# Dynamo graph Estribos en columna basica.dyn (Dynamo 3.6.0.9395)

datos_Entrada_Barra_Longitudinal = Custom[Datos_Entrada_Barra_Longitudinal]()  # Datos de entrada para Standard, Standard - 90 deg., Left, Right
pick_model_elements = DSModelElementMultipleSelection()  # 1 picked in the model
faces = Element.Faces(element=pick_model_elements)
code_block = CodeBlock { 0.5; }
normalAtParameter = Surface.NormalAtParameter(surface=faces, u=code_block, v=code_block)
ZAxis = Vector.ZAxis()
isParallel = Vector.IsParallel(vector=normalAtParameter, otherVector=ZAxis)
filterByBoolMask = List.FilterByBoolMask(list=faces, mask=isParallel)
identity = Object.Identity(object=filterByBoolMask.in)
code_block_2 = CodeBlock { 0.5; }
pointAtParameter = Surface.PointAtParameter(surface=filterByBoolMask.in, u=code_block_2, v=code_block_2)
Z = Point.Z(point=pointAtParameter)
minimumItem = List.MinimumItem(list=Z)
code_block_3 = CodeBlock(A=Z, B=minimumItem) { A==B; }
filterByBoolMask_2 = List.FilterByBoolMask(list=identity, mask=code_block_3)
identity_2 = Object.Identity(object=filterByBoolMask_2.in)
perimeterCurves = Surface.PerimeterCurves(surface=identity_2)
byGroupedCurves = PolyCurve.ByGroupedCurves(curves=perimeterCurves)
code_block_4 = CodeBlock { "Recubrimiento de armadura - Otras caras"; }
getParameterValueByName = Element.GetParameterValueByName(element=pick_model_elements, parameterName=code_block_4)
code_block_5 = CodeBlock { "Longitud"; }
getParameterValueByName_2 = Element.GetParameterValueByName(element=getParameterValueByName, parameterName=code_block_5)
code_block_6 = CodeBlock(recub=getParameterValueByName_2) { -recub; }
offsetMany = Curve.OffsetMany(curve=byGroupedCurves, signedDistance=code_block_6)
ZAxis_2 = Vector.ZAxis()
code_block_7 = CodeBlock { 0.05; }
translate = Geometry.Translate(geometry=offsetMany, direction=ZAxis_2, distance=code_block_7)
curves = PolyCurve.Curves(polyCurve=translate)
flatten = List.Flatten(list=curves)
ZAxis_3 = Vector.ZAxis()
code_block_8 = CodeBlock { "#4"; }
rebar_Bar_Type = Custom[Rebar_Bar_Type](Tipo_de_barra=code_block_8)  # Tipos de baras disponibles en el modelo de Revit
rebar_Estribos_135deg = Custom[Rebar_Estribos_135deg](Curvas=flatten, vector=ZAxis_3, Host_Element=pick_model_elements, Rebar_Bar_Type=rebar_Bar_Type.Rebar)
code_block_9 = CodeBlock { "Longitud del sistema"; }
getParameterValueByName_3 = Element.GetParameterValueByName(element=pick_model_elements, parameterName=code_block_9)
code_block_10 = CodeBlock(d=getParameterValueByName_3) { d-0.1; }
number = DoubleInput(0.15)
rebar_Espaciado_Máximo = Custom[Rebar_Espaciado_Máximo](Rebar=rebar_Estribos_135deg, Longitud_de_espaciado=code_block_10, Espaciado=number)
