# Dynamo custom node 00_Lineas_Rebar_Pórtico.dyf (Dynamo 3.5.2.8914)
# category: Revit
# Crea las lineas que representan el acero longitudinal de un tramo de vigas, sin traslapos.

Viga = Input(Viga: var[]..[])
rebar = Input(rebar: Revit.Elements.Element)
rebar_2 = Input(rebar: Revit.Elements.Element)
lineas_Acero_Vigas = Custom[Lineas_Acero_Vigas](element=Viga, rebar=rebar, rebar_2=rebar_2)  # Crea las lineas que representan el acero longitudinal de una viga horizontal
byStartPointEndPoint = Line.ByStartPointEndPoint(startPoint=lineas_Acero_Vigas.Sup_ini, endPoint=lineas_Acero_Vigas.Sup_fin)
Linea_Superior = Output(byStartPointEndPoint)
byStartPointEndPoint_2 = Line.ByStartPointEndPoint(startPoint=lineas_Acero_Vigas.Inf_ini, endPoint=lineas_Acero_Vigas.Inf_fin)
Linea_Inferior = Output(byStartPointEndPoint_2)
Vector = Output(lineas_Acero_Vigas.Vector)
Distancia_para_Espaciado = Output(lineas_Acero_Vigas.Distancia)
