# Dynamo custom node Barras_Y_Empalmes_Vigas_T1.dyf (Dynamo 3.6.0.9395)
# category: 01_Nodos_CQING
# Recibe las longitudes de las distancias las columnas, vigas y L_max. Sin voladizos. Barras con empalmes muy cerca a la cara de las columnas.

code_block = CodeBlock { A[0]; A[1]; }  # unwired: A
corrige_h2_y_t1 = Python(IN[0]=code_block.out0, IN[1]=code_block.out1)  # CPython3
# ---------- corrige_h2_y_t1.python (21 lines) ----------
# IN[0] = lista/número/None
# IN[1] = lista/número/None
a_raw = IN[0] if len(IN) > 0 else None
b_raw = IN[1] if len(IN) > 1 else None

def to_list(x):
    if x is None:
        return []
    return list(x) if isinstance(x, (list, tuple)) else [x]

a = to_list(a_raw)
b = to_list(b_raw)

if len(a) >= 3:
    a = a[:]
    a[1] = a[1] + 0.10
    if len(b) >= 2:
        b = b[:]
        b[1] = b[1] + 0.10

OUT = [a, b]
# ----------------------------------------
Y = Input(Y: var[]..[])
sort = List.Sort(list=Y)
Tipo_de_barra = Input(Tipo_de_barra: var[]..[])
T_min = Python(IN[0]=Tipo_de_barra)  # CPython3
# ---------- T_min.python (23 lines) ----------
text = IN[0] if len(IN) > 0 else ""
if text is None:
    text = ""
text = str(text)

# Ordenar de mayor a menor para priorizar el diámetro más grande encontrado
rules = [
    ("#8", 1.70),
    ("#7", 1.35),
    ("#6", 1.10),
    ("#5", 0.90),
    ("#4", 0.75),
    ("#3", 0.55),
    ("#2", 0.40),
]

T_min = None
for tag, val in rules:
    if tag in text:
        T_min = val
        break

OUT = T_min  # None si no se encontró ninguna etiqueta
# ----------------------------------------
agrega_lineas_de_empalmes = Python(IN[0]=sort, IN[1]=T_min)  # CPython3
# ---------- agrega_lineas_de_empalmes.python (28 lines) ----------
data = IN[0] if len(IN) > 0 else []
delta = IN[1] if len(IN) > 1 else 0

try:
    delta = float(delta)
except Exception:
    delta = 0.0

if data is None:
    data = []
elif not isinstance(data, (list, tuple)):
    data = [data]

n = len(data)
out = []
for idx, val in enumerate(data):
    # antes de cada item impar: item - delta
    if idx % 2 == 1:
        out.append(val - delta)

    # item original
    out.append(val)

    # después de cada item par, excepto si es el último
    if idx % 2 == 0 and idx < n - 1:
        out.append(val + delta)

OUT = out
# ----------------------------------------
L_Max = Input(L_Max: var[]..[])
Longitud_de_gancho = Input(Longitud_de_gancho: var[]..[])
h_y_t = Python(IN[0]=agrega_lineas_de_empalmes, IN[1]=L_Max, IN[2]=Longitud_de_gancho)  # CPython3
# ---------- h_y_t.python (298 lines) ----------
# -*- coding: utf-8 -*-
"""
IN[0] = [y0, y1, y2, ...]  (posiciones sobre el eje de la viga)
       0  = cara inicial de la 1ª columna (implícita)
       y0 = cara final   de la 1ª columna
       y1 = cara inicial de la 2ª columna
       y2 = cara final   de la 2ª columna
       y3 = cara inicial de la 3ª columna
       y4 = cara final   de la 3ª columna
       ...

IN[1] = L_max  (longitud máxima TOTAL de barra comercial)
IN[2] = g      (longitud de gancho en la primera y última barra)

OUT[0] = h  -> longitudes horizontales de barras (múltiplos de 0.10)
OUT[1] = T  -> longitudes de empalme entre barras consecutivas,
               con T[i] >= T_min  y  T[i] - T_min <= 0.20
"""

import math

yin  = IN[0]
Lmax = float(IN[1])
g    = float(IN[2])

# Asegurar lista
if not isinstance(yin, list):
    yin = [yin]

ys_extra = sorted([float(v) for v in yin])

if len(ys_extra) == 0:
    OUT = [[], []]

else:
    # Caras de columnas: 0 + y0,y1,y2,...
    caras   = [0.0] + ys_extra
    L_total = caras[-1]   # y_último

    # -------------------- T_min a partir de Y ----------------------------
    # Por tu definición: T_min = y1 - y0
    if len(ys_extra) >= 2:
        T_min = ys_extra[1] - ys_extra[0]
    else:
        T_min = 0.10
    if T_min <= 0:
        T_min = 0.10
    T_max = T_min + 0.20

    # -------------------- Caras cercanas y lejanas -----------------------
    n_caras = len(caras)
    if n_caras % 2 != 0:
        caras   = caras[:-1]
        n_caras = len(caras)

    n_cols = n_caras // 2
    if n_cols == 0:
        OUT = [[], []]

    else:
        caras_cercanas = [caras[2*i]     for i in range(n_cols)]  # 0,y1,y3,...
        caras_lejanas  = [caras[2*i + 1] for i in range(n_cols)]  # y0,y2,y4,...

        fin_tramo = caras_lejanas[-1]

        # ---------------------------------------------------------
        # 1) BARRAS GEOMÉTRICAS con traslapo = T_min (sin redondeo)
        # ---------------------------------------------------------
        barras_geom = []   # lista de (inicio, fin)
        start = caras_cercanas[0]  # 0
        tol   = 1e-6
        max_iter = 1000
        it = 0

        while start < fin_tramo - tol and it < max_iter:
            it += 1
            fin_max = start + Lmax
            candidatos = []

            # Caras cercanas por delante
            for x in caras_cercanas[1:]:
                if x > start + tol and x <= fin_max + tol:
                    candidatos.append(x)

            # Caras lejanas + T_min por delante
            for x in caras_lejanas:
                p = x + T_min
                if p > start + tol and p <= fin_tramo + tol and p <= fin_max + tol:
                    candidatos.append(p)

            # Permitir terminar en el final si está a alcance
            if fin_tramo - start <= Lmax + tol:
                candidatos.append(fin_tramo)

            if not candidatos:
                break

            end = max(candidatos)
            if end - start < tol:
                break

            barras_geom.append((start, end))

            if end >= fin_tramo - tol:
                break

            # Siguiente barra arranca T_min antes del final de la anterior
            start = end - T_min

        n = len(barras_geom)

        if n == 0:
            OUT = [[], []]

        # ---------------------------------------------------------
        # 2) CASO ESPECIAL: una sola barra → h0 = y_último (tu regla)
        # ---------------------------------------------------------
        elif n == 1:
            h0 = L_total
            OUT = [[round(h0, 3)], []]

        else:
            # -----------------------------------------------------
            # 3) Longitudes geométricas y redondeo de h
            # -----------------------------------------------------
            L_geom = [fin - ini for (ini, fin) in barras_geom]

            step = 0.10

            def redondear_h(Li, i_bar, n_barras, Lmax_val, g_val):
                """
                Barra interior: redondeo hacia arriba a múltiplo de 0.10,
                                capado a Lmax.
                Primera y última barra: redondeo hacia arriba,
                pero limitado a (Lmax - g) para garantizar h + g <= Lmax.
                """
                v = step * math.ceil((Li - 1e-9) / step)

                if i_bar == 0 or i_bar == n_barras - 1:
                    # límite horizontal para barras con gancho
                    Hmax_ext = Lmax_val - g_val
                    if Hmax_ext < 0:
                        Hmax_ext = 0.0
                    if v > Hmax_ext + 1e-9:
                        # si nos pasamos, recortamos hacia abajo al múltiplo de 0.10
                        v = step * math.floor((Hmax_ext + 1e-9) / step)
                        if v < 0:
                            v = 0.0
                else:
                    if v > Lmax_val:
                        v = Lmax_val

                return v

            # h[i] redondeadas con límite de gancho en primera y última
            h = [redondear_h(L_geom[i], i, n, Lmax, g) for i in range(n)]

            # Seguridad extra: h0 + g <= Lmax y h[-1] + g <= Lmax
            H_ext = Lmax - g
            if H_ext < 0:
                H_ext = 0.0
            if h[0] > H_ext + 1e-9:
                h[0] = step * math.floor((H_ext + 1e-9) / step)
            if h[-1] > H_ext + 1e-9:
                h[-1] = step * math.floor((H_ext + 1e-9) / step)

            # Increments por redondeo respecto a la geometría
            delta_h = [h[i] - L_geom[i] for i in range(n)]
            sum_delta_h = sum(delta_h)

            # Si sum_delta_h < 0, intentamos corregir alargando barras interiores
            if sum_delta_h < 0:
                falta = -sum_delta_h
                for i in range(1, n-1):  # solo barras interiores
                    while falta > 1e-9 and h[i] + step <= Lmax + 1e-9:
                        h[i] += step
                        delta_h[i] += step
                        falta -= step
                sum_delta_h = sum(delta_h)

            if sum_delta_h < -1e-6:
                # Sin solución estricta -> todos los empalmes a T_min
                T = [T_min]*(n-1)
            else:
                # -------------------------------------------------
                # 4) Empalmes T: T_i = T_min + δ_i
                #    con sum(δ_i) = sum_delta_h y 0 <= δ_i <= 0.20
                # -------------------------------------------------
                deltas_T = [0.0]*(n-1)
                remaining = sum_delta_h
                max_inc   = 0.20

                for i in range(n-1):
                    if remaining <= 1e-9:
                        break
                    inc = min(max_inc, remaining)
                    deltas_T[i] = inc
                    remaining   -= inc

                # Clamp por seguridad
                for i in range(n-1):
                    if deltas_T[i] < 0.0:
                        deltas_T[i] = 0.0
                    if deltas_T[i] > 0.20:
                        deltas_T[i] = 0.20

                T = [T_min + d for d in deltas_T]

            # Clamp general T al rango [T_min, T_max]
            for i in range(len(T)):
                if T[i] < T_min:
                    T[i] = T_min
                if T[i] > T_max + 1e-9:
                    T[i] = T_max

            # -----------------------------------------------------
            # 5) Ajuste ESPECÍFICO del ÚLTIMO empalme y h_última
            #    para que el inicio de la última barra
            #    NO quede dentro de columnas interiores.
            #    (solo columnas 2..(n_cols-1))
            # -----------------------------------------------------
            if n >= 2 and n_cols >= 3:
                # Columnas interiores (excluimos primera y última)
                columnas_int = []
                for j in range(1, n_cols-1):
                    a = min(caras_cercanas[j], caras_lejanas[j])
                    b = max(caras_cercanas[j], caras_lejanas[j])
                    columnas_int.append((a, b))

                def en_columna_interior(x):
                    for a, b in columnas_int:
                        if x > a + 1e-6 and x < b - 1e-6:
                            return True
                    return False

                # Inicio actual de la última barra
                S_last_actual = L_total - h[-1]

                if en_columna_interior(S_last_actual):
                    # Queremos un h_ult (múltiplo 0.10, <= Lmax - g)
                    # tal que el nuevo inicio no esté en ninguna columna interior
                    Hmax_ext = Lmax - g
                    if Hmax_ext < 0:
                        Hmax_ext = 0.0

                    sum_h_sin_ult = sum(h[:-1])
                    sum_T_sin_ult = sum(T[:-1])

                    # h_ult no puede ser mayor que Hmax_ext ni mayor que L_total
                    h_ult_sup = min(Hmax_ext, L_total)
                    k_max = int(math.floor((h_ult_sup + 1e-9) / step))

                    mejor_h = None
                    mejor_T = None

                    # Recorremos de la longitud mayor posible hacia abajo
                    for k in range(k_max, -1, -1):
                        h_cand = k * step
                        if h_cand <= 0:
                            continue

                        S_last_cand = L_total - h_cand
                        if en_columna_interior(S_last_cand):
                            continue

                        # Empalme necesario para mantener cobertura exacta
                        T_last_cand = (sum_h_sin_ult + h_cand) - L_total - sum_T_sin_ult

                        if T_last_cand < T_min - 1e-6 or T_last_cand > T_max + 1e-6:
                            continue

                        mejor_h = h_cand
                        mejor_T = T_last_cand
                        break  # tomamos el primero: barra más larga posible

                    if mejor_h is not None:
                        h[-1] = mejor_h
                        T[-1] = mejor_T
                    # Si no encontramos candidato válido, dejamos los valores tal como estaban

            # -----------------------------------------------------
            # 6) Comprobación de cierre (solo corrige errores numéricos)
            # -----------------------------------------------------
            cobertura = sum(h) - sum(T)
            error = cobertura - L_total
            if abs(error) > 1e-6 and len(T) > 0:
                T[-1] += error
                # volver a clamped
                if T[-1] < T_min:
                    T[-1] = T_min
                if T[-1] > T_max:
                    T[-1] = T_max

            # Salida redondeada para Dynamo (solo visual)
            h_out = [round(val, 3) for val in h]
            T_out = [round(val, 3) for val in T]

            OUT = [h_out, T_out]
# ----------------------------------------
OUT = Output(h_y_t)
watch = Watch(h_y_t)
