# Dynamo custom node BaseB_AlturaH_Vigas_Columnas.dyf (Dynamo 3.0.3.7597)
# category: 01_Nodos_CQING
# Obtiene los valores de la seccion trasnversal (B y H) de vigas o columnas.

element = Input(element: Revit.Elements.Element)
code_block = CodeBlock { "Tipo"; }
getParameterValueByName = Element.GetParameterValueByName(element=element, parameterName=code_block)
code_block_2 = CodeBlock { "b"; "h"; }
base = Element.GetParameterValueByName(element=getParameterValueByName, parameterName=code_block_2.out0)
Base_B = Output(base)
altura = Element.GetParameterValueByName(element=getParameterValueByName, parameterName=code_block_2.out1)
Altura_H = Output(altura)
