# Dynamo custom node Cambiar_Forma_De_Armadura.dyf (Dynamo 3.5.2.8914)
# category: 01_Nodos_CQING
# Cambia el parámetro "Forma" de elementos Rebar

Rebar = Input(Rebar: Revit.Elements.Element)
code_block = CodeBlock { "Forma"; }
obtiene_todos_los_elementtype = Python()  # "Obtiene todos los ElementType del documento de Revit"; CPython3
# ---------- obtiene_todos_los_elementtype.python (12 lines) ----------
import clr
clr.AddReference('RevitServices')
from RevitServices.Persistence import DocumentManager
doc = DocumentManager.Instance.CurrentDBDocument

clr.AddReference('RevitAPI')
from Autodesk.Revit.DB import FilteredElementCollector, ElementType

# Obtener todos los ElementType del documento
element_types = FilteredElementCollector(doc).OfClass(ElementType).ToElements()

OUT = element_types
# ----------------------------------------
name = ElementType.Name(elementType=obtiene_todos_los_elementtype)
Forma_De_Armadura = Input(Forma_De_Armadura: var[]..[])  # Nombre de entrada por defecto; cambie el nombre.
code_block_2 = CodeBlock(a=name, b=Forma_De_Armadura) { a==b; }
filterByBoolMask = List.FilterByBoolMask(list=obtiene_todos_los_elementtype, mask=code_block_2)
identity = Object.Identity(object=filterByBoolMask.in)
familyName = ElementType.FamilyName(elementType=identity)
code_block_3 = CodeBlock(a=familyName) { a=="Forma de armadura"; }
filterByBoolMask_2 = List.FilterByBoolMask(list=identity, mask=code_block_3)
identity_2 = Object.Identity(object=filterByBoolMask_2.in)
setParameterByName = Element.SetParameterByName(element=Rebar, parameterName=code_block, value=identity_2, lacing=Longest)
flatten = List.Flatten(list=setParameterByName)
Rebar_2 = Output(flatten)  # "Rebar"
