# Dynamo custom node Caras_Lejanas_Dirección.dyf (Dynamo 3.0.3.7597)
# category: Geometry
# Obtienen las caras lejanas entre sí, paralelas conectadas por una misma linea. IN[0] = Surfaces , IN[1] = Linea

Surfaces = Input(Surfaces: var[]..[])
Linea = Input(Linea: var[]..[])
obtiene_surfaces_que_se = Python(IN[0]=Surfaces, IN[1]=Linea)  # "Obtiene surfaces que se intersecan con una linea dada una lista de surfaces (IN[0]) y una linea (IN[1])"; CPython3
# ---------- obtiene_surfaces_que_se.python (24 lines) ----------
import clr
clr.AddReference('ProtoGeometry')
from Autodesk.DesignScript.Geometry import *

# IN[0]: lista de superficies (surfaces)
# IN[1]: línea (line)
surfaces = IN[0]
line = IN[1]

# Lista para almacenar superficies que intersectan
intersected_surfaces = []

for s in surfaces:
    try:
        # Intenta obtener el punto o curva de intersección
        intersection = s.Intersect(line)
        # Si no es None ni está vacía, hay intersección
        if intersection and len(intersection) > 0:
            intersected_surfaces.append(s)
    except:
        # Si ocurre algún error, simplemente pasa
        pass

OUT = intersected_surfaces
# ----------------------------------------
obtiene_caras_surfaces_mas = Python(IN[0]=obtiene_surfaces_que_se)  # "Obtiene caras (Surfaces) mas lejanas entre si"; CPython3
# ---------- obtiene_caras_surfaces_mas.python (26 lines) ----------
import clr
import sys
clr.AddReference('ProtoGeometry')
from Autodesk.DesignScript.Geometry import *

# IN[0] = surfaces
surfaces = IN[0]

def surface_center(surface):
    # Calcula el punto central en parámetros UV (0.5, 0.5)
    return surface.PointAtParameter(0.5, 0.5)

max_dist = -1
pair = (None, None)

n = len(surfaces)
for i in range(n):
    center_i = surface_center(surfaces[i])
    for j in range(i+1, n):
        center_j = surface_center(surfaces[j])
        dist = center_i.DistanceTo(center_j)
        if dist > max_dist:
            max_dist = dist
            pair = (surfaces[i], surfaces[j])

OUT = pair, max_dist
# ----------------------------------------
code_block = CodeBlock { 0; }
caras_mas_distantes_entre_si = List.GetItemAtIndex(list=obtiene_caras_surfaces_mas, index=code_block)
item = Output(caras_mas_distantes_entre_si)
