# Dynamo custom node Cota_Rebar_Recublimiento_Zapata_Dimension.dyf (Dynamo 3.6.0.9395)
# category: 01_Nodos_CQING
# Genera las cotas de las armaduras con el recubrimiento de la zapata

Vistas_Long = Input(Vistas_Long: var[]..[])  # Lista plana de vistas.
surfaces_Long = Input(surfaces_Long: var[]..[])  # Un par de surfaces por cada zapata.
code_block = CodeBlock { 0; 1; }
list_getitematindex_surfaces_2 = Custom[List_GetItemAtIndex. Surfaces 2](Lista=surfaces_Long@L2, Ítem=code_block.out1)  # List.GetItemAtIndex
bySurface = Revit.GeometryReferences.ElementFaceReference.BySurface(surface=list_getitematindex_surfaces_2)
zapatas = Input(zapatas: var[]..[])  # Lista plana de zapatas.
rebars_Hospedadas = Custom[Rebars_Hospedadas](Elementos=zapatas)  # Obtiene las barras de armaduras hospedadas
geometry = Element.Geometry(element=zapatas)
flatten = List.Flatten(list=geometry)
centroid = Solid.Centroid(solid=flatten)
Z = Point.Z(point=centroid)
rebar_CenterLine = Custom[Rebar_CenterLine](Rebar=rebars_Hospedadas@L2)  # Obtiene la CenterLine de una barra recta
length = Curve.Length(curve=rebar_CenterLine)
maximumItem = List.MaximumItem(list=length)
code_block_2 = CodeBlock(A=length, B=maximumItem) { A==B; }
filterByBoolMask = List.FilterByBoolMask(list=rebar_CenterLine, mask=code_block_2)
code_block_3 = CodeBlock { 0; }
list_GetItemAtIndex = Custom[List_GetItemAtIndex](Lista=filterByBoolMask.in@@L3, Ítem=code_block_3)  # List.GetItemAtIndex
flatten_2 = List.Flatten(list=list_GetItemAtIndex@L3)
startPoint = Curve.StartPoint(curve=flatten_2)
Z_2 = Point.Z(point=startPoint)
code_block_4 = CodeBlock(A=Z, B=Z_2) { A>B; }
filterByBoolMask_2 = List.FilterByBoolMask(list=rebars_Hospedadas, mask=code_block_4)
rebar_centerline_parrilla = Custom[Rebar_CenterLine. Parrilla inferior](Rebar=filterByBoolMask_2.in@L2)  # Obtiene la CenterLine de una barra recta
length_2 = Curve.Length(curve=rebar_centerline_parrilla)
maximumItem_2 = List.MaximumItem(list=length_2)
code_block_5 = CodeBlock(A=length_2, B=maximumItem_2) { A==B; }
filterByBoolMask_3 = List.FilterByBoolMask(list=rebar_centerline_parrilla, mask=code_block_5)
code_block_6 = CodeBlock { 0; }
list_GetItemAtIndex_2 = Custom[List_GetItemAtIndex](Lista=filterByBoolMask_3.in@@L3, Ítem=code_block_6)
flatten_3 = List.Flatten(list=list_GetItemAtIndex_2@L3)
length_3 = Curve.Length(curve=flatten_3)
maximumItem_3 = List.MaximumItem(list=length_3)
code_block_7 = CodeBlock(A=length_3, B=maximumItem_3) { A==B; }
filterByBoolMask_4 = List.FilterByBoolMask(list=filterByBoolMask_2.in, mask=code_block_7)
list_flatten_inf_long = List.Flatten(list=filterByBoolMask_4.out)

# group: 
# Descripción <Haga doble clic aquí para editar la descripción del grupo>
referencias_de_rebar = Python(IN[0]=list_flatten_inf_long, IN[1]=Vistas_Long)  # CPython3
# ---------- referencias_de_rebar.python (154 lines) ----------
import clr

# Importar bibliotecas principales de Revit API
clr.AddReference('RevitAPI')
from Autodesk.Revit.DB import *

# Importar Servicios de Documentos
clr.AddReference('RevitServices')
import RevitServices
from RevitServices.Persistence import DocumentManager

# Importar bibliotecas de Dynamo para conversión de geometría
clr.AddReference('RevitNodes')
import Revit
clr.ImportExtensions(Revit.GeometryConversion)

doc = DocumentManager.Instance.CurrentDBDocument

# --- GESTIÓN ROBUSTA DE ENTRADAS ---
input_elements = UnwrapElement(IN[0])
input_views = UnwrapElement(IN[1]) # Nueva entrada para vistas

# 1. Normalizar Elementos a lista
if isinstance(input_elements, list):
    elements = input_elements
else:
    elements = [input_elements]

# 2. Normalizar Vistas a lista alineada con los elementos
if isinstance(input_views, list):
    views = input_views
    # Nota: Si la lista de vistas es más corta que la de elementos, 
    # el bucle 'zip' se detendrá en el más corto.
else:
    # Si es una sola vista, repetirla para cada elemento
    views = [input_views] * len(elements)

def get_separated_references(element, specific_view):
    """
    Extrae referencias separando Superficies de Líneas/Curvas.
    Usa la vista específica proporcionada para la geometría dependiente de vista.
    """
    # Listas para Superficies (Faces)
    s_refs = []
    s_geoms = []
    
    # Listas para Líneas (Edges, Curves, Points)
    c_refs = []
    c_geoms = []
    
    # Definir configuraciones de extracción
    options_list = []
    
    # 1. Configuración de Modelo (Geometría 3D pura, independiente de la vista)
    opt_model = Options()
    opt_model.ComputeReferences = True
    opt_model.DetailLevel = ViewDetailLevel.Fine
    opt_model.IncludeNonVisibleObjects = True 
    options_list.append(opt_model)
    
    # 2. Configuración de Vista Específica (Geometría proyectada/dependiente)
    if specific_view:
        try:
            opt_view = Options()
            opt_view.ComputeReferences = True
            opt_view.IncludeNonVisibleObjects = True
            # Asignamos la vista específica pasada por argumento
            opt_view.View = specific_view
            options_list.append(opt_view)
        except:
            pass # Si la vista no es válida, ignoramos esta opción

    def process_geometry_object(g):
        
        # --- CASO A: SÓLIDOS ---
        if isinstance(g, Solid):
            # Caras -> Lista de Superficies
            if g.Faces:
                for face in g.Faces:
                    if face.Reference:
                        s_refs.append(face.Reference)
                        s_geoms.append(face.ToProtoType())
            # Bordes -> Lista de Curvas
            if g.Edges:
                for edge in g.Edges:
                    if edge.Reference:
                        c = edge.AsCurve()
                        if c:
                            c_refs.append(edge.Reference)
                            c_geoms.append(c.ToProtoType())

        # --- CASO B: CURVAS ---
        elif isinstance(g, Curve):
            if g.Reference:
                c_refs.append(g.Reference)
                c_geoms.append(g.ToProtoType())

        # --- CASO C: PUNTOS ---
        elif isinstance(g, Point):
            if g.Reference:
                c_refs.append(g.Reference)
                c_geoms.append(g.ToProtoType())
                
        # --- CASO D: POLILÍNEAS ---
        elif isinstance(g, PolyLine):
             try:
                 pass 
             except:
                 pass

        # --- CASO E: INSTANCIAS ---
        elif isinstance(g, GeometryInstance):
            inst_geo = g.GetInstanceGeometry()
            if inst_geo:
                for sub_g in inst_geo:
                    process_geometry_object(sub_g)

    # Ejecutar la extracción para cada configuración
    for opt in options_list:
        try:
            geom_elem = element.get_Geometry(opt)
            if geom_elem:
                for geom_obj in geom_elem:
                    process_geometry_object(geom_obj)
        except Exception:
            continue
            
    return s_refs, s_geoms, c_refs, c_geoms

# Listas maestras de salida
out_surf_refs = []  # OUT[0]
out_surf_geoms = [] # OUT[1]
out_curve_refs = [] # OUT[2]
out_curve_geoms = []# OUT[3]

# Procesar pares (Elemento, Vista)
# Usamos 'zip' para iterar ambas listas simultáneamente
for elem, view in zip(elements, views):
    try:
        sr, sg, cr, cg = get_separated_references(elem, view)
        
        out_surf_refs.append(sr)
        out_surf_geoms.append(sg)
        out_curve_refs.append(cr)
        out_curve_geoms.append(cg)
    except Exception:
        # Si falla, mantenemos la estructura de la lista con listas vacías
        out_surf_refs.append([])
        out_surf_geoms.append([])
        out_curve_refs.append([])
        out_curve_geoms.append([])

# Estructura de salida ordenada
OUT = [out_surf_refs, out_surf_geoms, out_curve_refs, out_curve_geoms]
# ----------------------------------------

code_block_8 = CodeBlock { 3; }
list_GetItemAtIndex_3 = Custom[List_GetItemAtIndex](Lista=referencias_de_rebar, Ítem=code_block_8)
vector_By_Line = Custom[Vector_By_Line](Linea=list_GetItemAtIndex_3)  # Crea un vector a partir de una linea
ZAxis = Vector.ZAxis()
isParallel = Vector.IsParallel(vector=vector_By_Line, otherVector=ZAxis)
filterByBoolMask_5 = List.FilterByBoolMask(list=list_GetItemAtIndex_3, mask=isParallel)
code_block_9 = CodeBlock { 2; 3; }
list_GetItemAtIndex_4 = Custom[List_GetItemAtIndex](Lista=filterByBoolMask_5.in@L2, Ítem=code_block_9.out1)
list_GetItemAtIndex_5 = Custom[List_GetItemAtIndex](Lista=filterByBoolMask_5.in@L2, Ítem=code_block_9.out0)
list_create = List.Create(item0=list_GetItemAtIndex_4, item1=list_GetItemAtIndex_5)
transpose = List.Transpose(lists=list_create)
list_getitematindex_surfaces_1 = Custom[List_GetItemAtIndex. Surfaces 1](Lista=surfaces_Long@L2, Ítem=code_block.out0)  # List.GetItemAtIndex
distanceTo = Geometry.DistanceTo(geometry=list_getitematindex_surfaces_1, other=transpose)
minimumItem = List.MinimumItem(list=distanceTo)
code_block_10 = CodeBlock(A=distanceTo, B=minimumItem) { A==B; }
filterByBoolMask_6 = List.FilterByBoolMask(list=transpose, mask=code_block_10)
list_flatten_lineas_más_cercanas = List.Flatten(list=filterByBoolMask_6.out)  # "List.Flatten. Lineas más cercanas a la surface 2"
byCurve = Revit.GeometryReferences.ElementCurveReference.ByCurve(curve=list_flatten_lineas_más_cercanas)
list_create_2 = List.Create(item0=bySurface, item1=byCurve)
transpose_2 = List.Transpose(lists=list_create_2)
rebar_CenterLine_2 = Custom[Rebar_CenterLine](Rebar=list_flatten_inf_long)
length_4 = Curve.Length(curve=rebar_CenterLine_2)
maximumItem_4 = List.MaximumItem(list=length_4)
code_block_11 = CodeBlock(A=length_4, B=maximumItem_4) { A==B; }
filterByBoolMask_7 = List.FilterByBoolMask(list=rebar_CenterLine_2, mask=code_block_11)
code_block_12 = CodeBlock { 0; }
list_GetItemAtIndex_6 = Custom[List_GetItemAtIndex](Lista=filterByBoolMask_7.in@L3, Ítem=code_block_12)
flatten_4 = List.Flatten(list=list_GetItemAtIndex_6)
ZAxis_2 = Vector.ZAxis()
Offset_z = Input(Offset_z: double)
translate = Geometry.Translate(geometry=flatten_4, direction=ZAxis_2, distance=Offset_z)
byReferences = Dimension.ByReferences(view=Vistas_Long, referenceGeometries=transpose_2, line=translate)
bySurface_2 = Revit.GeometryReferences.ElementFaceReference.BySurface(surface=list_getitematindex_surfaces_1)
list_flatten_lineas_más_cercanas_2 = List.Flatten(list=filterByBoolMask_6.in)  # "List.Flatten. Lineas más cercanas a la surface 1"
byCurve_2 = Revit.GeometryReferences.ElementCurveReference.ByCurve(curve=list_flatten_lineas_más_cercanas_2)
list_create_3 = List.Create(item0=bySurface_2, item1=byCurve_2)
transpose_3 = List.Transpose(lists=list_create_3)
byReferences_2 = Dimension.ByReferences(view=Vistas_Long, referenceGeometries=transpose_3, line=translate)
list_create_4 = List.Create(item0=byReferences, item1=byReferences_2)
transpose_4 = List.Transpose(lists=list_create_4)
Dimension_Long = Output(transpose_4)
vistas_Trans = Input(vistas_Trans: var[]..[])  # Lista plana de vistas.
surfaces_Trans = Input(surfaces_Trans: var[]..[])  # Un par de surfaces por cada zapata.
code_block_13 = CodeBlock { 0; 1; }
list_getitematindex_surfaces_2_2 = Custom[List_GetItemAtIndex. Surfaces 2](Lista=surfaces_Trans@L2, Ítem=code_block_13.out1)
bySurface_3 = Revit.GeometryReferences.ElementFaceReference.BySurface(surface=list_getitematindex_surfaces_2_2)
list_flatten_inf_trans = List.Flatten(list=filterByBoolMask_4.in)

# group: 
# Descripción <Haga doble clic aquí para editar la descripción del grupo>
referencias_de_rebar_2 = Python(IN[0]=list_flatten_inf_trans, IN[1]=vistas_Trans)  # CPython3; same code as referencias_de_rebar

code_block_14 = CodeBlock { 3; }
list_GetItemAtIndex_7 = Custom[List_GetItemAtIndex](Lista=referencias_de_rebar_2, Ítem=code_block_14)
vector_By_Line_2 = Custom[Vector_By_Line](Linea=list_GetItemAtIndex_7)
ZAxis_3 = Vector.ZAxis()
isParallel_2 = Vector.IsParallel(vector=vector_By_Line_2, otherVector=ZAxis_3)
filterByBoolMask_8 = List.FilterByBoolMask(list=list_GetItemAtIndex_7, mask=isParallel_2)
code_block_15 = CodeBlock { 2; 3; }
list_GetItemAtIndex_8 = Custom[List_GetItemAtIndex](Lista=filterByBoolMask_8.in@L2, Ítem=code_block_15.out1)
list_GetItemAtIndex_9 = Custom[List_GetItemAtIndex](Lista=filterByBoolMask_8.in@L2, Ítem=code_block_15.out0)
list_create_5 = List.Create(item0=list_GetItemAtIndex_8, item1=list_GetItemAtIndex_9)
transpose_5 = List.Transpose(lists=list_create_5)
list_getitematindex_surfaces_1_2 = Custom[List_GetItemAtIndex. Surfaces 1](Lista=surfaces_Trans@L2, Ítem=code_block_13.out0)
distanceTo_2 = Geometry.DistanceTo(geometry=list_getitematindex_surfaces_1_2, other=transpose_5)
minimumItem_2 = List.MinimumItem(list=distanceTo_2)
code_block_16 = CodeBlock(A=distanceTo_2, B=minimumItem_2) { A==B; }
filterByBoolMask_9 = List.FilterByBoolMask(list=transpose_5, mask=code_block_16)
list_flatten_lineas_más_cercanas_3 = List.Flatten(list=filterByBoolMask_9.out)  # "List.Flatten. Lineas más cercanas a la surface 2"
byCurve_3 = Revit.GeometryReferences.ElementCurveReference.ByCurve(curve=list_flatten_lineas_más_cercanas_3)
list_create_6 = List.Create(item0=bySurface_3, item1=byCurve_3)
transpose_6 = List.Transpose(lists=list_create_6)
rebar_CenterLine_3 = Custom[Rebar_CenterLine](Rebar=list_flatten_inf_trans)
length_5 = Curve.Length(curve=rebar_CenterLine_3)
maximumItem_5 = List.MaximumItem(list=length_5)
code_block_17 = CodeBlock(A=length_5, B=maximumItem_5) { A==B; }
filterByBoolMask_10 = List.FilterByBoolMask(list=rebar_CenterLine_3, mask=code_block_17)
code_block_18 = CodeBlock { 0; }
list_GetItemAtIndex_10 = Custom[List_GetItemAtIndex](Lista=filterByBoolMask_10.in@L3, Ítem=code_block_18)
flatten_5 = List.Flatten(list=list_GetItemAtIndex_10)
ZAxis_4 = Vector.ZAxis()
translate_2 = Geometry.Translate(geometry=flatten_5, direction=ZAxis_4, distance=Offset_z)
byReferences_3 = Dimension.ByReferences(view=vistas_Trans, referenceGeometries=transpose_6, line=translate_2)
bySurface_4 = Revit.GeometryReferences.ElementFaceReference.BySurface(surface=list_getitematindex_surfaces_1_2)
list_flatten_lineas_más_cercanas_4 = List.Flatten(list=filterByBoolMask_9.in)  # "List.Flatten. Lineas más cercanas a la surface 1"
byCurve_4 = Revit.GeometryReferences.ElementCurveReference.ByCurve(curve=list_flatten_lineas_más_cercanas_4)
list_create_7 = List.Create(item0=bySurface_4, item1=byCurve_4)
transpose_7 = List.Transpose(lists=list_create_7)
byReferences_4 = Dimension.ByReferences(view=vistas_Trans, referenceGeometries=transpose_7, line=translate_2)
list_create_8 = List.Create(item0=byReferences_3, item1=byReferences_4)
transpose_8 = List.Transpose(lists=list_create_8)
Dimension_Trans = Output(transpose_8)
vistas_PLAN = Input(vistas_PLAN: var[]..[])  # Lista plana de vistas.
distanceTo_3 = Geometry.DistanceTo(geometry=surfaces_Trans, other=translate)
maximumItem_6 = List.MaximumItem(list=distanceTo_3)
code_block_19 = CodeBlock(A=distanceTo_3, B=maximumItem_6) { A==B; }
filterByBoolMask_11 = List.FilterByBoolMask(list=surfaces_Trans, mask=code_block_19)
flatten_6 = List.Flatten(list=filterByBoolMask_11.in)
code_block_20 = CodeBlock { 0.5; }
normalAtParameter = Surface.NormalAtParameter(surface=flatten_6, u=code_block_20, v=code_block_20)
transpose_9 = List.Transpose(lists=surfaces_Trans)
code_block_21 = CodeBlock { 0; 1; }
list_GetItemAtIndex_11 = Custom[List_GetItemAtIndex](Lista=transpose_9, Ítem=code_block_21.out0)
list_GetItemAtIndex_12 = Custom[List_GetItemAtIndex](Lista=transpose_9, Ítem=code_block_21.out1)
distanceTo_4 = Geometry.DistanceTo(geometry=list_GetItemAtIndex_11, other=list_GetItemAtIndex_12)
translate_3 = Geometry.Translate(geometry=translate, direction=normalAtParameter, distance=distanceTo_4)
dimension_byreferences_long_plan = Dimension.ByReferences(view=vistas_PLAN, referenceGeometries=transpose_2, line=translate_3)
dimension_byreferences_trans = Dimension.ByReferences(view=vistas_PLAN, referenceGeometries=transpose_3, line=translate_3)  # "Dimension.ByReferences - TRANS - PLAN"
list_create_9 = List.Create(item0=dimension_byreferences_long_plan, item1=dimension_byreferences_trans)
distanceTo_5 = Geometry.DistanceTo(geometry=surfaces_Long, other=translate_2)
maximumItem_7 = List.MaximumItem(list=distanceTo_5)
code_block_22 = CodeBlock(A=distanceTo_5, B=maximumItem_7) { A==B; }
filterByBoolMask_12 = List.FilterByBoolMask(list=surfaces_Long, mask=code_block_22)
flatten_7 = List.Flatten(list=filterByBoolMask_12.in)
code_block_23 = CodeBlock { 0.5; }
normalAtParameter_2 = Surface.NormalAtParameter(surface=flatten_7, u=code_block_23, v=code_block_23)
transpose_10 = List.Transpose(lists=surfaces_Long)
code_block_24 = CodeBlock { 0; 1; }
list_GetItemAtIndex_13 = Custom[List_GetItemAtIndex](Lista=transpose_10, Ítem=code_block_24.out0)
list_GetItemAtIndex_14 = Custom[List_GetItemAtIndex](Lista=transpose_10, Ítem=code_block_24.out1)
distanceTo_6 = Geometry.DistanceTo(geometry=list_GetItemAtIndex_13, other=list_GetItemAtIndex_14)
code_block_25 = CodeBlock(A=distanceTo_6) { A+0.2; }
translate_4 = Geometry.Translate(geometry=translate_2, direction=normalAtParameter_2, distance=code_block_25)
dimension_byreferences_long_plan_2 = Dimension.ByReferences(view=vistas_PLAN, referenceGeometries=transpose_6, line=translate_4)
dimension_byreferences_trans_2 = Dimension.ByReferences(view=vistas_PLAN, referenceGeometries=transpose_7, line=translate_4)  # "Dimension.ByReferences - TRANS - PLAN"
list_create_10 = List.Create(item0=dimension_byreferences_long_plan_2, item1=dimension_byreferences_trans_2)
list_create_11 = List.Create(item0=list_create_9, item1=list_create_10)
Dimension_PLAN = Output(list_create_11)
