# Dynamo custom node Curvas_Rectángulo_Confinamiento_Estribos_Rebar_Vigas_Pórtico.dyf (Dynamo 3.5.2.8914)
# category: 01_Nodos_CQING
# Dada una viga, crea curvas de estribos en zona de confinamiento y no confinamiento para cada viga del Pórtico

Curvas_Iniciales = Input(Curvas_Iniciales: var)
code_block = CodeBlock { 0; }
getItemAtIndex = List.GetItemAtIndex(list=Curvas_Iniciales, index=code_block)
Lineas_Tramos_Vigas = Input(Lineas_Tramos_Vigas: var[]..[])
identity = Object.Identity(object=Lineas_Tramos_Vigas)
firstItem = List.FirstItem(list=identity)
identity_2 = Object.Identity(object=firstItem)
startPoint = Curve.StartPoint(curve=identity_2)
endPoint = Curve.EndPoint(curve=identity_2)
byStartPointEndPoint = Line.ByStartPointEndPoint(startPoint=startPoint, endPoint=endPoint)
vector_By_Line = Custom[Vector_By_Line](Linea=byStartPointEndPoint)  # Crea un vector a partir de una linea
Longitud_Confinamiento = Input(Longitud_Confinamiento: var)
identity_3 = Object.Identity(object=Longitud_Confinamiento)
Espaciado_Sin_Confinamiento = Input(Espaciado_Sin_Confinamiento: var)
identity_4 = Object.Identity(object=Espaciado_Sin_Confinamiento)
code_block_2 = CodeBlock(Long_conf=identity_3, Esp_No_Conf=identity_4) { Long_conf+Esp_No_Conf-0.05; }
translate = Geometry.Translate(geometry=getItemAtIndex, direction=vector_By_Line, distance=code_block_2)
startPoint_2 = Curve.StartPoint(curve=identity, lacing=Longest)
endPoint_2 = Curve.EndPoint(curve=identity, lacing=Longest)
byStartPointEndPoint_2 = Line.ByStartPointEndPoint(startPoint=startPoint_2, endPoint=endPoint_2, lacing=Longest)
length = Curve.Length(curve=byStartPointEndPoint_2, lacing=Longest)
code_block_3 = CodeBlock(L_Viga=length, Long_Conf=identity_3) { L_Viga-Long_Conf-0.05; }
translate_2 = Geometry.Translate(geometry=getItemAtIndex, direction=vector_By_Line, distance=code_block_3)
list_create = List.Create(item0=getItemAtIndex, item1=translate, item2=translate_2)
Curvas_Estribos__Transponer_si_es_necesa = Output(list_create)  # "Curvas_Estribos_(Transponer_si_es_necesario)"
python_script = Python()  # CPython3; unwired: IN[0]; starter script, not edited (OUT = 0)
watch = Watch(Lineas_Tramos_Vigas)
