# Dynamo custom node Curvas_Rectángulo_Inicial_Estribos_Rebar_Vigas_Pórtico.dyf (Dynamo 3.5.2.8914)
# category: 01_Nodos_CQING
# Dada una viga en un pórtico, crea las curvas para los estribos en la posición inicial de cada viga.

Viga = Input(Viga: var)
elementos_Pórtico = Custom[Elementos_Pórtico](Viga=Viga)  # Obtiene todos los elementos que intervienen en un pórtico
flatten = List.Flatten(list=elementos_Pórtico)
categories = Categories("OST_StructuralFraming")
filter_Element_By_Category = Custom[Filter_Element_By_Category](Element=flatten, Categoria=categories)
uniqueItems = List.UniqueItems(list=filter_Element_By_Category)
faces = Element.Faces(element=uniqueItems)
caras_de_las_vigas_del_pórtico = List.Flatten(list=faces)
identity = Object.Identity(object=caras_de_las_vigas_del_pórtico)
Linea_Superior_Portico = Input(Linea_Superior_Portico: var)
startPoint = Curve.StartPoint(curve=Linea_Superior_Portico)
identity_2 = Object.Identity(object=startPoint)
firstItem = List.FirstItem(list=identity_2)
identity_3 = Object.Identity(object=Linea_Superior_Portico)
firstItem_2 = List.FirstItem(list=identity_3)
vector_By_Line = Custom[Vector_By_Line](Linea=firstItem_2)  # Crea un vector a partir de una linea
code_block = CodeBlock { 500; -1000; }
byStartPointDirectionLength = Line.ByStartPointDirectionLength(startPoint=firstItem, direction=vector_By_Line, length=code_block.out0)
endPoint = Curve.EndPoint(curve=byStartPointDirectionLength)
byStartPointDirectionLength_2 = Line.ByStartPointDirectionLength(startPoint=endPoint, direction=vector_By_Line, length=code_block.out1)
obtiene_surfaces_que_se = Python(IN[0]=identity, IN[1]=byStartPointDirectionLength_2)  # "Obtiene surfaces que se intersecan con una linea dada una lista de surfaces (IN[0]) y una linea (IN[1])"; CPython3
# ---------- obtiene_surfaces_que_se.python (24 lines) ----------
import clr
clr.AddReference('ProtoGeometry')
from Autodesk.DesignScript.Geometry import *

# IN[0]: lista de superficies (surfaces)
# IN[1]: línea (line)
surfaces = IN[0]
line = IN[1]

# Lista para almacenar superficies que intersectan
intersected_surfaces = []

for s in surfaces:
    try:
        # Intenta obtener el punto o curva de intersección
        intersection = s.Intersect(line)
        # Si no es None ni está vacía, hay intersección
        if intersection and len(intersection) > 0:
            intersected_surfaces.append(s)
    except:
        # Si ocurre algún error, simplemente pasa
        pass

OUT = intersected_surfaces
# ----------------------------------------
ordena_surfaces_de_acuerdo_a_la = Python(IN[0]=obtiene_surfaces_que_se, IN[1]=firstItem)  # "Ordena surfaces de acuerdo a la cercanía a in punto IN[0] = Surfaces IN[1] = Point"; CPython3
# ---------- ordena_surfaces_de_acuerdo_a_la.python (23 lines) ----------
import clr
clr.AddReference('ProtoGeometry')
from Autodesk.DesignScript.Geometry import *

# Entradas
surfaces = IN[0]
reference_point = IN[1]

# Calcular el punto más cercano de cada superficie al punto de referencia
def min_distance(surface, point):
    # Obtener varios puntos de la superficie para aproximar
    uvs = [(0,0), (0,1), (1,0), (1,1), (0.5,0.5), (0.5,0), (0,0.5), (1,0.5), (0.5,1)]
    pts = [surface.PointAtParameter(u,v) for (u,v) in uvs]
    dists = [pt.DistanceTo(point) for pt in pts]
    return min(dists)

# Ordenar superficies por distancia mínima
ordered_surfaces = sorted(
    surfaces, 
    key=lambda surf: min_distance(surf, reference_point)
)

OUT = ordered_surfaces
# ----------------------------------------
identity_4 = Object.Identity(object=ordena_surfaces_de_acuerdo_a_la)
count = List.Count(list=ordena_surfaces_de_acuerdo_a_la)
code_block_2 = CodeBlock(n=count) { 0..n-1..1; }
code_block_3 = CodeBlock { 2; }
mod = code_block_2 % code_block_3
code_block_4 = CodeBlock { 0; }
eq = mod == code_block_4
filterByBoolMask = List.FilterByBoolMask(list=identity_4, mask=eq)
identity_5 = Object.Identity(object=filterByBoolMask.in)
ZAxis = Vector.ZAxis()
code_block_5 = CodeBlock { 0.5; }
normalAtParameter = Surface.NormalAtParameter(surface=caras_de_las_vigas_del_pórtico, u=code_block_5, v=code_block_5)
dot = Vector.Dot(vector=ZAxis, vec=normalAtParameter)
code_block_6 = CodeBlock { 1; -1; }
eq_2 = dot == code_block_6.out0
eq_3 = dot == code_block_6.out1
or_ = eq_2 || eq_3
filterByBoolMask_2 = List.FilterByBoolMask(list=caras_de_las_vigas_del_pórtico, mask=or_)
identity_6 = Object.Identity(object=filterByBoolMask_2.in)
byOriginNormal = Plane.ByOriginNormal()
distanceTo = Geometry.DistanceTo(geometry=identity_6, other=byOriginNormal)
uniqueItems_2 = List.UniqueItems(list=distanceTo)
maximumItem = List.MaximumItem(list=uniqueItems_2)
identity_7 = Object.Identity(object=distanceTo)
eq_4 = maximumItem == identity_7
filterByBoolMask_3 = List.FilterByBoolMask(list=identity_6, mask=eq_4)
identity_8 = Object.Identity(object=filterByBoolMask_3.in)
code_block_7 = CodeBlock { 0.5; }
getIsoline = Surface.GetIsoline(surface=identity_8, parameter=code_block_7)
firstItem_3 = List.FirstItem(list=getIsoline)
vector_By_Line_2 = Custom[Vector_By_Line](Linea=firstItem_3)
getLocationActual = Custom[GetLocationActual](Elemento=Viga)  # Crea una linea en el eje centroidal de Vigas o Columnas
vector_By_Line_3 = Custom[Vector_By_Line](Linea=getLocationActual.Location_Vigas)
angleWithVector = Vector.AngleWithVector(vector=vector_By_Line_2, otherVector=vector_By_Line_3)
code_block_8 = CodeBlock(a=angleWithVector) { a==0||a==180; }
getIsoline_2 = Surface.GetIsoline(surface=identity_8, isoDirection=code_block_7)
flatten_2 = List.Flatten(list=getIsoline_2)
if_ = RefactoredIf(test=code_block_8, true=getIsoline, false=flatten_2)
flatten_3 = List.Flatten(list=if_)
firstItem_4 = List.FirstItem(list=startPoint)
python_script = Python(IN[0]=flatten_3, IN[1]=firstItem_4)  # CPython3
# ---------- python_script.python (18 lines) ----------
import clr

# Importar Dynamo Geometry
clr.AddReference('ProtoGeometry')
from Autodesk.DesignScript.Geometry import Line, Point

# Entradas
lineas = IN[0]  # Lista de líneas únicas
punto_ref = IN[1]  # Punto de referencia (Point)

def min_distancia(linea, punto):
    # Calcula la menor distancia entre el punto y los extremos de la línea
    return min(linea.StartPoint.DistanceTo(punto), linea.EndPoint.DistanceTo(punto))

# Ordenar las líneas según la distancia mínima de sus extremos al punto de referencia
lineas_ordenadas = sorted(lineas, key=lambda l: min_distancia(l, punto_ref))

OUT = lineas_ordenadas
# ----------------------------------------
reorienta_una_lista_de_líneas = Python(IN[0]=python_script, IN[1]=firstItem_4)  # "Reorienta una lista de líneas (Line), haciendo que el punto inicial de cada línea sea el más cercano a un punto de referencia dado"; CPython3
# ---------- reorienta_una_lista_de_líneas.python (26 lines) ----------
import clr
clr.AddReference('RevitServices')
from RevitServices.Persistence import DocumentManager
doc = DocumentManager.Instance.CurrentDBDocument

# Entradas
lineas = IN[0]        # Lista de líneas
punto_ref = IN[1]     # Punto de referencia

def dist(p1, p2):
    return (p1.X - p2.X)**2 + (p1.Y - p2.Y)**2 + (p1.Z - p2.Z)**2

reoriented = []
for l in lineas:
    start = l.StartPoint
    end = l.EndPoint
    # Compara distancias al punto de referencia
    if dist(start, punto_ref) <= dist(end, punto_ref):
        # El punto inicial ya es el más cercano, no se cambia
        reoriented.append(l)
    else:
        # El punto final es el más cercano, invierte la dirección
        new_line = l.Reverse()
        reoriented.append(new_line)

OUT = reoriented
# ----------------------------------------
firstItem_5 = List.FirstItem(list=reorienta_una_lista_de_líneas)
startPoint_2 = Curve.StartPoint(curve=firstItem_5)
endPoint_2 = Curve.EndPoint(curve=firstItem_5)
byTwoPoints = Vector.ByTwoPoints(start=startPoint_2, end=endPoint_2)
code_block_9 = CodeBlock { 0.05; }
translate = Geometry.Translate(geometry=identity_5, direction=byTwoPoints, distance=code_block_9)
perimeterCurves = Surface.PerimeterCurves(surface=translate)
byJoinedCurves = PolyCurve.ByJoinedCurves(curves=perimeterCurves)
code_block_10 = CodeBlock { "Recubrimiento de armadura - Cara inferior"; }
getParameterValueByName = Element.GetParameterValueByName(element=Viga, parameterName=code_block_10)
code_block_11 = CodeBlock { "Longitud"; }
getParameterValueByName_2 = Element.GetParameterValueByName(element=getParameterValueByName, parameterName=code_block_11)
recubrimiento_en_metros = CodeBlock(Recub=getParameterValueByName_2) { Recub/1000; }
identity_9 = Object.Identity(object=recubrimiento_en_metros)
identity_10 = Object.Identity(object=identity_9)
code_block_12 = CodeBlock(Recub=identity_10) { -Recub; }
offsetMany = Curve.OffsetMany(curve=byJoinedCurves, signedDistance=code_block_12)
curves = PolyCurve.Curves(polyCurve=offsetMany)
n01_Curvas = Output(curves)  # "01_Curvas"
identity_11 = Object.Identity(object=firstItem_2)
vector_By_Line_4 = Custom[Vector_By_Line](Linea=identity_11)
firstItem_6 = List.FirstItem(list=vector_By_Line_4)
n02_Vector_Propagación = Output(firstItem_6)  # "02_Vector_Propagación"
n03_Lineas_Tramos_Vigas = Output(reorienta_una_lista_de_líneas)  # "03_Lineas_Tramos_Vigas"
watch = Watch(if_)
python_script_2 = Python()  # CPython3; unwired: IN[0]; starter script, not edited (OUT = 0)
