# Dynamo custom node Datos_Entrada_Barra_Longitudinal.dyf (Dynamo 3.6.0.9395)
# category: Revit
# Datos de entrada para Standard, Standard - 90 deg., Left, Right

code_block = CodeBlock { "Standard"; "Standard - 90 deg."; "Left"; "Right"; "Ninguno"; }
Rebar_Style = Output(code_block.out0)  # "Rebar Style: Standard"
Rebar_Hook_Horientation = Output(code_block.out2)  # "Rebar Hook Horientation: Left"
Rebar_Hook_Horientation_2 = Output(code_block.out3)  # "Rebar Hook Horientation: Right"
rebar_Hook_Type = Custom[Rebar_Hook_Type]()  # Obtiene las formas de gancho de armaduras
Rebar_Hook_Type = Output(rebar_Hook_Type.Standard_90_deg)  # "Rebar Hook Type: Standard - 90 deg."
null = Python()  # CPython3
# ---------- null.python (1 lines) ----------
OUT = None
# ----------------------------------------
Rebar_Hook_Type_2 = Output(null)  # "Rebar Hook Type: Ninguno"
Rebar_Hook_Type_3 = Output(rebar_Hook_Type.Standard_180_deg)  # "Rebar Hook Type: Standard - 180 deg."
Rebar_Hook_Type_4 = Output(rebar_Hook_Type.Stirrup_Tie_Seismic_135_deg)  # "Rebar Hook Type: Stirrup/Tie  - 135 deg."
