# Dynamo custom node Datos_Entrada_Estribos_RebarByCurves.dyf (Dynamo 3.5.2.8914)
# category: 01_Nodos_CQING
# Da los parametros para poder crear estribos

rebar_Hook_Type = Custom[Rebar_Hook_Type]()  # Obtiene las formas de gancho de armaduras
n02_RebarHookType_Stirrup_Tie_135_deg = Output(rebar_Hook_Type.Stirrup_Tie_Seismic_135_deg)  # "02_RebarHookType_Stirrup/Tie_135_deg."
string = StringInput("StirrupTie")
n01_Rebar_Style_STirrupTie = Output(string)  # "01_Rebar_Style_STirrupTie"
string_2 = StringInput("Right")
n03_Rebar_Hooke_Orientation_Right = Output(string_2)  # "03_Rebar_Hooke_Orientation_Right"
string_3 = StringInput("Left")
n04_Rebar_Hooke_Orientation_Left = Output(string_3)  # "04_Rebar_Hooke_Orientation_Left"
