# Dynamo custom node Detalle_De_Plegado_IndependentTag.dyf (Dynamo 3.6.0.9395)
# category: 01_Nodos_CQING
# Crea detalles de plegado alineado a la barra.

Rebar = Input(Rebar: var[]..[])  # Rebar
Offset_x = Input(Offset_x: var[]..[])  # double
Offset_y = Input(Offset_y: var[]..[])  # double
Offset_z = Input(Offset_z: var[]..[])  # double
Vistas = Input(Vistas: var[]..[])  # view
Tipo_detalle = Input(Tipo_detalle: var[]..[])  # string
xyz_vista_seleccionada_multiples = Python(IN[0]=Rebar, IN[1]=Offset_x, IN[2]=Offset_y, IN[3]=Offset_z, IN[4]=Vistas, IN[5]=Tipo_detalle)  # "XYZ - Vista Seleccionada - Multiples vistas, rebar y offset - Tipo de detalle"; CPython3
# ---------- xyz_vista_seleccionada_multiples.python (119 lines) ----------
# 1. IMPORTAR LIBRERÍAS
import clr
clr.AddReference('RevitAPI')
from Autodesk.Revit.DB import *
from Autodesk.Revit.DB.Structure import RebarBendingDetail, RebarBendingDetailType

clr.AddReference('RevitServices')
from RevitServices.Persistence import DocumentManager
from RevitServices.Transactions import TransactionManager

# 2. CONFIGURACIÓN INICIAL
doc = DocumentManager.Instance.CurrentDBDocument

# --- FUNCIONES DE AYUDA (NORMALIZAR ENTRADAS) ---
def asegurar_lista(entrada, cantidad_objetivo):
    """
    Si la entrada es un solo valor, lo repite 'n' veces.
    Si es una lista, la devuelve tal cual.
    """
    if isinstance(entrada, list):
        return entrada
    else:
        # Si es un solo valor (ej: un número), creamos una lista repitiéndolo
        return [entrada] * cantidad_objetivo

# --- 3. PROCESAMIENTO DE ENTRADAS (INPUTS) ---

# IN[0] -> LISTA MAESTRA DE BARRAS
entrada_barras = IN[0]
if not isinstance(entrada_barras, list):
    entrada_barras = [entrada_barras]
lista_barras = UnwrapElement(entrada_barras)

# Cantidad de elementos a crear (dictada por las barras)
cantidad = len(lista_barras)

# IN[4] -> LISTA MAESTRA DE VISTAS (Debe coincidir con las barras)
entrada_vistas = IN[4]
if not isinstance(entrada_vistas, list):
    entrada_vistas = [entrada_vistas]
lista_vistas = UnwrapElement(entrada_vistas)

# IN[1], IN[2], IN[3] -> OFFSETS (Números o Listas)
# Usamos la función asegurar_lista para normalizar todo al tamaño 'cantidad'
lista_x = asegurar_lista(IN[1], cantidad)
lista_y = asegurar_lista(IN[2], cantidad)
lista_z = asegurar_lista(IN[3], cantidad)

# Factor de conversión (Metros -> Pies)
factor = 3.28084

# -----------------------------------------------

# 4. BUSCAR TIPO DE DETALLE (RebarBendingDetailType)
todos_los_tipos = FilteredElementCollector(doc).OfClass(RebarBendingDetailType).ToElements()
tipo_final = None

# Prioridad: Buscar "esquemático"
for tipo in todos_los_tipos:
    try:
        if "esquemático" in tipo.Name.lower() or "schematic" in tipo.Name.lower():
            tipo_final = tipo
            break
    except: continue

if not tipo_final and todos_los_tipos:
    tipo_final = todos_los_tipos[-1]

# 5. CREACIÓN MASIVA
resultados = []

TransactionManager.Instance.EnsureInTransaction(doc)

if not tipo_final:
    resultados.append("ERROR GLOBAL: No hay familias de detalle cargadas.")
elif len(lista_vistas) != cantidad:
    resultados.append("ERROR: La lista de Vistas (IN[4]) debe tener el mismo tamaño que la lista de Barras (IN[0]).")
else:
    # Bucle usando 'zip' para recorrer las 5 listas SIMULTÁNEAMENTE
    # Si alguna lista de offsets es más corta, zip se detendrá ahí (pero ya las normalizamos arriba)
    for barra, vista, off_x, off_y, off_z in zip(lista_barras, lista_vistas, lista_x, lista_y, lista_z):
        try:
            # 1. Convertir offsets actuales a pies
            # Si off_x es None, usar 0.0
            dx = (off_x if off_x else 0.0) * factor
            dy = (off_y if off_y else 0.0) * factor
            dz = (off_z if off_z else 0.0) * factor

            # 2. Calcular BoundingBox (depende de la vista específica)
            bbox = barra.get_BoundingBox(vista)

            if bbox:
                centro_x = (bbox.Min.X + bbox.Max.X) / 2.0
                centro_y = (bbox.Min.Y + bbox.Max.Y) / 2.0
                centro_z = (bbox.Min.Z + bbox.Max.Z) / 2.0
                
                # 3. Punto final personalizado para ESTA barra específica
                punto_final = XYZ(centro_x + dx, centro_y + dy, centro_z + dz)
                
                # 4. Crear Detalle
                nuevo = RebarBendingDetail.Create(
                    doc, 
                    vista.Id, 
                    barra.Id, 
                    0, 
                    tipo_final, 
                    punto_final, 
                    0.0
                )
                resultados.append(nuevo)
            else:
                resultados.append(None) # La barra no es visible en esa vista
                
        except Exception as e:
            resultados.append("Error: " + str(e))

TransactionManager.Instance.TransactionTaskDone()

OUT = resultados
# ----------------------------------------
Tag = Output(xyz_vista_seleccionada_multiples)
