# Dynamo custom node ElementCurveReference_ByCurve_Sin_Advertencia.dyf (Dynamo 3.6.0.9395)
# category: 01_Nodos_CQING

curve = Input(curve: Autodesk.DesignScript.Geometry.Curve)
byCurve = Revit.GeometryReferences.ElementCurveReference.ByCurve(curve=curve)
ElementCurveReference = Output(byCurve)
