# Dynamo custom node Empalme_una_barra.dyf (Dynamo 3.6.0.9395)
# category: 01_Nodos_CQING
# Realiza empalmes centrados en una sola barra o un solo conjunto de barras.

Rebar = Input(Rebar: var[]..[])
code_block = CodeBlock(Rebar=Rebar) { Rebar; }
Tipo_Empalme = Input(Tipo_Empalme: var[]..[])
code_block_2 = CodeBlock(Tipo_Empalme=Tipo_Empalme) { Tipo_Empalme; }
script_2 = Python(IN[0]=code_block_2)  # CPython3
# ---------- script_2.python (34 lines) ----------
# SCRIPT 2: CONFIGURADOR DE OPCIONES (MÚLTIPLE)
import clr
from System.Collections.Generic import List
clr.AddReference('RevitAPI')
from Autodesk.Revit.DB.Structure import RebarSpliceOptions, RebarSplicePosition

clr.AddReference('RevitServices')
from RevitServices.Persistence import DocumentManager
doc = DocumentManager.Instance.CurrentDBDocument

# Función ayuda para listas
def to_list(obj):
    if hasattr(obj, '__iter__') and not isinstance(obj, str):
        return obj
    else:
        return [obj]

# ENTRADAS
input_tipos = IN[0] # Puede ser uno o varios tipos

if not input_tipos:
    OUT = []
else:
    tipos = to_list(input_tipos)
    lista_opciones = []
    
    for tipo in tipos:
        # Extraemos ID
        t_id = UnwrapElement(tipo).Id
        # Creamos la opción
        opt = RebarSpliceOptions(doc, t_id, RebarSplicePosition.Middle)
        lista_opciones.append(opt)

    OUT = lista_opciones
# ----------------------------------------
Puntos = Input(Puntos: var[]..[])
code_block_3 = CodeBlock(Puntos=Puntos) { Puntos; }
Vector_Rebar = Input(Vector_Rebar: var[]..[])
code_block_4 = CodeBlock(Vector_Rebar=Vector_Rebar) { Vector_Rebar; }
count = List.Count(list=code_block_3)
ofRepeatedItem = List.OfRepeatedItem(item=code_block_4, amount=count)
script_1 = Python(IN[0]=code_block_3, IN[1]=ofRepeatedItem)  # CPython3
# ---------- script_1.python (55 lines) ----------
# SCRIPT 1: FABRICANTE DE GEOMETRÍA (CORREGIDO)
import clr
from System.Collections.Generic import List

clr.AddReference('RevitAPI')
from Autodesk.Revit.DB.Structure import RebarSpliceGeometry

clr.AddReference("RevitNodes")
import Revit
clr.ImportExtensions(Revit.GeometryConversion) 

# ENTRADAS
input_puntos = IN[0]
input_vectores = IN[1]

# --- GUARDIA: Si falta algo, devuelve lista vacía ---
if input_puntos is None or input_vectores is None:
    OUT = []

else:
    # --- LA CORRECCIÓN: FUERZA BRUTA ---
    # Preguntamos directamente: ¿Eres una lista de Python?
    # Si SI: Te usamos tal cual.
    # Si NO: Te metemos dentro de corchetes [] para convertirte en lista de 1 elemento.
    
    if isinstance(input_puntos, list):
        puntos = input_puntos
    else:
        puntos = [input_puntos]
        
    if isinstance(input_vectores, list):
        vectores = input_vectores
    else:
        vectores = [input_vectores]

    # Preparamos la lista contenedora de Revit
    lista_geometrias = List[RebarSpliceGeometry]()

    # --- BUCLE ---
    # Ahora es seguro usar 'zip' porque GARANTIZAMOS que ambos son listas
    for p, v in zip(puntos, vectores):
        try:
            # 1. Traducir a Revit (XYZ)
            p_xyz = p.ToXyz()
            v_xyz = v.ToXyz()
            
            # 2. Crear objeto
            geom = RebarSpliceGeometry(p_xyz, v_xyz)
            
            # 3. Añadir a la lista final
            lista_geometrias.Add(geom)
        except:
            pass

    OUT = lista_geometrias
# ----------------------------------------
script_3 = Python(IN[0]=code_block, IN[1]=script_2, IN[2]=script_1)  # CPython3
# ---------- script_3.python (108 lines) ----------
# SCRIPT 3: EJECUTOR FINAL (HÍBRIDO Y ROBUSTO)
import clr
from System.Collections.Generic import List

clr.AddReference('RevitAPI')
from Autodesk.Revit.DB import ElementId, XYZ
from Autodesk.Revit.DB.Structure import RebarSpliceUtils, RebarSpliceGeometry, MultiplanarOption

clr.AddReference('RevitServices')
from RevitServices.Persistence import DocumentManager
from RevitServices.Transactions import TransactionManager

doc = DocumentManager.Instance.CurrentDBDocument

# ENTRADAS
barra_input = IN[0]
opciones_in = IN[1]  
entrada_mixta = IN[2] # Puede ser Puntos o Geometría

def to_list(obj):
    if isinstance(obj, list): return obj
    else: return [obj]

# --- GUARDIA ---
if not barra_input or not opciones_in or not entrada_mixta:
    OUT = ["Faltan datos de entrada"]

else:
    # 1. Manejo seguro de la barra
    raw_barra = UnwrapElement(barra_input)
    if isinstance(raw_barra, list):
        barra = raw_barra[0]
    else:
        barra = raw_barra

    opts_py = to_list(opciones_in)
    lista_entrada = to_list(entrada_mixta) 

    TransactionManager.Instance.EnsureInTransaction(doc)
    doc.Regenerate()
    resultado = []
    
    try:
        # Preparar datos para la curva guía (solo si necesitamos proyectar puntos)
        curvas_barra = barra.GetCenterlineCurves(False, False, False, MultiplanarOption.IncludeAllMultiplanarCurves, 0)
        curva_guia = curvas_barra[0] 

        # --- PREPARAR GEOMETRÍA ---
        lista_geoms_cs = List[RebarSpliceGeometry]()
        
        conteo_puntos = 0
        conteo_geoms = 0

        for item in lista_entrada:
            if not item: continue
            obj = UnwrapElement(item)
            
            # --- CASO A: VIENE DEL SCRIPT 1 COMO GEOMETRÍA YA HECHA ---
            # Si ya es un RebarSpliceGeometry, lo usamos directo y confiamos en él.
            if isinstance(obj, RebarSpliceGeometry):
                lista_geoms_cs.Add(obj)
                conteo_geoms += 1
                
            # --- CASO B: VIENE COMO PUNTO (XYZ) ---
            # Si es un punto, aplicamos la corrección de precisión (Imantado)
            elif isinstance(obj, XYZ): # O tiene coordenadas
                proyeccion = curva_guia.Project(obj)
                if proyeccion:
                    pt_perfecto = proyeccion.XYZPoint
                    geom_splice = RebarSpliceGeometry(barra.Id, pt_perfecto)
                    lista_geoms_cs.Add(geom_splice)
                    conteo_puntos += 1
                else:
                    resultado.append("Aviso: Un punto estaba demasiado lejos.")
            
            else:
                 # Intento final por si es un punto de Dynamo envuelto
                 try:
                    pt_xyz = obj.ToXyz() # Método común en Dynamo
                    proyeccion = curva_guia.Project(pt_xyz)
                    if proyeccion:
                        geom_splice = RebarSpliceGeometry(barra.Id, proyeccion.XYZPoint)
                        lista_geoms_cs.Add(geom_splice)
                 except:
                    pass

        # --- EJECUCIÓN ---
        opcion_a_usar = opts_py[0]
        
        if lista_geoms_cs.Count > 0:
            ids_creados = RebarSpliceUtils.SpliceRebar(doc, barra.Id, opcion_a_usar, lista_geoms_cs)
            
            if ids_creados and ids_creados.Count > 0:
                resultado.append(f"ÉXITO: Se crearon {ids_creados.Count} empalmes.")
                resultado.append(f"Info: Se usaron {conteo_geoms} geometrías directas y {conteo_puntos} puntos corregidos.")
            else:
                resultado.append("FALLO GEOMÉTRICO: Revit aceptó los datos pero no cortó.")
                resultado.append("Consejo: Si estás usando geometrías directas (Script 1), asegúrate de que sus puntos toquen PERFECTAMENTE la barra.")
        else:
            resultado.append("Error: No hay geometrías válidas para procesar.")

    except Exception as e:
        import traceback
        resultado.append("Error de API: " + str(e))
    
    TransactionManager.Instance.TransactionTaskDone()
    
    OUT = resultado
# ----------------------------------------
OUT = Output(script_3)
watch = Watch(script_1)
watch_2 = Watch(script_2)
watch_3 = Watch(script_3)
