# Dynamo custom node Empalmes_Vigas.dyf "Empalmes_Columnas" (Dynamo 3.6.0.9395)
# category: 01_Nodos_CQING
# Crea empalmes en barras verticales. Rebar, Número de empalmes, Planos de empalmes, Longitudes de empalmes, Tipo de barra.

categories = Categories("OST_Rebar")
all_elements_of_category = ElementsOfCategory(Category=categories)
boolean = BoolSelector(true)
Rebar = Input(Rebar: var[]..[])
Número_de_Empalmes = Input(Número_de_Empalmes: var[]..[])
Longitudes_de_Empalmes = Input(Longitudes_de_Empalmes: var[]..[])
Tipo_de_barra = Input(Tipo_de_barra: var[]..[])
tipos_de_empalmes = Python()  # CPython3
# ---------- tipos_de_empalmes.python (66 lines) ----------
import clr
clr.AddReference("RevitAPI")
clr.AddReference("RevitServices")
clr.AddReference("RevitNodes")
import Revit
clr.ImportExtensions(Revit.Elements)

from Autodesk.Revit.DB import FilteredElementCollector, BuiltInCategory, BuiltInParameter
from RevitServices.Persistence import DocumentManager

doc = DocumentManager.Instance.CurrentDBDocument

def safe_name(e):
    for getter in (
        lambda: e.Name,
        lambda: e.get_Parameter(BuiltInParameter.ALL_MODEL_TYPE_NAME).AsString(),
        lambda: e.get_Parameter(BuiltInParameter.SYMBOL_NAME_PARAM).AsString()
    ):
        try:
            v = getter()
            if v:
                return v
        except:
            pass
    return "<sin nombre>"

def safe_id(eid):
    # Maneja distintos bindings de ElementId
    for attr in ("IntegerValue", "Value"):
        try:
            v = getattr(eid, attr)
            v = v() if callable(v) else v
            return int(v)
        except:
            pass
    try:
        return int(str(eid))
    except:
        return None

if doc is None:
    OUT = "No hay documento Revit."
elif not hasattr(BuiltInCategory, "OST_RebarSpliceType"):
    OUT = "Tu Revit no expone la categoría RebarSpliceType (requiere 2025+)."
else:
    types = list(
        FilteredElementCollector(doc)
        .OfCategory(BuiltInCategory.OST_RebarSpliceType)
        .WhereElementIsElementType()
    )
    if not types:
        OUT = "No hay tipos de empalme en el modelo."
    else:
        sorted_types = sorted(types, key=lambda t: safe_name(t))
        names = [safe_name(t) for t in sorted_types]
        ids = [safe_id(t.Id) for t in sorted_types]
        elements_ds = [t.ToDSType(True) for t in sorted_types]

        items = [{"name": n, "id": i, "element": e} for n, i, e in zip(names, ids, elements_ds)]

        OUT = {
            "names": names,
            "ids": ids,
            "elements": elements_ds,  # úsalo directo en GetParameterByName
            "items": items
        }
# ----------------------------------------
code_block = CodeBlock(A=tipos_de_empalmes) { A["elements"]; }
code_block_2 = CodeBlock { "Nombre de tipo"; }
getParameterValueByName = Element.GetParameterValueByName(element=code_block, parameterName=code_block_2)
code_block_3 = CodeBlock { "Empalme solapado 60D"; }
code_block_4 = CodeBlock(A=getParameterValueByName, B=code_block_3) { A==B; }
filterByBoolMask = List.FilterByBoolMask(list=code_block, mask=code_block_4)
firstItem = List.FirstItem(list=filterByBoolMask.in)
element_type_de_empalmes = Python(IN[0]=Número_de_Empalmes, IN[1]=Longitudes_de_Empalmes, IN[2]=Tipo_de_barra, IN[3]=firstItem)  # "Element type de empalmes Copiados"; CPython3
# ---------- element_type_de_empalmes.python (144 lines) ----------
import clr
clr.AddReference("RevitAPI")
clr.AddReference("RevitServices")
clr.AddReference("RevitNodes")
import Revit
clr.ImportExtensions(Revit.Elements)

from Autodesk.Revit.DB import BuiltInParameter, ElementType, FilteredElementCollector
from RevitServices.Persistence import DocumentManager
from RevitServices.Transactions import TransactionManager

doc = DocumentManager.Instance.CurrentDBDocument

# Entradas
count_in = IN[0]
values_in = IN[1]
prefix = IN[2] if IN[2] is not None else ""
base_type = UnwrapElement(IN[3])

def divisor_from_prefix(txt):
    t = (txt or "").lower()
    if "#10" in t: return 1.9348
    if "#9"  in t: return 1.7205
    if "#8"  in t: return 1.524
    if "#7"  in t: return 1.3335
    if "#6"  in t: return 1.143
    if "#5"  in t: return 0.9525
    if "#4"  in t: return 0.762
    if "#3"  in t: return 0.5715
    return 0.762  # fallback

divisor = divisor_from_prefix(prefix)

def safe_name(e):
    for getter in (
        lambda: e.Name,
        lambda: e.get_Parameter(BuiltInParameter.ALL_MODEL_TYPE_NAME).AsString(),
        lambda: e.get_Parameter(BuiltInParameter.SYMBOL_NAME_PARAM).AsString()
    ):
        try:
            v = getter()
            if v:
                return v
        except:
            pass
    return None

def get_lap_param(t):
    for bip in (BuiltInParameter.REBAR_SPLICE_LAP_LENGTH_MULTIPLIER,):
        try:
            p = t.get_Parameter(bip)
            if p: return p
        except: pass
    return t.LookupParameter("Multiplicador de longitudes de solape")

def find_existing(name, category_id):
    try:
        for et in FilteredElementCollector(doc).WhereElementIsElementType():
            try:
                if et.Category and et.Category.Id == category_id:
                    if safe_name(et) == name:
                        return et
            except:
                continue
    except:
        pass
    return None

# Validaciones
errors = []
try:
    count = int(count_in)
except:
    count = 0
    errors.append("IN[0] debe ser entero > 0")

vals = values_in if isinstance(values_in, list) else ([values_in] if values_in is not None else [])
if count <= 0:
    errors.append("IN[0] debe ser entero > 0")
if len(vals) != count:
    errors.append("IN[1] debe tener exactamente {} valores".format(count))
if base_type is None or not isinstance(base_type, ElementType):
    errors.append("IN[3] debe ser un ElementType de empalme")

if errors:
    OUT = {"created": [], "names": [], "multipliers": [], "errors": errors}
else:
    created, names, multipliers, errs = [], [], [], []

    TransactionManager.Instance.EnsureInTransaction(doc)

    cat_id = base_type.Category.Id if base_type.Category else None

    for v in vals:
        try:
            v_num = float(v)
        except:
            errs.append("Valor no numérico: {}".format(v))
            continue

        new_name = "{} - {}".format(prefix, v_num)
        target_val = (60.0 * v_num) / divisor

        existing = find_existing(new_name, cat_id) if cat_id else None
        if existing:
            new_type = existing
            param = get_lap_param(new_type)
            val = None
            try:
                if param: val = param.AsDouble()
            except:
                pass
            multipliers.append(val)
            errs.append("Reusado '{}' (ya existía, no se modificó)".format(new_name))
        else:
            try:
                new_type = base_type.Duplicate(new_name)
            except Exception as e:
                errs.append("No se pudo duplicar '{}': {}".format(new_name, e))
                continue

            param = get_lap_param(new_type)
            if param and not param.IsReadOnly:
                try:
                    param.Set(target_val)
                    multipliers.append(target_val)
                except Exception as e:
                    errs.append("No se pudo asignar valor en '{}': {}".format(new_name, e))
                    multipliers.append(None)
            else:
                errs.append("Parámetro no encontrado o de solo lectura en '{}'".format(new_name))
                multipliers.append(None)

        created.append(new_type.ToDSType(True))
        names.append(new_name)

    TransactionManager.Instance.TransactionTaskDone()

    OUT = {
        "created": created,
        "names": names,
        "multipliers": multipliers,
        "errors": errs
    }
# ----------------------------------------
code_block_5 = CodeBlock(A=element_type_de_empalmes) { A["created"]; }
Planos = Input(Planos: var[]..[])
empalmes = Python(IN[0]=boolean, IN[1]=Rebar, IN[2]=code_block_5, IN[3]=Planos)  # CPython3
# ---------- empalmes.python (270 lines) ----------
import clr
import sys
from System import Enum
import math

# --- IMPORTACIONES ---
clr.AddReference("RevitAPI")
clr.AddReference("RevitServices")
clr.AddReference("RevitNodes")

from Autodesk.Revit.DB import XYZ, Element, BuiltInParameter, Line
from Autodesk.Revit.DB.Structure import (
    Rebar,
    RebarSpliceOptions,
    RebarSpliceUtils,
    RebarSplicePosition,
    RebarSpliceError,
    RebarSpliceGeometry
)

from RevitServices.Persistence import DocumentManager
from RevitServices.Transactions import TransactionManager
import Revit
clr.ImportExtensions(Revit.Elements)
from System.Collections.Generic import List

doc = DocumentManager.Instance.CurrentDBDocument

# --- INPUTS ---
run_script = IN[0]
rebars_in  = IN[1]
types_in   = IN[2]
planes_in  = IN[3]

# --- CONFIGURACIÓN ---
MAX_RETRIES = 10 
METROS_A_PIES = 3.280839895
PIES_A_METROS = 0.3048

# --- HELPERS ---
def flatten_inputs(input_obj):
    flat = []
    if isinstance(input_obj, list):
        for i in input_obj: flat.extend(flatten_inputs(i))
    else: flat.append(input_obj)
    return flat

def to_list(obj):
    if isinstance(obj, list): return obj
    return [obj]

def to_api_units(v): return v * METROS_A_PIES

def get_id_str(element_id):
    try: return str(element_id.Value)
    except:
        try: return str(element_id.IntegerValue)
        except: return str(element_id)

def get_geometry_args(dynamo_plane):
    origin, normal = None, None
    if hasattr(dynamo_plane, "Origin") and hasattr(dynamo_plane, "Normal"):
        o, n = dynamo_plane.Origin, dynamo_plane.Normal
        origin = XYZ(to_api_units(o.X), to_api_units(o.Y), to_api_units(o.Z))
        normal = XYZ(n.X, n.Y, n.Z).Normalize()
    elif hasattr(dynamo_plane, "PointAtParameter") and hasattr(dynamo_plane, "NormalAtParameter"):
        pt, nv = dynamo_plane.PointAtParameter(0.5, 0.5), dynamo_plane.NormalAtParameter(0.5, 0.5)
        origin = XYZ(to_api_units(pt.X), to_api_units(pt.Y), to_api_units(pt.Z))
        normal = XYZ(nv.X, nv.Y, nv.Z).Normalize()
    return origin, normal

def get_intersection_point_on_bar(rebar, plane_z):
    try:
        curves = rebar.GetShapeDrivenAccessor().ComputeDrivingCurves()
        for c in curves:
            if isinstance(c, Line):
                p0 = c.GetEndPoint(0)
                p1 = c.GetEndPoint(1)
                z_min, z_max = min(p0.Z, p1.Z), max(p0.Z, p1.Z)
                if z_min - 0.01 <= plane_z <= z_max + 0.01:
                    if abs(p1.Z - p0.Z) < 1e-9: return (p0 + p1) / 2.0
                    t = (plane_z - p0.Z) / (p1.Z - p0.Z)
                    return XYZ(p0.X + t * (p1.X - p0.X), p0.Y + t * (p1.Y - p0.Y), plane_z)
        return None
    except: return None

def try_splice_low_level(doc, rebar_id, type_id, geom, opts):
    try:
        rebar = doc.GetElement(rebar_id)
        if not rebar or not rebar.IsValidObject: return False, [], "Barra Inválida"
        
        check = RebarSpliceUtils.CanRebarBeSpliced(rebar, opts, geom)
        if check == RebarSpliceError.Success:
            g_list = List[RebarSpliceGeometry]()
            g_list.Add(geom)
            res_ids = RebarSpliceUtils.SpliceRebar(doc, rebar_id, opts, g_list)
            return True, list(res_ids), "OK"
        
        err_str = str(check)
        if str(check) == "7" or "DoesNotIntersect" in str(check): err_str = "Err7(No Intersecta)"
        elif "TooShort" in str(check): err_str = "Muy Corto"
        return False, [], err_str
    except Exception as e:
        return False, [], str(e)

def process_single_bar_v38(bar_data, planes, splice_types):
    root_rebar = bar_data['element']
    if not root_rebar.IsValidObject: return False, [], ["ID Eliminado"]

    active_pool = [root_rebar.Id]
    any_modification = False
    error_log = []
    
    total_planes = len(planes)
    num_types = len(splice_types)
    
    # CORRECCIÓN V38: Iteramos por índice para asegurar que se procesen TODOS los planos
    for i in range(total_planes):
        plane = planes[i]
        
        # Reciclamos el tipo de empalme si hay menos tipos que planos
        s_type = splice_types[i % num_types]
        
        raw_origin, normal = get_geometry_args(plane)
        if not raw_origin: 
            error_log.append(f"Corte {i+1}: Geom Nula")
            continue
            
        # --- LÓGICA DE POSICIÓN ---
        target = "Middle"
        if i == total_planes - 1: # Último plano
            target = "Bottom"
        else: # Planos anteriores
            target = "Middle"

        # ESTRATEGIAS
        strategies = []
        if target == "Bottom":
            strategies.append({'n': normal, 'p': RebarSplicePosition.End2, 'tag': 'End2(Std)'})
            strategies.append({'n': normal.Negate(), 'p': RebarSplicePosition.End1, 'tag': 'End1(Inv)'})
            strategies.append({'n': normal, 'p': RebarSplicePosition.End1, 'tag': 'End1(Fallback)'})
        else:
            strategies.append({'n': normal, 'p': RebarSplicePosition.Middle, 'tag': 'Mid'})
            strategies.append({'n': normal.Negate(), 'p': RebarSplicePosition.Middle, 'tag': 'Mid(Inv)'})

        cut_success = False
        candidates = list(active_pool)
        
        for cand_id in candidates:
            try: 
                current_rebar = doc.GetElement(cand_id)
                if not current_rebar: continue
                snapped_origin = get_intersection_point_on_bar(current_rebar, raw_origin.Z)
                final_origin = snapped_origin if snapped_origin else raw_origin
            except: final_origin = raw_origin
            
            cand_errors = []
            
            for strat in strategies:
                geom = None
                try:
                    geom = RebarSpliceGeometry(final_origin, strat['n'])
                    opts = RebarSpliceOptions(doc, s_type.Id, strat['p'])
                    
                    success, res_ids, msg = try_splice_low_level(doc, cand_id, s_type.Id, geom, opts)
                    
                    if success:
                        if cand_id in active_pool: active_pool.remove(cand_id)
                        for rid in res_ids: 
                            if rid not in active_pool: active_pool.append(rid)
                        any_modification = True
                        doc.Regenerate()
                        cut_success = True
                        break 
                    else:
                        cand_errors.append(f"{strat['tag']}:{msg}")
                except Exception as ex:
                    pass
                finally:
                    if geom: geom.Dispose()
            
            if cut_success: break # Ya cortamos un fragmento con este plano, pasamos al siguiente plano

        if not cut_success:
            error_log.append(f"Corte {i+1} Falló. Detalles: " + " | ".join(cand_errors))

    return any_modification, active_pool, error_log

# --- EJECUCIÓN ---
if not run_script:
    OUT = ["PAUSA", [], [], []]
else:
    raw_inputs = flatten_inputs(rebars_in)
    
    out_input_ids = []
    out_traceability = []
    out_failed_ids = []
    out_debug_log = []
    
    valid_bars_queue = []
    
    for item in raw_inputs:
        if item:
            try:
                u = UnwrapElement(item)
                if isinstance(u, Rebar) and u.IsValidObject:
                    sid = get_id_str(u.Id)
                    out_input_ids.append(sid)
                    entry = {'element': u, 'id': sid, 'done': False, 'logs': []}
                    valid_bars_queue.append(entry)
            except: pass

    splice_types = []
    for t in to_list(types_in):
        if t:
            u = UnwrapElement(t)
            if isinstance(u, Element): splice_types.append(u)
    planes = to_list(planes_in)

    if not valid_bars_queue:
        OUT = [out_input_ids, ["No valid bars"], [], ["IN[1] Vacío"]]
    elif not splice_types: # Corrección de seguridad
        OUT = [out_input_ids, ["Error: No Splice Types"], [], ["IN[2] Vacío"]]
    elif not planes:
        OUT = [out_input_ids, ["Error: No Planes"], [], ["IN[3] Vacío"]]
    else:
        TransactionManager.Instance.EnsureInTransaction(doc)
        
        pending_queue = valid_bars_queue
        retry_count = 0
        final_results = {}
        
        while len(pending_queue) > 0 and retry_count < MAX_RETRIES:
            next_round = []
            for entry in pending_queue:
                try:
                    mod, final_pool, logs = process_single_bar_v38(entry, planes, splice_types)
                    entry['logs'] = logs
                    
                    if mod:
                        final_results[entry['id']] = final_pool
                        entry['done'] = True
                    else:
                        if entry['element'].IsValidObject: next_round.append(entry)
                        else: final_results[entry['id']] = None
                except Exception as e:
                    entry['logs'].append(str(e))
                    next_round.append(entry)
            
            pending_queue = next_round
            if not pending_queue: break
            doc.Regenerate()
            retry_count += 1
        
        TransactionManager.Instance.TransactionTaskDone()
        
        global_counter = 1
        for entry in valid_bars_queue:
            oid = entry['id']
            if oid in final_results and final_results[oid]:
                for child_id in final_results[oid]:
                    cid_str = get_id_str(child_id)
                    out_traceability.append(f"Barra {global_counter} - ID actual: {cid_str} - ID barra anterior: {oid}")
                    global_counter += 1
            else:
                out_failed_ids.append(oid)
                reasons = " || ".join(entry['logs'])
                out_debug_log.append(f"ID {oid}: {reasons}")

        OUT = [out_input_ids, out_traceability, out_failed_ids, out_debug_log]
# ----------------------------------------
code_block_6 = CodeBlock(A=empalmes) { A[2]; }
id = Element.Id(element=all_elements_of_category)
python_script = Python(IN[0]=code_block_6, IN[1]=id)  # CPython3
# ---------- python_script.python (29 lines) ----------
# IN[0]: lista de textos (opc. vacío)
# IN[1]: lista de números (opc. vacío)
import math

def as_list(x):
    return x if isinstance(x, list) else ([] if x is None else [x])

def canon(val):
    # normaliza a float y redondea para comparar
    try:
        return round(float(val), 9)
    except:
        return None

texts = as_list(IN[0])
nums  = as_list(IN[1])

text_vals = set()
for t in texts:
    c = canon(t)
    if c is not None:
        text_vals.add(c)

result = []
for n in nums:
    c = canon(n)
    result.append(c in text_vals if c is not None else False)

OUT = result
# ----------------------------------------
barras_sin_empalmar = List.FilterByBoolMask(list=all_elements_of_category, mask=python_script)
Barras_sin_empalmes = Output(barras_sin_empalmar.in)
