# Dynamo custom node Empalmes_Vigas_T1.dyf (Dynamo 3.6.0.9395)
# category: 01_Nodos_CQING
# Empalmes pegados a caras de columnas

categories = Categories("OST_Rebar")
all_elements_of_category = ElementsOfCategory(Category=categories)
boolean = BoolSelector(true)
Rebar = Input(Rebar: var[]..[])
Número_de_empalmes = Input(Número_de_empalmes: var[]..[])
Logitudes_Empalmes = Input(Logitudes_Empalmes: var[]..[])
Tipo_de_barra = Input(Tipo_de_barra: var[]..[])
tipos_de_empalmes = Python()  # CPython3
# ---------- tipos_de_empalmes.python (66 lines) ----------
import clr
clr.AddReference("RevitAPI")
clr.AddReference("RevitServices")
clr.AddReference("RevitNodes")
import Revit
clr.ImportExtensions(Revit.Elements)

from Autodesk.Revit.DB import FilteredElementCollector, BuiltInCategory, BuiltInParameter
from RevitServices.Persistence import DocumentManager

doc = DocumentManager.Instance.CurrentDBDocument

def safe_name(e):
    for getter in (
        lambda: e.Name,
        lambda: e.get_Parameter(BuiltInParameter.ALL_MODEL_TYPE_NAME).AsString(),
        lambda: e.get_Parameter(BuiltInParameter.SYMBOL_NAME_PARAM).AsString()
    ):
        try:
            v = getter()
            if v:
                return v
        except:
            pass
    return "<sin nombre>"

def safe_id(eid):
    # Maneja distintos bindings de ElementId
    for attr in ("IntegerValue", "Value"):
        try:
            v = getattr(eid, attr)
            v = v() if callable(v) else v
            return int(v)
        except:
            pass
    try:
        return int(str(eid))
    except:
        return None

if doc is None:
    OUT = "No hay documento Revit."
elif not hasattr(BuiltInCategory, "OST_RebarSpliceType"):
    OUT = "Tu Revit no expone la categoría RebarSpliceType (requiere 2025+)."
else:
    types = list(
        FilteredElementCollector(doc)
        .OfCategory(BuiltInCategory.OST_RebarSpliceType)
        .WhereElementIsElementType()
    )
    if not types:
        OUT = "No hay tipos de empalme en el modelo."
    else:
        sorted_types = sorted(types, key=lambda t: safe_name(t))
        names = [safe_name(t) for t in sorted_types]
        ids = [safe_id(t.Id) for t in sorted_types]
        elements_ds = [t.ToDSType(True) for t in sorted_types]

        items = [{"name": n, "id": i, "element": e} for n, i, e in zip(names, ids, elements_ds)]

        OUT = {
            "names": names,
            "ids": ids,
            "elements": elements_ds,  # úsalo directo en GetParameterByName
            "items": items
        }
# ----------------------------------------
code_block = CodeBlock(A=tipos_de_empalmes) { A["elements"]; }
code_block_2 = CodeBlock { "Nombre de tipo"; }
getParameterValueByName = Element.GetParameterValueByName(element=code_block, parameterName=code_block_2)
code_block_3 = CodeBlock { "Empalme solapado 60D"; }
code_block_4 = CodeBlock(A=getParameterValueByName, B=code_block_3) { A==B; }
filterByBoolMask = List.FilterByBoolMask(list=code_block, mask=code_block_4)
firstItem = List.FirstItem(list=filterByBoolMask.in)
element_type_de_empalmes = Python(IN[0]=Número_de_empalmes, IN[1]=Logitudes_Empalmes, IN[2]=Tipo_de_barra, IN[3]=firstItem)  # "Element type de empalmes Copiados"; CPython3
# ---------- element_type_de_empalmes.python (144 lines) ----------
import clr
clr.AddReference("RevitAPI")
clr.AddReference("RevitServices")
clr.AddReference("RevitNodes")
import Revit
clr.ImportExtensions(Revit.Elements)

from Autodesk.Revit.DB import BuiltInParameter, ElementType, FilteredElementCollector
from RevitServices.Persistence import DocumentManager
from RevitServices.Transactions import TransactionManager

doc = DocumentManager.Instance.CurrentDBDocument

# Entradas
count_in = IN[0]
values_in = IN[1]
prefix = IN[2] if IN[2] is not None else ""
base_type = UnwrapElement(IN[3])

def divisor_from_prefix(txt):
    t = (txt or "").lower()
    if "#10" in t: return 1.9348
    if "#9"  in t: return 1.7205
    if "#8"  in t: return 1.524
    if "#7"  in t: return 1.3335
    if "#6"  in t: return 1.143
    if "#5"  in t: return 0.9525
    if "#4"  in t: return 0.762
    if "#3"  in t: return 0.5715
    return 0.762  # fallback

divisor = divisor_from_prefix(prefix)

def safe_name(e):
    for getter in (
        lambda: e.Name,
        lambda: e.get_Parameter(BuiltInParameter.ALL_MODEL_TYPE_NAME).AsString(),
        lambda: e.get_Parameter(BuiltInParameter.SYMBOL_NAME_PARAM).AsString()
    ):
        try:
            v = getter()
            if v:
                return v
        except:
            pass
    return None

def get_lap_param(t):
    for bip in (BuiltInParameter.REBAR_SPLICE_LAP_LENGTH_MULTIPLIER,):
        try:
            p = t.get_Parameter(bip)
            if p: return p
        except: pass
    return t.LookupParameter("Multiplicador de longitudes de solape")

def find_existing(name, category_id):
    try:
        for et in FilteredElementCollector(doc).WhereElementIsElementType():
            try:
                if et.Category and et.Category.Id == category_id:
                    if safe_name(et) == name:
                        return et
            except:
                continue
    except:
        pass
    return None

# Validaciones
errors = []
try:
    count = int(count_in)
except:
    count = 0
    errors.append("IN[0] debe ser entero > 0")

vals = values_in if isinstance(values_in, list) else ([values_in] if values_in is not None else [])
if count <= 0:
    errors.append("IN[0] debe ser entero > 0")
if len(vals) != count:
    errors.append("IN[1] debe tener exactamente {} valores".format(count))
if base_type is None or not isinstance(base_type, ElementType):
    errors.append("IN[3] debe ser un ElementType de empalme")

if errors:
    OUT = {"created": [], "names": [], "multipliers": [], "errors": errors}
else:
    created, names, multipliers, errs = [], [], [], []

    TransactionManager.Instance.EnsureInTransaction(doc)

    cat_id = base_type.Category.Id if base_type.Category else None

    for v in vals:
        try:
            v_num = float(v)
        except:
            errs.append("Valor no numérico: {}".format(v))
            continue

        new_name = "{} - {}".format(prefix, v_num)
        target_val = (60.0 * v_num) / divisor

        existing = find_existing(new_name, cat_id) if cat_id else None
        if existing:
            new_type = existing
            param = get_lap_param(new_type)
            val = None
            try:
                if param: val = param.AsDouble()
            except:
                pass
            multipliers.append(val)
            errs.append("Reusado '{}' (ya existía, no se modificó)".format(new_name))
        else:
            try:
                new_type = base_type.Duplicate(new_name)
            except Exception as e:
                errs.append("No se pudo duplicar '{}': {}".format(new_name, e))
                continue

            param = get_lap_param(new_type)
            if param and not param.IsReadOnly:
                try:
                    param.Set(target_val)
                    multipliers.append(target_val)
                except Exception as e:
                    errs.append("No se pudo asignar valor en '{}': {}".format(new_name, e))
                    multipliers.append(None)
            else:
                errs.append("Parámetro no encontrado o de solo lectura en '{}'".format(new_name))
                multipliers.append(None)

        created.append(new_type.ToDSType(True))
        names.append(new_name)

    TransactionManager.Instance.TransactionTaskDone()

    OUT = {
        "created": created,
        "names": names,
        "multipliers": multipliers,
        "errors": errs
    }
# ----------------------------------------
code_block_5 = CodeBlock(A=element_type_de_empalmes) { A["created"]; }
Planos = Input(Planos: var[]..[])
empalmes = Python(IN[0]=boolean, IN[1]=Rebar, IN[2]=code_block_5, IN[3]=Planos)  # CPython3
# ---------- empalmes.python (243 lines) ----------
# --- SCRIPT EMPALMES REVIT 2026 (CPYTHON) ---
# Versión: 5.3 (Input Debugger)
# Objetivo: Diagnosticar por qué el script recibe "nada" o filtra todo.
# Muestra conteos de entradas y estado de validez de cada elemento.

import clr
import sys
from System.Collections.Generic import List

# --- IMPORTACIONES REVIT ---
clr.AddReference("RevitAPI")
clr.AddReference("RevitServices")
clr.AddReference("RevitNodes")

from Autodesk.Revit.DB import (
    XYZ, ElementId, Line, BuiltInParameter, 
    Transaction, Element, BuiltInCategory
)
from Autodesk.Revit.DB.Structure import (
    Rebar, RebarSpliceOptions, RebarSpliceUtils, 
    RebarSplicePosition, RebarSpliceError, RebarSpliceGeometry,
    RebarLayoutRule
)

from RevitServices.Persistence import DocumentManager
from RevitServices.Transactions import TransactionManager
import Revit
clr.ImportExtensions(Revit.Elements)

doc = DocumentManager.Instance.CurrentDBDocument

# --- INPUTS ---
run_script = IN[0]
input_rebars = IN[1]
input_types  = IN[2]
input_planes = IN[3]

METROS_A_PIES = 3.280839895

# --- HELPERS ---
def to_list(obj):
    if isinstance(obj, list):
        flat = []
        for item in obj: flat.extend(to_list(item))
        return flat
    else: return [obj]

def to_feet(val): return val * METROS_A_PIES
def to_meters(val): return val / METROS_A_PIES

def dynamo_plane_to_revit(plano_dyn):
    try:
        if hasattr(plano_dyn, "Origin") and hasattr(plano_dyn, "Normal"):
            o = plano_dyn.Origin
            n = plano_dyn.Normal
            origin = XYZ(to_feet(o.X), to_feet(o.Y), to_feet(o.Z))
            normal = XYZ(n.X, n.Y, n.Z).Normalize()
            return origin, normal
    except: return None, None
    return None, None

def validate_splice_type(elem):
    if not elem: return None
    if isinstance(elem, Element):
        if elem.Category:
            try: cat_val = elem.Category.Id.Value
            except: 
                try: cat_val = elem.Category.Id.IntegerValue
                except: return None
            if cat_val == int(BuiltInCategory.OST_RebarSpliceType):
                return elem.Id
    return None

def get_best_intersection(rebar, plane_origin):
    try:
        accessor = rebar.GetShapeDrivenAccessor()
        curves = accessor.ComputeDrivingCurves()
        candidates = []
        for i, c in enumerate(curves):
            if isinstance(c, Line):
                p0, p1 = c.GetEndPoint(0), c.GetEndPoint(1)
                vec_bar = p1.Subtract(p0)
                len_sq = vec_bar.GetLength()**2
                if len_sq < 1e-9: continue
                vec_plane = plane_origin.Subtract(p0)
                t = vec_plane.DotProduct(vec_bar) / len_sq
                if -0.5 <= t <= 1.5:
                    pt = p0.Add(vec_bar.Multiply(t))
                    candidates.append((vec_bar.GetLength(), pt, vec_bar, t))
        if not candidates: return None, None, 0, "No Intersect"
        candidates.sort(key=lambda x: x[0], reverse=True)
        best = candidates[0]
        return best[1], best[2], best[3], f"SegLen={round(to_meters(best[0]),2)}m"
    except Exception as e: return None, None, 0, str(e)

# --- CORE LOGIC ---
def perform_splice(doc, bar_id, type_id, point, vec):
    offsets = [0, 0.164, -0.164]
    positions = [RebarSplicePosition.Middle, RebarSplicePosition.End1, RebarSplicePosition.End2]
    
    for pos in positions:
        for off in offsets:
            try:
                pt = point if off == 0 else point.Add(vec.Multiply(off))
                geom = RebarSpliceGeometry(pt, vec)
                opts = RebarSpliceOptions(doc, type_id, pos)
                
                if RebarSpliceUtils.CanRebarBeSpliced(doc.GetElement(bar_id), opts, geom) == RebarSpliceError.Success:
                    g_list = List[RebarSpliceGeometry]()
                    g_list.Add(geom)
                    res = RebarSpliceUtils.SpliceRebar(doc, bar_id, opts, g_list)
                    if res and len(res) > 0:
                        geom.Dispose()
                        return list(res), f"OK_{pos}"
                geom.Dispose()
            except: pass
    return [], "ZeroIDs"

def robust_workflow(doc, bar, type_id, pt, tan):
    # Captura
    try: 
        acc = bar.GetShapeDrivenAccessor()
        qty = bar.Quantity
        arr_len = acc.ArrayLength
        is_set = qty > 1
        
        # Intentamos cortar normal
        new_ids, status = perform_splice(doc, bar.Id, type_id, pt, tan.Normalize())
        
        if new_ids: return new_ids, f"EXITO: {status}"
        
        # Fallback Single
        if is_set:
            try:
                acc.SetLayoutAsFixedNumber(1, arr_len, True, True, True)
                doc.Regenerate()
                new_ids, s2 = perform_splice(doc, bar.Id, type_id, pt, tan.Normalize())
                
                # Restaurar (Siempre, incluso si falla)
                if new_ids:
                    # Restaurar las nuevas a MaxSpacing (Aproximado seguro)
                    for nid in new_ids:
                        nbar = doc.GetElement(nid)
                        if nbar: nbar.GetShapeDrivenAccessor().SetLayoutAsMaximumSpacing(0.656, arr_len, True, True, True)
                    return new_ids, f"EXITO_SINGLE: {s2}"
                else:
                    # Restaurar original
                    acc.SetLayoutAsFixedNumber(qty, arr_len, True, True, True) # O MaxSpacing si se pudiera leer parametro facil
                    return [], f"FAIL_SINGLE: {s2}"
            except Exception as e:
                return [], f"ERR_SINGLE: {str(e)}"
        
        return [], f"FAIL: {status}"
    except Exception as ex: return [], f"ERR_MAIN: {str(ex)}"

# --- DIAGNOSTIC MAIN ---
def execute_debug(rebars_in, types_in, planes_in):
    # 1. Analisis Inputs Raw
    raw_rebars = to_list(rebars_in)
    raw_types = to_list(types_in)
    raw_planes = to_list(planes_in)
    
    debug_logs = []
    debug_logs.append(f"Inputs Recibidos: Rebars={len(raw_rebars)}, Tipos={len(raw_types)}, Planos={len(raw_planes)}")
    
    # 2. Unwrap y Validacion
    valid_rebars = []
    for i, r in enumerate(raw_rebars):
        unwrapped = UnwrapElement(r)
        if unwrapped and unwrapped.IsValidObject:
            valid_rebars.append(unwrapped)
        else:
            debug_logs.append(f"Rebar[{i}] INVÁLIDA o NULA (Posiblemente borrada)")
            
    debug_logs.append(f"Rebars Válidas para procesar: {len(valid_rebars)}")
    
    if not valid_rebars: return [], debug_logs
    
    # 3. Validar Tipos
    valid_types = []
    for t in raw_types:
        tid = validate_splice_type(UnwrapElement(t))
        valid_types.append(tid)
    
    # 4. Proceso
    num = min(len(valid_types), len(raw_planes))
    if num == 0: debug_logs.append("Cero cortes a procesar (Faltan tipos o planos)")
    
    pool = [r.Id for r in valid_rebars]
    
    for i in range(num):
        p_org, _ = dynamo_plane_to_revit(raw_planes[i])
        tid = valid_types[i]
        
        if not p_org: 
            debug_logs.append(f"Corte {i}: Plano Malo")
            continue
        if not tid:
            debug_logs.append(f"Corte {i}: Tipo Malo")
            continue
            
        next_pool = []
        cut_happened = False
        
        current_list = list(pool)
        for bid in current_list:
            bar = doc.GetElement(bid)
            if not bar: continue
            
            pt, tan, t, info = get_best_intersection(bar, p_org)
            
            if pt:
                new_ids, msg = robust_workflow(doc, bar, tid, pt, tan)
                if new_ids:
                    next_pool.extend(new_ids)
                    cut_happened = True
                else:
                    next_pool.append(bid)
                    debug_logs.append(f"Corte {i} ID {bid}: {msg} [{info}]")
            else:
                next_pool.append(bid)
                debug_logs.append(f"Corte {i} ID {bid}: No Intersecta")
        
        pool = next_pool
        if cut_happened: doc.Regenerate()
        
    return pool, debug_logs

if run_script:
    TransactionManager.Instance.EnsureInTransaction(doc)
    try:
        f_ids, f_logs = execute_debug(input_rebars, input_types, input_planes)
        TransactionManager.Instance.TransactionTaskDone()
        
        final_msg = "V5.3 Debugger Completado"
        if not f_ids: final_msg = "ALERTA: Pool Final Vacío"
        
        OUT = [[str(i.Value) for i in f_ids], f_logs, final_msg]
    except Exception as e:
        TransactionManager.Instance.ForceCloseTransaction()
        OUT = [[], [str(e)], "Crash"]
else:
    OUT = [[], ["Script Off"], "Off"]
# ----------------------------------------
code_block_6 = CodeBlock(A=empalmes) { A[2]; }
id = Element.Id(element=all_elements_of_category)
python_script = Python(IN[0]=code_block_6, IN[1]=id)  # CPython3
# ---------- python_script.python (29 lines) ----------
# IN[0]: lista de textos (opc. vacío)
# IN[1]: lista de números (opc. vacío)
import math

def as_list(x):
    return x if isinstance(x, list) else ([] if x is None else [x])

def canon(val):
    # normaliza a float y redondea para comparar
    try:
        return round(float(val), 9)
    except:
        return None

texts = as_list(IN[0])
nums  = as_list(IN[1])

text_vals = set()
for t in texts:
    c = canon(t)
    if c is not None:
        text_vals.add(c)

result = []
for n in nums:
    c = canon(n)
    result.append(c in text_vals if c is not None else False)

OUT = result
# ----------------------------------------
barras_sin_empalmar = List.FilterByBoolMask(list=all_elements_of_category, mask=python_script)
in_ = Output(empalmes)  # "in"
