# Dynamo custom node Filter_Element_By_Category.dyf (Dynamo 3.5.2.8914)
# category: 01_Nodos_CQING

Element = Input(Element: var)
getCategory = Element.GetCategory(element=Element)
Categoria = Input(Categoria: var[]..[])  # Nombre de entrada por defecto; cambie el nombre.
equals = List.Equals(object=getCategory, otherObject=Categoria, lacing=Longest)
filterByBoolMask = List.FilterByBoolMask(list=Element, mask=equals)
OUT = Output(filterByBoolMask.in)
