# Dynamo custom node GetLocationActual.dyf (Dynamo 3.5.2.8914)
# category: 01_Nodos_CQING
# Crea una linea en el eje centroidal de Vigas o Columnas

Elemento = Input(Elemento: var[]..[])  # Nombre de entrada por defecto; cambie el nombre.
identity = Object.Identity(object=Elemento)
categories = Categories("OST_StructuralFraming")
filter_Element_By_Category = Custom[Filter_Element_By_Category](Element=identity, Categoria=categories)
faces = Element.Faces(element=filter_Element_By_Category)
obtiene_caras_surfaces_mas = Python(IN[0]=faces)  # "Obtiene caras (Surfaces) mas lejanas entre si"; CPython3
# ---------- obtiene_caras_surfaces_mas.python (40 lines) ----------
import clr
clr.AddReference('RevitAPI')
from Autodesk.DesignScript.Geometry import Surface
import math

def get_center(surface):
    bbox = surface.BoundingBox
    pt_min = bbox.MinPoint
    pt_max = bbox.MaxPoint
    return [(pt_min.X + pt_max.X)/2.0, (pt_min.Y + pt_max.Y)/2.0, (pt_min.Z + pt_max.Z)/2.0]

def extremos_superficies(surfaces):
    if not surfaces or len(surfaces) < 2:
        return surfaces
    centers = [get_center(s) for s in surfaces]
    max_dist = -1
    idx_a, idx_b = 0, 0
    for i, c1 in enumerate(centers):
        for j, c2 in enumerate(centers):
            dist = math.sqrt(sum([(a - b)**2 for a, b in zip(c1, c2)]))
            if dist > max_dist:
                max_dist = dist
                idx_a, idx_b = i, j
    vec_dir = [b - a for a, b in zip(centers[idx_a], centers[idx_b])]
    norm = math.sqrt(sum([x**2 for x in vec_dir]))
    dir_norm = [x / norm for x in vec_dir]
    def proyectar(c, origen, dir_norm):
        return sum([(ci - oi)*di for ci, oi, di in zip(c, origen, dir_norm)])
    origen = centers[idx_a]
    proyecciones = [proyectar(c, origen, dir_norm) for c in centers]
    orden = sorted(range(len(proyecciones)), key=lambda k: proyecciones[k])
    return [surfaces[orden[0]], surfaces[orden[-1]]]

def deep_process(item):
    if isinstance(item, list):
        return [deep_process(subitem) for subitem in item] if item and isinstance(item[0], list) else extremos_superficies(item)
    else:
        return item

OUT = deep_process(IN[0])
# ----------------------------------------
code_block = CodeBlock { 0.5; }
pointAtParameter = Surface.PointAtParameter(surface=obtiene_caras_surfaces_mas, u=code_block, v=code_block)
flatten = List.Flatten(list=pointAtParameter@L2)
isEmpty = List.IsEmpty(list=flatten)
byCoordinates = Point.ByCoordinates()
isEmpty_2 = List.IsEmpty(list=flatten)
code_block_2 = CodeBlock { 0..1..1; }
if_ = RefactoredIf(test=isEmpty_2, true=code_block_2, false=flatten)
transpose = List.Transpose(lists=if_)
firstItem = List.FirstItem(list=transpose)
if_2 = RefactoredIf(test=isEmpty, true=byCoordinates, false=firstItem)
code_block_3 = CodeBlock { 1; }
byCoordinates_2 = Point.ByCoordinates(z=code_block_3)
lastItem = List.LastItem(list=transpose)
if_3 = RefactoredIf(test=isEmpty, true=byCoordinates_2, false=lastItem)
byStartPointEndPoint = Line.ByStartPointEndPoint(startPoint=if_2, endPoint=if_3)
flatten_2 = List.Flatten(list=obtiene_caras_surfaces_mas@L2)
perimeterCurves = Surface.PerimeterCurves(surface=flatten_2)
vector_By_Line = Custom[Vector_By_Line](Linea=perimeterCurves)  # Crea un vector a partir de una linea
ZAxis = Vector.ZAxis()
angleWithVector = Vector.AngleWithVector(vector=vector_By_Line, otherVector=ZAxis)
code_block_4 = CodeBlock(a=angleWithVector) { a==90; }
filterByBoolMask = List.FilterByBoolMask(list=perimeterCurves, mask=code_block_4)
startPoint = Curve.StartPoint(curve=filterByBoolMask.in)
Z = Point.Z(point=startPoint)
maximumItem = List.MaximumItem(list=Z)
code_block_5 = CodeBlock(a=Z, b=maximumItem) { a==b; }
filterByBoolMask_2 = List.FilterByBoolMask(list=filterByBoolMask.in, mask=code_block_5)
vector_By_Line_2 = Custom[Vector_By_Line](Linea=filterByBoolMask_2.in)
baseB_AlturaH_Vigas_Columnas = Custom[BaseB_AlturaH_Vigas_Columnas](element=identity)  # Obtiene los valores de la seccion trasnversal (B y H) de vigas o columnas.
code_block_6 = CodeBlock(B=baseB_AlturaH_Vigas_Columnas.Base_B) { B/2; }
byStartPointDirectionLength = Line.ByStartPointDirectionLength(startPoint=flatten, direction=vector_By_Line_2, length=code_block_6)
flatten_3 = List.Flatten(list=byStartPointDirectionLength)
isEmpty_3 = List.IsEmpty(list=flatten_3)
empty = List.Empty()
code_block_7 = CodeBlock { 0..1..1; }
if_4 = RefactoredIf(test=isEmpty_3, true=code_block_7, false=flatten_3)
firstItem_2 = List.FirstItem(list=if_4)
if_5 = RefactoredIf(test=isEmpty_3, true=empty, false=firstItem_2)
endPoint = Curve.EndPoint(curve=if_5)
byLineAndPoint = Plane.ByLineAndPoint(line=byStartPointEndPoint, point=endPoint)
isEmpty_4 = List.IsEmpty(list=byLineAndPoint)
byOriginNormal = Plane.ByOriginNormal()
if_6 = RefactoredIf(test=isEmpty_4, true=byOriginNormal, false=byLineAndPoint)
code_block_8 = CodeBlock { 100; }
byWidthLength = Rectangle.ByWidthLength(plane=if_6, width=code_block_8, length=code_block_8)
byPatch = Surface.ByPatch(closedCurve=byWidthLength)
getLocation = Element.GetLocation(element=identity)
count = List.Count(list=getLocation)
code_block_9 = CodeBlock(a=count) { a==1; }
code_block_10 = CodeBlock { "Autodesk.DesignScript.Geometry.Line"; }
removeIfNot = List.RemoveIfNot(list=getLocation, type=code_block_10)
if_7 = RefactoredIf(test=code_block_9, true=getLocation, false=removeIfNot)
isNull = Object.IsNull(object=if_7)
firstItem_3 = List.FirstItem(list=isNull)
empty_2 = List.Empty()
if_8 = RefactoredIf(test=firstItem_3, true=empty_2, false=if_7)
ZAxis_2 = Vector.ZAxis()
reverse = Vector.Reverse(vector=ZAxis_2)
projectInputOnto = Surface.ProjectInputOnto(surface=byPatch, geometryToProject=if_8, projectionDirection=reverse)
flatten_4 = List.Flatten(list=projectInputOnto)
Location_Vigas = Output(flatten_4)
categories_2 = Categories("OST_StructuralColumns")
filter_Element_By_Category_2 = Custom[Filter_Element_By_Category](Element=identity, Categoria=categories_2)
faces_2 = Element.Faces(element=filter_Element_By_Category_2)
obtiene_caras_surfaces_mas_2 = Python(IN[0]=faces_2)  # "Obtiene caras (Surfaces) mas lejanas entre si"; CPython3; same code as obtiene_caras_surfaces_mas
code_block_11 = CodeBlock { 0.5; }
pointAtParameter_2 = Surface.PointAtParameter(surface=obtiene_caras_surfaces_mas_2, u=code_block_11, v=code_block_11)
flatten_5 = List.Flatten(list=pointAtParameter_2)
Z_2 = Point.Z(point=flatten_5)
minimumItem = List.MinimumItem(list=Z_2)
code_block_12 = CodeBlock(a=Z_2, b=minimumItem) { a==b; }
filterByBoolMask_3 = List.FilterByBoolMask(list=flatten_5, mask=code_block_12)
byStartPointEndPoint_2 = Line.ByStartPointEndPoint(startPoint=filterByBoolMask_3.in, endPoint=filterByBoolMask_3.out)
Location_Columnas = Output(byStartPointEndPoint_2)
watch = Watch(flatten_4)
