# Dynamo custom node If_Combinatoria_dos_Booleanos.dyf (Dynamo 3.0.3.7597)
# category: 01_Nodos_CQING
# Dados dos booleados, permite evaluar todas combinasciones posibles: True-True, True-False, False-True, False-False

Booleano_1 = Input(Booleano_1: var[]..[])
Booleano_2 = Input(Booleano_2: var[]..[])
True_True = Input(True_True: var[]..[])
True_False = Input(True_False: var[]..[])
False_True = Input(False_True: var[]..[])
False_False = Input(False_False: var[]..[])
estructura_if_para_seleccionar = Python(IN[0]=Booleano_1, IN[1]=Booleano_2, IN[2]=True_True, IN[3]=True_False, IN[4]=False_True, IN[5]=False_False)  # "Estructura If para Seleccionar un Resultado Según Todas las Combinaciones Posibles entre Dos Valores Booleanos de Entrada"; CPython3
# ---------- estructura_if_para_seleccionar.python (19 lines) ----------
# Entradas
Ini = IN[0]
Fin = IN[1]
res1 = IN[2]  # Primera condición: Ini = True, Fin = True
res2 = IN[3]  # Segunda condición: Ini = True, Fin = False
res3 = IN[4]  # Tercera condición: Ini = False, Fin = True
res4 = IN[5]  # Cuarta condición: Ini = False, Fin = False

# Lógica anidada
if Ini == True:
    if Fin == True:
        OUT = res1  # Primera condición
    else:
        OUT = res2  # Segunda condición
else:
    if Fin == True:
        OUT = res3  # Tercera condición
    else:
        OUT = res4  # Cuarta condición
# ----------------------------------------
OUT = Output(estructura_if_para_seleccionar)
