# Dynamo custom node Lineas_Acero_Vigas_Rebar.dyf "Lineas_Acero_Vigas" (Dynamo 3.5.2.8914)
# category: Revit
# Crea las lineas que representan el acero longitudinal de una viga horizontal

element = Input(element: Revit.Elements.Element)
getLocationActual = Custom[GetLocationActual](Elemento=element)  # Crea una linea en el eje centroidal de Vigas o Columnas
vector_By_Line = Custom[Vector_By_Line](Linea=getLocationActual.Location_Vigas)  # Crea un vector a partir de una linea

# group: Caras paralelas a la linea centroidal de la viga seleccionada y paralelas al eje Z
# Descripción <Haga doble clic aquí para editar la descripción del grupo>
todas_las_caras_de_la_viga = Element.Faces(element=element)  # "Todas las caras de la viga seleccionada"
flatten = List.Flatten(list=todas_las_caras_de_la_viga)
normalAtParameter = Surface.NormalAtParameter(surface=todas_las_caras_de_la_viga)
ZAxis = Vector.ZAxis()
code_block = CodeBlock { 90; }
rotate = Vector.Rotate(vector=vector_By_Line, axis=ZAxis, degrees=code_block)
dot = Vector.Dot(vector=normalAtParameter, vec=rotate)
flatten_2 = List.Flatten(list=dot)
code_block_2 = CodeBlock { 0.1; -0.1; }
gt = flatten_2 > code_block_2.out1
lt = flatten_2 < code_block_2.out0
and_ = gt && lt
filterByBoolMask = List.FilterByBoolMask(list=flatten, mask=and_)
watch = Watch(filterByBoolMask.out)
code_block_3 = CodeBlock { 0; }
caras_perpendiculares_al_eje = List.GetItemAtIndex(list=watch@L3, index=code_block_3)  # "Caras perpendiculares al eje centroidal de las vigas"
flatten_3 = List.Flatten(list=caras_perpendiculares_al_eje)

obtiene_todas_las_vigas = Python(IN[0]=element)  # "Obtiene todas las vigas continuas en la misma dirección"; CPython3
# ---------- obtiene_todas_las_vigas.python (74 lines) ----------
import clr
clr.AddReference('RevitAPI')
clr.AddReference('RevitServices')
from Autodesk.Revit.DB import *
from RevitServices.Persistence import DocumentManager

doc = DocumentManager.Instance.CurrentDBDocument

viga_sel = UnwrapElement(IN[0])
vigas = FilteredElementCollector(doc).OfCategory(BuiltInCategory.OST_StructuralFraming).WhereElementIsNotElementType().ToElements()

def get_id_val(obj):
    # Si es int, devuelve directo
    if type(obj) == int:
        return obj
    # Si es un ElementId (CPython3)
    if obj.__class__.__name__ == "ElementId":
        return int(str(obj))
    # Si es un elemento Revit, accede a su Id
    if hasattr(obj, 'Id'):
        return get_id_val(obj.Id)
    # Si es string, intenta convertir
    try:
        return int(obj)
    except:
        raise Exception("No se puede extraer IntegerValue del objeto (tipo {}): {}".format(type(obj), obj))

def extremos_y_direccion(viga):
    loc = viga.Location
    if hasattr(loc, "Curve"):
        curva = loc.Curve
        p0 = curva.GetEndPoint(0)
        p1 = curva.GetEndPoint(1)
        vec = XYZ(p1.X - p0.X, p1.Y - p0.Y, p1.Z - p0.Z)
        mag = vec.GetLength()
        if mag == 0:
            return [p0, p1], None
        dir_norm = XYZ(vec.X/mag, vec.Y/mag, vec.Z/mag)
        return [p0, p1], dir_norm
    return [], None

tolerancia = 0.001
umbral_direccion = 0.01

ext_sel, dir_sel = extremos_y_direccion(viga_sel)
visitadas = set([get_id_val(viga_sel)])
cola = [(viga_sel, ext_sel, dir_sel)]
resultado = [viga_sel]

while cola:
    actual, extremos_act, dir_act = cola.pop(0)
    for viga in vigas:
        if get_id_val(viga) in visitadas:
            continue
        ext_viga, dir_viga = extremos_y_direccion(viga)
        if dir_viga is None:
            continue
        dot = abs(dir_act.X * dir_viga.X + dir_act.Y * dir_viga.Y + dir_act.Z * dir_viga.Z)
        paralelo = abs(dot - 1.0) < umbral_direccion
        if paralelo:
            conectado = False
            for p1 in extremos_act:
                for p2 in ext_viga:
                    if p1.DistanceTo(p2) < tolerancia:
                        conectado = True
                        break
                if conectado:
                    break
            if conectado:
                visitadas.add(get_id_val(viga))
                resultado.append(viga)
                cola.append((viga, ext_viga, dir_viga))

OUT = resultado
# ----------------------------------------
elementos_unidos = Element.GetJoinedElements(element=obtiene_todas_las_vigas)
list_create = List.Create(item0=obtiene_todas_las_vigas, item1=elementos_unidos)
todos_los_elementos_que = List.UniqueItems(list=list_create)  # "Todos los elementos que intervienen en el pórtico"
getLocationActual_2 = Custom[GetLocationActual](Elemento=element)
vector_By_Line_2 = Custom[Vector_By_Line](Linea=getLocationActual_2.Location_Vigas)

# group: Caras perpendiculares a la linea centroidal de las vigas
# Descripción <Haga doble clic aquí para editar la descripción del grupo>
todas_las_caras_de_todos_los = Element.Faces(element=todos_los_elementos_que)  # "Todas las caras de todos los elementos"
flatten_4 = List.Flatten(list=todas_las_caras_de_todos_los)
normalAtParameter_2 = Surface.NormalAtParameter(surface=todas_las_caras_de_todos_los)
dot_2 = Vector.Dot(vector=normalAtParameter_2, vec=vector_By_Line_2)
flatten_5 = List.Flatten(list=dot_2)
code_block_4 = CodeBlock { 0.1; -0.1; }
gt_2 = flatten_5 > code_block_4.out1
lt_2 = flatten_5 < code_block_4.out0
and_2 = gt_2 && lt_2
filterByBoolMask_2 = List.FilterByBoolMask(list=flatten_4, mask=and_2)
watch_2 = Watch(filterByBoolMask_2.out)
code_block_5 = CodeBlock { 0; }
caras_perpendiculares_al_eje_2 = List.GetItemAtIndex(list=watch_2@L3, index=code_block_5)  # "Caras perpendiculares al eje centroidal de las vigas"
flatten_6 = List.Flatten(list=caras_perpendiculares_al_eje_2)

getLocationActual_3 = Custom[GetLocationActual](Elemento=element)
vector_By_Line_3 = Custom[Vector_By_Line](Linea=getLocationActual_3.Location_Vigas)

# group: Crea una linea super larga (400 m equidistantemente) que pasa por el eje centroidal de la viga seleccionada
# Descripción <Haga doble clic aquí para editar la descripción del grupo>
startPoint = Curve.StartPoint(curve=getLocationActual_3.Location_Vigas)
code_block_6 = CodeBlock { 200; }
byStartPointDirectionLength = Line.ByStartPointDirectionLength(startPoint=startPoint, direction=vector_By_Line_3, length=code_block_6)
endPoint = Curve.EndPoint(curve=byStartPointDirectionLength)
code_block_7 = CodeBlock { -400; }

vector_By_Line_4 = Custom[Vector_By_Line](Linea=byStartPointDirectionLength)

# group (continued): Crea una linea super larga (400 m equidistantemente) que pasa por el eje centroidal de la viga seleccionada
byStartPointDirectionLength_2 = Line.ByStartPointDirectionLength(startPoint=endPoint, direction=vector_By_Line_4, length=code_block_7)

firstItem = List.FirstItem(list=byStartPointDirectionLength_2)

# group: Obtiene caras (Surfaces) mas lejanas entre si
# Descripción <Haga doble clic aquí para editar la descripción del grupo>
obtiene_surfaces_que_se = Python(IN[0]=flatten_6, IN[1]=firstItem)  # "Obtiene surfaces que se intersecan con una linea dada una lista de surfaces (IN[0]) y una linea (IN[1])"; CPython3
# ---------- obtiene_surfaces_que_se.python (20 lines) ----------
import clr
clr.AddReference('ProtoGeometry')
from Autodesk.DesignScript.Geometry import *

surfaces = IN[0]  # Lista plana de surfaces (ya aplanada con List.Flatten)
line = IN[1]      # Línea a verificar

intersected_surfaces = []
debug = []

for s in surfaces:
    try:
        intersection = s.Intersect(line)
        debug.append(intersection)
        if intersection and hasattr(intersection, "__len__") and len(intersection) > 0:
            intersected_surfaces.append(s)
    except Exception as e:
        debug.append("Error: " + str(e))

OUT = (intersected_surfaces)
# ----------------------------------------
obtiene_caras_surfaces_mas = Python(IN[0]=obtiene_surfaces_que_se)  # "Obtiene caras (Surfaces) mas lejanas entre si"; CPython3
# ---------- obtiene_caras_surfaces_mas.python (26 lines) ----------
import clr
import sys
clr.AddReference('ProtoGeometry')
from Autodesk.DesignScript.Geometry import *

# IN[0] = surfaces
surfaces = IN[0]

def surface_center(surface):
    # Calcula el punto central en parámetros UV (0.5, 0.5)
    return surface.PointAtParameter(0.5, 0.5)

max_dist = -1
pair = (None, None)

n = len(surfaces)
for i in range(n):
    center_i = surface_center(surfaces[i])
    for j in range(i+1, n):
        center_j = surface_center(surfaces[j])
        dist = center_i.DistanceTo(center_j)
        if dist > max_dist:
            max_dist = dist
            pair = (surfaces[i], surfaces[j])

OUT = pair, max_dist
# ----------------------------------------
code_block_8 = CodeBlock { 0; }
caras_mas_distantes_entre_si = List.GetItemAtIndex(list=obtiene_caras_surfaces_mas, index=code_block_8)

# group: Selecciona el orden de las caras de inicio y fin de las lineas de las barras
# Descripción <Haga doble clic aquí para editar la descripción del grupo>
watch_3 = Watch(caras_mas_distantes_entre_si)
getLocationActual_4 = Custom[GetLocationActual](Elemento=element)
startPoint_2 = Curve.StartPoint(curve=getLocationActual_4.Location_Vigas)
vector_By_Line_5 = Custom[Vector_By_Line](Linea=getLocationActual_4.Location_Vigas)
code_block_9 = CodeBlock { 200; }
byStartPointDirectionLength_3 = Line.ByStartPointDirectionLength(startPoint=startPoint_2, direction=vector_By_Line_5, length=code_block_9)
endPoint_2 = Curve.EndPoint(curve=byStartPointDirectionLength_3)
distanceTo = Geometry.DistanceTo(geometry=watch_3, other=endPoint_2, lacing=Longest)
minimumItem = List.MinimumItem(list=distanceTo)
maximumItem = List.MaximumItem(list=distanceTo)
eq = distanceTo == maximumItem

rebar = Input(rebar: Revit.Elements.Element)

# group: Altura (h) y Base (b) de la viga seleccionada
# Descripción <Haga doble clic aquí para editar la descripción del grupo>
code_block_10 = CodeBlock { "Tipo"; "h"; "b"; }
getParameterValueByName = Element.GetParameterValueByName(element=element, parameterName=code_block_10.out0)
altura_h = Element.GetParameterValueByName(element=getParameterValueByName, parameterName=code_block_10.out1)
base_b = Element.GetParameterValueByName(element=getParameterValueByName, parameterName=code_block_10.out2)

# group: Recubrimiento de la viga seleccionada
# Descripción <Haga doble clic aquí para editar la descripción del grupo>
code_block_11 = CodeBlock { "Recubrimiento de armadura - Cara inferior"; "Longitud"; }
getParameterValueByName_2 = Element.GetParameterValueByName(element=element, parameterName=code_block_11.out0)
recubrimirnto_en_mm = Element.GetParameterValueByName(element=getParameterValueByName_2, parameterName=code_block_11.out1)
recubrimiento_en_m = CodeBlock(Rec=recubrimirnto_en_mm) { Rec/1000; }

rebar_2 = Input(rebar: Revit.Elements.Element)

# group: Rectangulo para ubicar las barras en los vertices en plano ubicado en el punto inicial de la linea del eje centroidal de la viga seleccionada
# Descripción <Haga doble clic aquí para editar la descripción del grupo>
getLocationActual_5 = Custom[GetLocationActual](Elemento=element)
startPoint_3 = Curve.StartPoint(curve=getLocationActual_5.Location_Vigas)
vector_By_Line_6 = Custom[Vector_By_Line](Linea=getLocationActual_5.Location_Vigas)
plano_en_el_punto_inicial_de_la = Plane.ByOriginNormal(origin=startPoint_3, normal=vector_By_Line_6)  # "Plano en el punto inicial de la linea del eje centroidal de la viga seleccionada"
alto_w = Watch(altura_h)
base_l = Watch(base_b)
rectangulo_que_representa_la = Rectangle.ByWidthLength(plane=plano_en_el_punto_inicial_de_la, width=alto_w, length=base_l)  # "Rectangulo que representa la seccion de la viga seleccionada"
recubrimiento_en_m_2 = Watch(recubrimiento_en_m)
code_block_12 = CodeBlock { "Diámetro de barra"; }
getParameterValueByName_3 = Element.GetParameterValueByName(element=rebar_2, parameterName=code_block_12)

# group: Rectangulo para ubicar las barras en los vertices en plano ubicado en el punto inicial de la linea del eje centroidal de la viga seleccionada > Diametro del estribo
# Descripción <Haga doble clic aquí para editar la descripción del grupo>
diametro_del_estribo_en_m = CodeBlock(De=getParameterValueByName_3) { De/1000; }
diametro_de_la_barra_en_m = CodeBlock(Db=getParameterValueByName_3) { Db/1000; }

# group (continued): Rectangulo para ubicar las barras en los vertices en plano ubicado en el punto inicial de la linea del eje centroidal de la viga seleccionada
re = CodeBlock(De=diametro_del_estribo_en_m) { De/2; }
rb = CodeBlock(Db=diametro_de_la_barra_en_m) { Db/2; }
code_block_13 = CodeBlock(Rec=recubrimiento_en_m_2, Re=re, Rb=rb) { -Rec-Re-(Re+Rb); }
cuadrado_que_representa_a_las = Curve.OffsetMany(curve=rectangulo_que_representa_la, signedDistance=code_block_13)  # "Cuadrado que representa a las lineas de las barras con sus 4 vertices"

# group: Nombrando caras para establecer origen y fin de las barras.
# Descripción <Haga doble clic aquí para editar la descripción del grupo>
filterByBoolMask_3 = List.FilterByBoolMask(list=watch_3, mask=eq)

# group: Obtiene los planos que representan a la cara 1 y a la cara 2.
# Descripción <Haga doble clic aquí para editar la descripción del grupo>
curvas_de_la_cara_1 = Surface.PerimeterCurves(surface=filterByBoolMask_3.in)
code_block_14 = CodeBlock { 0; }
cualquier_linea_de_la_cara_1 = List.GetItemAtIndex(list=curvas_de_la_cara_1, index=code_block_14)
policurvas_de_la_cara_1 = PolyCurve.ByJoinedCurves(curves=curvas_de_la_cara_1)
puntos_de_los_vertices_la = PolyCurve.Points(polyCurve=policurvas_de_la_cara_1)  # "Puntos de los vertices la policurva de la cara 1"
byPoints = Polygon.ByPoints(points=puntos_de_los_vertices_la)
punto_central_de_la_cara_1 = Polygon.Center(polygon=byPoints)
plano_en_la_cara_1 = Plane.ByLineAndPoint(line=cualquier_linea_de_la_cara_1, point=punto_central_de_la_cara_1)
curvas_de_la_cara_2 = Surface.PerimeterCurves(surface=filterByBoolMask_3.out)
code_block_15 = CodeBlock { 0; }
cualquier_linea_de_la_cara_2 = List.GetItemAtIndex(list=curvas_de_la_cara_2, index=code_block_15)
policurvas_de_la_cara_2 = PolyCurve.ByJoinedCurves(curves=curvas_de_la_cara_2)
puntos_de_los_vertices_la_2 = PolyCurve.Points(polyCurve=policurvas_de_la_cara_2)  # "Puntos de los vertices la policurva de la cara 2"
byPoints_2 = Polygon.ByPoints(points=puntos_de_los_vertices_la_2)
punto_central_de_la_cara_2 = Polygon.Center(polygon=byPoints_2)
plano_en_la_cara_2 = Plane.ByLineAndPoint(line=cualquier_linea_de_la_cara_2, point=punto_central_de_la_cara_2)

# group: Puntos de inicio (Cara 1) y fin (Cara 2) de las lineas de las barras
# Descripción <Haga doble clic aquí para editar la descripción del grupo>
cuadrado_que_representa_a_las_2 = Curve.PullOntoPlane(curve=cuadrado_que_representa_a_las, plane=plano_en_la_cara_1)  # "Cuadrado que representa a las lineas de las barras con sus 4 vertices - Cara 1"
puntos_iniciales_cara_1 = PolyCurve.Points(polyCurve=cuadrado_que_representa_a_las_2)
cuadrado_que_representa_a_las_3 = Curve.PullOntoPlane(curve=cuadrado_que_representa_a_las, plane=plano_en_la_cara_2)  # "Cuadrado que representa a las lineas de las barras con sus 4 vertices - Cara 2"
puntos_finales_cara_2 = PolyCurve.Points(polyCurve=cuadrado_que_representa_a_las_3)
byStartPointEndPoint = Line.ByStartPointEndPoint(startPoint=puntos_iniciales_cara_1, endPoint=puntos_finales_cara_2)
firstItem_2 = List.FirstItem(list=byStartPointEndPoint)
vector_By_Line_7 = Custom[Vector_By_Line](Linea=firstItem_2)
watch_4 = Watch(recubrimiento_en_m_2)
punto_de_las_barras_con = Geometry.Translate(geometry=puntos_iniciales_cara_1, direction=vector_By_Line_7, distance=watch_4)  # "Punto de las barras con recubrimiento - Cara 1"
length = Curve.Length(curve=firstItem_2)
code_block_16 = CodeBlock(L=length, Rec=watch_4) { L-Rec; }
punto_de_las_barras_con_2 = Geometry.Translate(geometry=puntos_iniciales_cara_1, direction=vector_By_Line_7, distance=code_block_16)  # "Punto de las barras con recubrimiento - Cara 2"

# group: Puntos para dibujar las barras de acero en la cara superior y la cara inferior > Puntos mas altos con respecto al plano xy global
# Descripción <Haga doble clic aquí para editar la descripción del grupo>
Z = Point.Z(point=punto_de_las_barras_con)
maximumItem_2 = List.MaximumItem(list=Z)
eq_2 = maximumItem_2 == Z
filterByBoolMask_4 = List.FilterByBoolMask(list=punto_de_las_barras_con, mask=eq_2)
watch_5 = Watch(filterByBoolMask_4.in)
flatten_7 = List.Flatten(list=watch_5)
Z_2 = Point.Z(point=punto_de_las_barras_con_2)
maximumItem_3 = List.MaximumItem(list=Z_2)
eq_3 = maximumItem_3 == Z_2
filterByBoolMask_5 = List.FilterByBoolMask(list=punto_de_las_barras_con_2, mask=eq_3)
watch_6 = Watch(filterByBoolMask_5.in)
flatten_8 = List.Flatten(list=watch_6)

# group: Obtener punto medio de la linea del eje centroidal de la viga seleccionada
# Descripción <Haga doble clic aquí para editar la descripción del grupo>
startPoint_4 = Curve.StartPoint(curve=getLocationActual.Location_Vigas)
endPoint_3 = Curve.EndPoint(curve=getLocationActual.Location_Vigas)
punto_medio_de_la_linea = Python(IN[0]=startPoint_4, IN[1]=endPoint_3)  # "Punto medio de la linea centroidal de la viga seleccionada"; CPython3
# ---------- punto_medio_de_la_linea.python (23 lines) ----------
import clr
clr.AddReference('RevitAPI')
from Autodesk.Revit.DB import XYZ

A = IN[0]
B = IN[1]

# Si el punto viene como lista, toma el primero
if isinstance(A, list): A = A[0]
if isinstance(B, list): B = B[0]

def to_xyz(pt):
    if isinstance(pt, XYZ):
        return pt
    return XYZ(pt.X, pt.Y, pt.Z)

A = to_xyz(A)
B = to_xyz(B)

# Cálculo del punto medio
mid = XYZ((A.X+B.X)/2, (A.Y+B.Y)/2, (A.Z+B.Z)/2)

OUT = mid
# ----------------------------------------
string_from_object = FromObject(object=punto_medio_de_la_linea)
code_block_17 = CodeBlock { ","; }
split = String.Split(string=string_from_object, separator0=code_block_17)
code_block_18 = CodeBlock { "("; }
split_2 = String.Split(string=split, separator0=code_block_18)
code_block_19 = CodeBlock { ")"; }
split_3 = String.Split(string=split_2@L1, separator0=code_block_19)
toNumber = String.ToNumber(string=split_3)
code_block_20 = CodeBlock { 0; 1; 2; }
getItemAtIndex = List.GetItemAtIndex(list=toNumber, index=code_block_20.out0)
getItemAtIndex_2 = List.GetItemAtIndex(list=toNumber, index=code_block_20.out1)
getItemAtIndex_3 = List.GetItemAtIndex(list=toNumber, index=code_block_20.out2)
byCoordinates = Point.ByCoordinates(x=getItemAtIndex, y=getItemAtIndex_2, z=getItemAtIndex_3)

# group: Linea del eje centroidal de la viga seleccionada rotada 90° desde su punto medio, paralela al plano xy
# Descripción <Haga doble clic aquí para editar la descripción del grupo>
ZAxis_2 = Vector.ZAxis()
code_block_21 = CodeBlock { 90; }
linea_rotada_90 = Geometry.Rotate(geometry=getLocationActual.Location_Vigas, origin=byCoordinates, axis=ZAxis_2, degrees=code_block_21)
startPoint_5 = Curve.StartPoint(curve=linea_rotada_90)

# group: Puntos para dibujar las barras de acero en la cara superior y la cara inferior > Obtiene los puntos para dibujar la linea de la barra de acero en la cara superior
# Descripción <Haga doble clic aquí para editar la descripción del grupo>
distancias_de_los_puntos_mas = Geometry.DistanceTo(geometry=flatten_7, other=startPoint_5, lacing=Longest)  # "Distancias de los puntos mas altos (Cara 1) al punto inicial de la linea centroidal rotada 90°"
minimumItem_2 = List.MinimumItem(list=distancias_de_los_puntos_mas)
eq_4 = distancias_de_los_puntos_mas == minimumItem_2
filterByBoolMask_6 = List.FilterByBoolMask(list=flatten_7, mask=eq_4)
punto_1_para_iniciar_la_barra_de = List.Flatten(list=filterByBoolMask_6.in)  # "Punto 1 para iniciar la barra de la cara superior"
distancias_de_los_puntos_mas_2 = Geometry.DistanceTo(geometry=flatten_8, other=startPoint_5, lacing=Longest)  # "Distancias de los puntos mas altos (Cara 2) al punto inicial de la linea centroidal rotada 90°"
minimumItem_3 = List.MinimumItem(list=distancias_de_los_puntos_mas_2)
eq_5 = distancias_de_los_puntos_mas_2 == minimumItem_3
filterByBoolMask_7 = List.FilterByBoolMask(list=flatten_8, mask=eq_5)
punto_2_para_finalizar_la_barra = List.Flatten(list=filterByBoolMask_7.in)  # "Punto 2 para finalizar la barra de la cara superior"

Sup_ini = Output(punto_1_para_iniciar_la_barra_de)
Sup_fin = Output(punto_2_para_finalizar_la_barra)

# group: Puntos para dibujar las barras de acero en la cara superior y la cara inferior > Puntos mas bajos con respecto al plano xy global
# Descripción <Haga doble clic aquí para editar la descripción del grupo>
Z_3 = Point.Z(point=punto_de_las_barras_con)
minimumItem_4 = List.MinimumItem(list=Z_3)
eq_6 = minimumItem_4 == Z_3
filterByBoolMask_8 = List.FilterByBoolMask(list=punto_de_las_barras_con, mask=eq_6)
watch_7 = Watch(filterByBoolMask_8.in)
flatten_9 = List.Flatten(list=watch_7)
Z_4 = Point.Z(point=punto_de_las_barras_con_2)
minimumItem_5 = List.MinimumItem(list=Z_4)
eq_7 = minimumItem_5 == Z_4
filterByBoolMask_9 = List.FilterByBoolMask(list=punto_de_las_barras_con_2, mask=eq_7)
watch_8 = Watch(filterByBoolMask_9.in)
flatten_10 = List.Flatten(list=watch_8)

# group: Puntos para dibujar las barras de acero en la cara superior y la cara inferior > Obtiene los puntos para dibujar la linea de la barra de acero en la cara inferior
# Descripción <Haga doble clic aquí para editar la descripción del grupo>
distancias_de_los_puntos_mas_3 = Geometry.DistanceTo(geometry=flatten_9, other=startPoint_5, lacing=Longest)  # "Distancias de los puntos mas altos (Cara 1) al punto inicial de la linea centroidal rotada 90°"
minimumItem_6 = List.MinimumItem(list=distancias_de_los_puntos_mas_3)
eq_8 = distancias_de_los_puntos_mas_3 == minimumItem_6
filterByBoolMask_10 = List.FilterByBoolMask(list=flatten_9, mask=eq_8)
punto_1_para_iniciar_la_barra_de_2 = List.Flatten(list=filterByBoolMask_10.in)  # "Punto 1 para iniciar la barra de la cara inferior"
distancias_de_los_puntos_mas_4 = Geometry.DistanceTo(geometry=flatten_10, other=startPoint_5, lacing=Longest)  # "Distancias de los puntos mas altos (Cara 2) al punto inicial de la linea centroidal rotada 90°"
minimumItem_7 = List.MinimumItem(list=distancias_de_los_puntos_mas_4)
eq_9 = distancias_de_los_puntos_mas_4 == minimumItem_7
filterByBoolMask_11 = List.FilterByBoolMask(list=flatten_10, mask=eq_9)
punto_2_para_finalizar_la_barra_2 = List.Flatten(list=filterByBoolMask_11.in)  # "Punto 2 para finalizar la barra de la cara inferior"

Inf_ini = Output(punto_1_para_iniciar_la_barra_de_2)
Inf_fin = Output(punto_2_para_finalizar_la_barra_2)

# group: Vector de propagación de las barras
# Descripción <Haga doble clic aquí para editar la descripción del grupo>
vector_By_Line_8 = Custom[Vector_By_Line](Linea=linea_rotada_90)

Vector = Output(vector_By_Line_8)
code_block_22 = CodeBlock { 1; 0; }
getItemAtIndex_4 = List.GetItemAtIndex(list=flatten_7, index=code_block_22.out0)
getItemAtIndex_5 = List.GetItemAtIndex(list=flatten_7, index=code_block_22.out1)
distanceTo_2 = Geometry.DistanceTo(geometry=getItemAtIndex_4, other=getItemAtIndex_5)
Distancia = Output(distanceTo_2)
python_script = Python()  # CPython3; unwired: IN[0]; starter script, not edited (OUT = 0)
