# Dynamo custom node List_GetItemAtIndex.dyf (Dynamo 3.6.0.9395)
# category: 01_Nodos_CQING
# List.GetItemAtIndex

Lista = Input(Lista: var[]..[])
Ítem = Input(Ítem: var[]..[])
getItemAtIndex = Python(IN[0]=Lista, IN[1]=Ítem)  # "List.GetItemAtIndex"; CPython3
# ---------- getItemAtIndex.python (19 lines) ----------
data = IN[0] if len(IN) > 0 else None
idx   = IN[1] if len(IN) > 1 else None

def safe_get(lst, i):
    if not isinstance(lst, (list, tuple)):
        return []  # no es lista
    try:
        n = int(i)
    except Exception:
        return []
    # admite índices negativos como en Python
    if -len(lst) <= n < len(lst):
        return lst[n]
    return []

if isinstance(idx, (list, tuple)):
    OUT = [safe_get(data, i) for i in idx]
else:
    OUT = safe_get(data, idx)
# ----------------------------------------
OUT = Output(getItemAtIndex)
