# Dynamo custom node Orienta_Lineas.dyf (Dynamo 3.0.3.7597)
# category: Revit
# Orienta las lineas de modo que tengan el mismo sentido del vector de la viga seleccionada
# packages: Structural Design 2025.3.16

curve = Input(curve: Autodesk.DesignScript.Geometry.Curve)
startPoint = Curve.StartPoint(curve=curve)
endPoint = Curve.EndPoint(curve=curve)
list_create = List.Create(item0=startPoint, item1=endPoint)
flatten = List.Flatten(list=list_create)
curve_2 = Input(curve: Autodesk.DesignScript.Geometry.Curve)
startPoint_2 = Curve.StartPoint(curve=curve_2)
endPoint_2 = Curve.EndPoint(curve=curve_2)
list_create_2 = List.Create(item0=startPoint_2, item1=endPoint_2)
flatten_2 = List.Flatten(list=list_create_2)
list_create_3 = List.Create(item0=flatten, item1=flatten_2)
element = Input(element: Revit.Elements.Element)
getActualLocation = AnalyticalAutomation.RevitElements.Element.GetActualLocation(element=element)
startPoint_3 = Curve.StartPoint(curve=getActualLocation)
distanceTo = Geometry.DistanceTo(geometry=list_create_3, other=startPoint_3)
minimumItem = List.MinimumItem(list=distanceTo)
eq = distanceTo == minimumItem
filterByBoolMask = List.FilterByBoolMask(list=list_create_3, mask=eq)
flatten_3 = List.Flatten(list=filterByBoolMask.in)
byLine = StructuralDesign.Model.Geom.Vector.ByLine(line=getActualLocation)
length = Curve.Length(curve=curve)
translate = Geometry.Translate(geometry=flatten_3, direction=byLine, distance=length, lacing=Longest)
byStartPointEndPoint = Line.ByStartPointEndPoint(startPoint=flatten_3, endPoint=translate)
code_block = CodeBlock { 0; 1; }
linea_superior = List.GetItemAtIndex(list=byStartPointEndPoint, index=code_block.out0)
Línea_Superior = Output(linea_superior)
linea_inferior = List.GetItemAtIndex(list=byStartPointEndPoint, index=code_block.out1)
Línea_Inferior = Output(linea_inferior)
