# Dynamo custom node Radar_Muros.dyf (Dynamo 3.6.0.9395)
# category: 01_Nodos_CQING
# Obiene el perímetro de lineas de muros buscando secuencialmente

surface = Input(surface: Autodesk.DesignScript.Geometry.Surface)
Interior_Exterior = Input(Interior_Exterior: var[]..[])
Linea_Inicial = Input(Linea_Inicial: var[]..[])
Radio = Input(Radio: var[]..[])
Giro = Input(Giro: var[]..[])

# group: Perímetro exterior
# Descripción <Haga doble clic aquí para editar la descripción del grupo>
categories = Categories("OST_Walls")
all_elements_of_category = ElementsOfCategory(Category=categories)
code_block = CodeBlock { "Restricción de base"; }
getParameterValueByName = Element.GetParameterValueByName(element=all_elements_of_category, parameterName=code_block)
categories_2 = Categories("OST_Walls")
all_elements_of_category_2 = ElementsOfCategory(Category=categories_2)
faces = Element.Faces(element=all_elements_of_category_2)
code_block_2 = CodeBlock { 0.5; }
pointAtParameter = Surface.PointAtParameter(surface=faces, u=code_block_2, v=code_block_2)
X = Point.X(point=pointAtParameter)
pointAtParameter_2 = Surface.PointAtParameter(surface=surface, u=code_block_2, v=code_block_2)
X_2 = Point.X(point=pointAtParameter_2)
eq = X@@L1 == X_2
Y = Point.Y(point=pointAtParameter)
Y_2 = Point.Y(point=pointAtParameter_2)
eq_2 = Y@@L1 == Y_2
Z = Point.Z(point=pointAtParameter)
Z_2 = Point.Z(point=pointAtParameter_2)
eq_3 = Z@@L1 == Z_2
code_block_3 = CodeBlock(A=eq, B=eq_2, C=eq_3) { A&&B&&C; }
flatten = List.Flatten(list=code_block_3@L3)
anyTrue = List.AnyTrue(list=flatten@@L2)
filterByBoolMask = List.FilterByBoolMask(list=all_elements_of_category_2, mask=anyTrue)
firstItem = List.FirstItem(list=filterByBoolMask.in)
code_block_4 = CodeBlock { "Restricción de base"; }
getParameterValueByName_2 = Element.GetParameterValueByName(element=firstItem, parameterName=code_block_4)
equals = List.Equals(object=getParameterValueByName@L1, otherObject=getParameterValueByName_2)
filterByBoolMask_2 = List.FilterByBoolMask(list=all_elements_of_category, mask=equals)
faces_2 = Element.Faces(element=filterByBoolMask_2.in)
code_block_5 = CodeBlock { 0.5; }
normalAtParameter = Surface.NormalAtParameter(surface=faces_2, u=code_block_5, v=code_block_5)
ZAxis = Vector.ZAxis()
isParallel = Vector.IsParallel(vector=normalAtParameter, otherVector=ZAxis)
filterByBoolMask_3 = List.FilterByBoolMask(list=faces_2, mask=isParallel)
pointAtParameter_3 = Surface.PointAtParameter(surface=filterByBoolMask_3.in, u=code_block_5, v=code_block_5)
Z_3 = Point.Z(point=pointAtParameter_3)
maximumItem = List.MaximumItem(list=Z_3)
code_block_6 = CodeBlock(A=Z_3, B=maximumItem) { A==B; }
filterByBoolMask_4 = List.FilterByBoolMask(list=filterByBoolMask_3.in, mask=code_block_6)
flatten_2 = List.Flatten(list=filterByBoolMask_4.in)
perimeterCurves = Surface.PerimeterCurves(surface=flatten_2)
byOriginNormal = Plane.ByOriginNormal()
pullOntoPlane = Curve.PullOntoPlane(curve=perimeterCurves, plane=byOriginNormal)
categories_3 = Categories("OST_StructuralColumns")
all_elements_of_category_3 = ElementsOfCategory(Category=categories_3)
code_block_7 = CodeBlock { "Nivel"; }
getParameterValueByName_3 = Element.GetParameterValueByName(element=all_elements_of_category_3, parameterName=code_block_7)
equals_2 = List.Equals(object=getParameterValueByName_3@L1, otherObject=getParameterValueByName_2)
filterByBoolMask_5 = List.FilterByBoolMask(list=all_elements_of_category_3, mask=equals_2)
faces_3 = Element.Faces(element=filterByBoolMask_5.in)
normalAtParameter_2 = Surface.NormalAtParameter(surface=faces_3, u=code_block_5, v=code_block_5)
ZAxis_2 = Vector.ZAxis()
isParallel_2 = Vector.IsParallel(vector=normalAtParameter_2, otherVector=ZAxis_2)
filterByBoolMask_6 = List.FilterByBoolMask(list=faces_3, mask=isParallel_2)
pointAtParameter_4 = Surface.PointAtParameter(surface=filterByBoolMask_6.in, u=code_block_5, v=code_block_5)
Z_4 = Point.Z(point=pointAtParameter_4)
maximumItem_2 = List.MaximumItem(list=Z_4)
code_block_8 = CodeBlock(A=Z_4, B=maximumItem_2) { A==B; }
filterByBoolMask_7 = List.FilterByBoolMask(list=filterByBoolMask_6.in, mask=code_block_8)
flatten_3 = List.Flatten(list=filterByBoolMask_7.in)
perimeterCurves_2 = Surface.PerimeterCurves(surface=flatten_3)
pullOntoPlane_2 = Curve.PullOntoPlane(curve=perimeterCurves_2@L1, plane=byOriginNormal)
flatten_4 = List.Flatten(list=filterByBoolMask_4.out)
perimeterCurves_3 = Surface.PerimeterCurves(surface=flatten_4)
pullOntoPlane_3 = Curve.PullOntoPlane(curve=perimeterCurves_3, plane=byOriginNormal)
list_create = List.Create(item0=pullOntoPlane, item1=pullOntoPlane_2, item2=pullOntoPlane_3)
in_0 = List.Flatten(list=list_create)
python_script = Python(IN[0]=in_0)  # CPython3
# ---------- python_script.python (151 lines) ----------
# Dynamo CPython3
import clr
clr.AddReference('ProtoGeometry')
from Autodesk.DesignScript.Geometry import Curve, Line, Arc, Point, Vector

# ---------------- utilidades ----------------
def flatten(x):
    if not isinstance(x, list): return [x]
    out, stack = [], list(x)
    while stack:
        v = stack.pop(0)
        if isinstance(v, list): stack = list(v) + stack
        else: out.append(v)
    return out

def almost(a, b, tol): return abs(a - b) <= tol

def unique_points(pts, tol):
    out = []
    for p in pts:
        keep = True
        for q in out:
            if p.DistanceTo(q) <= tol:
                keep = False; break
        if keep: out.append(p)
    return out

def add_param(unique_list, t, tol):
    for u in unique_list:
        if almost(u, t, tol): return
    unique_list.append(t)

def round_pt(p, q):
    # discretiza coordenadas usando paso q
    return (round(p.X / q), round(p.Y / q), round(p.Z / q))

def line_key(ln, q):
    a = ln.StartPoint; b = ln.EndPoint
    pa, pb = round_pt(a, q), round_pt(b, q)
    # orden independiente de dirección
    return ('L',) + tuple(sorted([pa, pb]))

def arc_key(ac, q):
    # clave robusta usando start, end (ordenadas) y un punto medio
    s, e = ac.StartPoint, ac.EndPoint
    m = ac.PointAtParameter(0.5)
    ps, pe = round_pt(s, q), round_pt(e, q)
    pair = tuple(sorted([ps, pe]))
    pm = round_pt(m, q)
    return ('A',) + pair + pm

def dedup_curves(curves, tol):
    # q: paso de cuantización para claves (≥ 100*tol)
    q = max(tol * 100.0, 1e-6)
    seen = set()
    out = []
    for c in curves:
        try:
            if isinstance(c, Line):
                k = line_key(c, q)
            elif isinstance(c, Arc):
                k = arc_key(c, q)
            else:
                # para cualquier otro Curve (por si se cuela), usa centroide + largo
                bb = c.BoundingBox
                centroid = Point.ByCoordinates((bb.MaxPoint.X+bb.MinPoint.X)/2.0,
                                               (bb.MaxPoint.Y+bb.MinPoint.Y)/2.0,
                                               (bb.MaxPoint.Z+bb.MinPoint.Z)/2.0)
                k = ('C', round_pt(centroid, q), round(c.Length / (q if q>0 else 1e-6)))
        except:
            continue
        if k in seen: 
            continue
        seen.add(k)
        out.append(c)
    return out

# ---------------- entrada ----------------
raw = flatten(IN[0]) if isinstance(IN[0], list) else [IN[0]]
curves = [c for c in raw if isinstance(c, Curve)]

if not curves:
    OUT = [[], []]
else:
    # tolerancias relativas
    avg_len = sum(c.Length for c in curves) / float(len(curves))
    TOL = max(1e-6, avg_len * 1e-8)
    MIN_SEG = max(1e-6, avg_len * 1e-7)

    # parámetros de corte por curva
    params = [[0.0, 1.0] for _ in curves]
    inter_nodes = []

    n = len(curves)
    for i in range(n):
        ci = curves[i]
        for j in range(i+1, n):
            cj = curves[j]
            inter = ci.Intersect(cj)
            if not inter: 
                continue

            for g in inter:
                if isinstance(g, Point):
                    inter_nodes.append(g)
                    # intenta mapear a parámetros
                    try:
                        add_param(params[i], ci.ParameterAtPoint(g), TOL)
                        add_param(params[j], cj.ParameterAtPoint(g), TOL)
                    except:
                        pass

                elif isinstance(g, Curve):
                    # tramo solapado -> corta en extremos
                    try:
                        p0, p1 = g.StartPoint, g.EndPoint
                        inter_nodes.extend([p0, p1])
                        add_param(params[i], ci.ParameterAtPoint(p0), TOL)
                        add_param(params[i], ci.ParameterAtPoint(p1), TOL)
                        add_param(params[j], cj.ParameterAtPoint(p0), TOL)
                        add_param(params[j], cj.ParameterAtPoint(p1), TOL)
                    except:
                        pass

    # dividir preservando tipo
    pieces_all = []
    for k, c in enumerate(curves):
        # limpia y ordena parámetros internos
        ps_sorted = sorted(params[k])
        inner = []
        for t in ps_sorted:
            if t > 0.0 + TOL and t < 1.0 - TOL:
                add_param(inner, t, TOL)

        if not inner:
            pieces = [c]
        else:
            pieces = c.SplitByParameter(inner)

        for seg in pieces:
            try:
                if seg.Length > MIN_SEG:
                    pieces_all.append(seg)
            except:
                pass

    # eliminar duplicados
    nodes_unique = unique_points(inter_nodes, TOL)
    curves_unique = dedup_curves(pieces_all, TOL)

    OUT = [curves_unique, nodes_unique]
# ----------------------------------------
code_block_9 = CodeBlock(A=python_script) { A[0]; }
perimeterCurves_4 = Surface.PerimeterCurves(surface=surface)
code_block_10 = CodeBlock(A=perimeterCurves_4) { A[0]; }
startPoint = Curve.StartPoint(curve=code_block_10)
endPoint = Curve.EndPoint(curve=code_block_10)
punt_medio = Python(IN[0]=startPoint, IN[1]=endPoint)  # CPython3
# ---------- punt_medio.python (24 lines) ----------
import clr
clr.AddReference('ProtoGeometry')
from Autodesk.DesignScript.Geometry import Point

# Entradas: listas de puntos
puntosA = IN[0]
puntosB = IN[1]

# Asegurar que sean listas
if not isinstance(puntosA, list): puntosA = [puntosA]
if not isinstance(puntosB, list): puntosB = [puntosB]

# Calcular punto medio entre cada par correspondiente
p_medios = []
for i in range(min(len(puntosA), len(puntosB))):
    p1 = puntosA[i]
    p2 = puntosB[i]
    xm = (p1.X + p2.X) / 2.0
    ym = (p1.Y + p2.Y) / 2.0
    zm = (p1.Z + p2.Z) / 2.0
    p_medios.append(Point.ByCoordinates(xm, ym, zm))

# Salida
OUT = p_medios
# ----------------------------------------
Z_5 = Point.Z(point=punt_medio)
maximumItem_3 = List.MaximumItem(list=Z_5)
code_block_11 = CodeBlock(A=Z_5, B=maximumItem_3) { A==B; }
filterByBoolMask_8 = List.FilterByBoolMask(list=code_block_10, mask=code_block_11)
pullOntoPlane_4 = Curve.PullOntoPlane(curve=filterByBoolMask_8.in@L1, plane=byOriginNormal)
firstItem_2 = List.FirstItem(list=pullOntoPlane_4)
list_create_2 = List.Create(item0=code_block_9, item1=firstItem_2)
pica = Python(IN[0]=list_create_2)  # CPython3; same code as python_script
code_block_12 = CodeBlock(A=pica) { A[0]; }
python_script_2 = Python(IN[0]=code_block_12, IN[1]=firstItem_2)  # CPython3
# ---------- python_script_2.python (43 lines) ----------
import clr
clr.AddReference('ProtoGeometry')
from Autodesk.DesignScript.Geometry import *

def vector_unitario(linea):
    """Devuelve el vector unitario de la línea."""
    v = Vector.ByTwoPoints(linea.StartPoint, linea.EndPoint)
    return v.Normalized()

def son_colineales(linea1, linea2, tolerancia=1e-6):
    """Verifica si dos líneas o curvas son colineales."""
    # Obtener vectores dirección
    v1 = vector_unitario(linea1)
    v2 = vector_unitario(linea2)

    # Comparar si son paralelas (mismo sentido o contrario)
    angulo = v1.AngleWithVector(v2)
    paralelas = abs(angulo) < tolerancia or abs(angulo - 180) < tolerancia

    if not paralelas:
        return False

    # Verificar que estén sobre la misma recta (no desplazadas)
    p_ref = linea2.StartPoint
    p0 = linea1.StartPoint
    v_linea = v1
    v_p0p = Vector.ByTwoPoints(p0, p_ref)

    # Si el vector que une un punto de una línea con la otra es perpendicular a la dirección → no son colineales
    prod_cruz = v_linea.Cross(v_p0p)
    dist = prod_cruz.Length

    return dist < tolerancia

# --- Entradas desde Dynamo ---
lineas = IN[0]
ref_linea = IN[1]

# Si IN[1] viene como lista
if isinstance(ref_linea, list):
    ref_linea = ref_linea[0]

OUT = [son_colineales(l, ref_linea) for l in lineas]
# ----------------------------------------
filterByBoolMask_9 = List.FilterByBoolMask(list=code_block_12, mask=python_script_2)
identity = Object.Identity(object=filterByBoolMask_9.in)
startPoint_2 = Curve.StartPoint(curve=identity)
endPoint_2 = Curve.EndPoint(curve=identity)
punt_medio_2 = Python(IN[0]=startPoint_2, IN[1]=endPoint_2)  # CPython3; same code as punt_medio
startPoint_3 = Curve.StartPoint(curve=firstItem_2)
endPoint_3 = Curve.EndPoint(curve=firstItem_2)
punt_medio_3 = Python(IN[0]=startPoint_3, IN[1]=endPoint_3)  # CPython3; same code as punt_medio
firstItem_3 = List.FirstItem(list=punt_medio_3)
distanceTo = Geometry.DistanceTo(geometry=punt_medio_2@L1, other=firstItem_3)
minimumItem = List.MinimumItem(list=distanceTo)
code_block_13 = CodeBlock(A=distanceTo, B=minimumItem) { A==B; }
filterByBoolMask_10 = List.FilterByBoolMask(list=identity, mask=code_block_13)

if_ = RefactoredIf(test=Interior_Exterior, true=filterByBoolMask_10.in, false=Linea_Inicial)

# group (continued): Perímetro exterior
firstItem_4 = List.FirstItem(list=if_)
radar = Python(IN[0]=code_block_9, IN[1]=firstItem_4, IN[2]=Radio, IN[3]=byOriginNormal, IN[4]=Giro)  # CPython3
# ---------- radar.python (179 lines) ----------
# Dynamo (CPython3) — Secuencia de arcos hasta repetir línea
# IN[0]: lineas   -> Lista de Line (todas coplanares, en el mismo plano IN[3])
# IN[1]: lineaRef -> Line (también está en IN[0])
# IN[2]: radio    -> float
# IN[3]: plano    -> Plane (se usa su XAxis/YAxis y normal; el círculo se ancla al centro correspondiente en cada paso)
# IN[4]: sentido  -> int (1 = antihorario / CCW, -1 = horario / CW)
#
# OUT: [linea_inicial, lista_arcos, lista_lineas_intersectadas, lista_extremos_priorizados]
#  - lista_arcos[i]               = arco i (Arc) en el sentido IN[4]
#  - lista_lineas_intersectadas[i]= línea sobre la que termina el arco i (Line)
#  - lista_extremos_priorizados[i]= extremo de esa línea, elegido:
#       * inicialmente: el extremo MÁS LEJANO al punto final del arco i
#       * PERO priorizando que NO quede "dentro" del arco i (distancia al centro del arco i >= radio - tol);
#         si el más lejano queda dentro, se usa el otro extremo.
#
# La secuencia se DETIENE cuando un arco finaliza sobre una línea que ya apareció previamente
# (incluida la línea inicial IN[1]).

import clr, math
clr.AddReference('ProtoGeometry')
from Autodesk.DesignScript.Geometry import *

lineas   = IN[0]
lineaRef = IN[1]
radio    = float(IN[2])
plano    = IN[3]
sentido  = int(IN[4])

TOL = 1e-6
MAX_STEPS = max(1, len(lineas) * 2)  # límite de seguridad

# ---------------------- Utilidades ---------------------- #
def mismas_extremidades(l1, l2, tol=TOL):
    a1, a2 = l1.StartPoint, l1.EndPoint
    b1, b2 = l2.StartPoint, l2.EndPoint
    return ((a1.DistanceTo(b1) <= tol and a2.DistanceTo(b2) <= tol) or
            (a1.DistanceTo(b2) <= tol and a2.DistanceTo(b1) <= tol))

def hallar_linea_en_lista(lst, ref):
    try:
        return lst[lst.index(ref)]  # misma instancia
    except:
        for l in lst:               # coincidencia geométrica
            if mismas_extremidades(l, ref):
                return l
    return None

def inters_circ_line(circ, ln):
    pts = circ.Intersect(ln)
    return [p for p in (pts or []) if isinstance(p, Point)]

def angulo_en_plano(center, pt, xaxis, yaxis):
    v = Vector.ByTwoPoints(center, pt)
    x = v.Dot(xaxis); y = v.Dot(yaxis)
    a = math.atan2(y, x)  # [-pi,pi]
    return a if a >= 0 else (a + 2*math.pi)

def delta_angular(a_from, a_to, dir_sign):
    # Delta positivo siguiendo el sentido: 1=CCW, -1=CW
    return ((a_to - a_from) % (2*math.pi)) if dir_sign >= 0 else ((a_from - a_to) % (2*math.pi))

def punto_en_circulo(center, xaxis, yaxis, r, ang):
    vx = xaxis.Normalized().Scale(r * math.cos(ang))
    vy = yaxis.Normalized().Scale(r * math.sin(ang))
    return center.Add(vx.Add(vy))

def extremos_priorizado_fuera_circulo(ln, end_pt, centro_arco, r, tol=TOL):
    """Devuelve (extremo_priorizado, extremo_restante) priorizando que NO esté dentro del círculo del arco."""
    pA, pB = ln.StartPoint, ln.EndPoint
    # Primero el más lejano respecto a end_pt
    far, other = (pA, pB) if pA.DistanceTo(end_pt) >= pB.DistanceTo(end_pt) else (pB, pA)
    # Prioriza que quede FUERA del círculo (distancia al centro >= r - tol)
    if far.DistanceTo(centro_arco) >= (r - tol):
        return far, other
    else:
        # si el "far" cae dentro, usa el otro
        return other, far

# ---------------------- Preparación ---------------------- #
linea_inicial = hallar_linea_en_lista(lineas, lineaRef)
if linea_inicial is None:
    OUT = [None, [], [], []]
else:
    # Visitados por identidad de objeto (misma referencia en IN[0])
    visitados = set([id(linea_inicial)])

    arcos   = []
    lns_end = []
    extremos = []

    # Paso 1: centro en StartPoint de la línea inicial
    centro = linea_inicial.StartPoint
    xax, yax = plano.XAxis, plano.YAxis

    # Círculo 1
    pln_c = Plane.ByOriginXAxisYAxis(centro, xax, yax)
    circ  = Circle.ByPlaneRadius(pln_c, radio)

    # Punto de inicio 1: intersección con linea_inicial, tomando el que avanza Start->End de la línea
    pts0 = inters_circ_line(circ, linea_inicial)
    if not pts0:
        OUT = [linea_inicial, [], [], []]
    else:
        vdir = Vector.ByTwoPoints(linea_inicial.StartPoint, linea_inicial.EndPoint).Normalized()
        start = None; best = -1e9
        for p in pts0:
            val = vdir.Dot(Vector.ByTwoPoints(centro, p))
            if val > best + TOL:
                best, start = val, p
        if start is None:
            OUT = [linea_inicial, [], [], []]
        else:
            prev_end = None  # para pasos siguientes

            # ---------------------- Bucle principal ---------------------- #
            steps = 0
            while steps < MAX_STEPS:
                # Ángulo de partida para este arco:
                # - En paso 0 (primer arco), lo tomamos del propio "start"
                # - En pasos siguientes, partimos mirando hacia el end del arco previo
                if steps == 0:
                    a0 = angulo_en_plano(centro, start, xax, yax)
                    start_pt = start
                else:
                    a0 = angulo_en_plano(centro, prev_end, xax, yax)
                    start_pt = punto_en_circulo(centro, xax, yax, radio, a0)

                # Buscar la PRIMERA intersección (mínimo delta angular > 0) con cualquier línea
                mejor_delta = None
                end_pt = None
                linea_hit = None

                for l in lineas:
                    pts = inters_circ_line(circ, l)
                    if not pts:
                        continue
                    for p in pts:
                        if p.DistanceTo(start_pt) <= TOL:
                            continue  # evita arrancar y terminar en el mismo punto
                        ai = angulo_en_plano(centro, p, xax, yax)
                        d = delta_angular(a0, ai, sentido)
                        if d <= TOL:
                            continue
                        if (mejor_delta is None) or (d < mejor_delta):
                            mejor_delta, end_pt, linea_hit = d, p, l

                if end_pt is None or linea_hit is None:
                    break  # no hay más intersecciones válidas en este sentido

                # Construir el arco del paso
                amid = a0 + sentido * (mejor_delta / 2.0)
                mid  = punto_en_circulo(centro, xax, yax, radio, amid)
                arco = Arc.ByThreePoints(start_pt, mid, end_pt)

                # Elegir extremo priorizado de la línea donde terminó el arco
                extremo_ok, extremo_rest = extremos_priorizado_fuera_circulo(
                    linea_hit, end_pt, centro, radio, TOL
                )

                # Guardar resultados del paso
                arcos.append(arco)
                lns_end.append(linea_hit)
                extremos.append(extremo_ok)

                # Condición de parada: si la línea_hit ya estaba en visitados, detenemos aquí
                ya_vista = id(linea_hit) in visitados
                visitados.add(id(linea_hit))
                if ya_vista:
                    break

                # Preparar siguiente paso:
                prev_end = end_pt
                centro   = extremo_ok          # nuevo centro
                pln_c    = Plane.ByOriginXAxisYAxis(centro, xax, yax)
                circ     = Circle.ByPlaneRadius(pln_c, radio)

                steps += 1

            OUT = [linea_inicial, arcos, lns_end, extremos]
# ----------------------------------------

Radar = Output(radar)
code_block_14 = CodeBlock(A=radar) { A[0]; A[1]; }
Curvas_de_todo = Output(pica)
watch = Watch(radar)
