# Dynamo custom node Rebar_Bar_Type.dyf (Dynamo 3.6.0.9395)
# category: 01_Nodos_CQING
# Tipos de baras disponibles en el modelo de Revit

tipos_de_barras_de_armaduras = Python()  # "Tipos de barras de armaduras cargados en Revit- Nombres y elementos"; CPython3
# ---------- tipos_de_barras_de_armaduras.python (25 lines) ----------
import clr

clr.AddReference('RevitServices')
from RevitServices.Persistence import DocumentManager
doc = DocumentManager.Instance.CurrentDBDocument

clr.AddReference('RevitAPI')
from Autodesk.Revit.DB import FilteredElementCollector, ElementType, BuiltInParameter

# Obtener todos los tipos de elemento
types = FilteredElementCollector(doc).OfClass(ElementType).ToElements()

# Filtrar solo tipos de barra de refuerzo usando nombre de clase
bar_types = [t for t in types if t.GetType().Name == "RebarBarType"]

# Leer nombre de tipo a través de parámetro 'SYMBOL_NAME_PARAM'
names = []
for bt in bar_types:
    try:
        name = bt.get_Parameter(BuiltInParameter.SYMBOL_NAME_PARAM).AsString()
    except:
        name = "Sin nombre"
    names.append(name)

OUT = (names, bar_types)
# ----------------------------------------
nombre_de_tipos_de_barras = List.FirstItem(list=tipos_de_barras_de_armaduras)  # "Nombre de Tipos de barras disponibles"
Tipos_de_barras_disponibles = Output(nombre_de_tipos_de_barras)
tipos_de_barras_elementos = List.LastItem(list=tipos_de_barras_de_armaduras)
Tipo_de_barra = Input(Tipo_de_barra: var[]..[])  # Nombre de entrada por defecto; cambie el nombre.
indexOf = List.IndexOf(list=nombre_de_tipos_de_barras, element=Tipo_de_barra)
elimina_todos_los_null_de_una = Python(IN[0]=indexOf)  # "Elimina todos los null de una lista"; CPython3
# ---------- elimina_todos_los_null_de_una.python (9 lines) ----------
def limpiar_nulls(input_data):
    # Si es una lista, filtra los nulls (None en Python)
    if isinstance(input_data, list):
        return [x for x in input_data if x is not None]
    else:
        # Si no es lista, revisa si es null, si no lo es lo devuelve
        return None if input_data is None else input_data

OUT = limpiar_nulls(IN[0])
# ----------------------------------------
firstItem = List.FirstItem(list=elimina_todos_los_null_de_una)
getItemAtIndex = List.GetItemAtIndex(list=tipos_de_barras_elementos, index=firstItem)
Rebar = Output(getItemAtIndex)
watch = Watch(tipos_de_barras_de_armaduras)
