# Dynamo custom node Rebar_By_Curves.dyf (Dynamo 3.6.0.9395)
# category: 01_Nodos_CQING

Estructura_De_Lineas = Input(Estructura_De_Lineas: var[]..[])  # 0 para lineas individuales, 1 para lineas unidas.
code_block = CodeBlock(a=Estructura_De_Lineas) { a==0; }
empty = List.Empty()
Curvas = Input(Curvas: var[]..[])  # Nombre de entrada por defecto; cambie el nombre.
aplana_lista_y_transforma_curvas = Python(IN[0]=Curvas)  # "Aplana lista y transforma curvas de Dynamo a Revit"; CPython3
# ---------- aplana_lista_y_transforma_curvas.python (48 lines) ----------
import clr
#//
clr.AddReference('RevitAPI')
#//
from Autodesk.Revit.DB import *
#//
from Autodesk.Revit.DB.Structure import *
#//
clr.AddReference('RevitServices')
#//
from RevitServices.Persistence import DocumentManager
from RevitServices.Transactions import TransactionManager
#//
clr.AddReference('RevitNodes')
import Revit
clr.ImportExtensions(Revit.GeometryConversion)
#//
import System
from System.Collections.Generic import List
#//
doc = DocumentManager.Instance.CurrentDBDocument
#//


#//
def flatten_and_get_revit_curves(curves):
    """Profundiza cualquier lista, ignora None, convierte PolyCurve y curvas simples."""
    result = []
    if curves is None:
        return result
    if isinstance(curves, list):
        for c in curves:
            result.extend(flatten_and_get_revit_curves(c))
    else:
        try:
            # PolyCurve
            for sc in curves.Curves:
                try:
                    result.append(sc.ToRevitType())
                except:
                    continue
        except:
            try:
                result.append(curves.ToRevitType())
            except:
                pass
    return result
OUT = flatten_and_get_revit_curves(IN[0])
# ----------------------------------------
if_ = RefactoredIf(test=code_block, true=empty, false=aplana_lista_y_transforma_curvas)
Rebar_Bar_Type = Input(Rebar_Bar_Type: var[]..[])  # Nombre de entrada por defecto; cambie el nombre.
code_block_2 = CodeBlock { "Standard"; "Left"; "Right"; }
conversión_de_strings_a_enums = Python(IN[0]=code_block_2.out0, IN[1]=code_block_2.out1, IN[2]=code_block_2.out2)  # "Conversión de strings a enums (valores especiales de Revit) RebarStyle y HookOrientation"; CPython3
# ---------- conversión_de_strings_a_enums.python (39 lines) ----------
import clr
#//
clr.AddReference('RevitAPI')
#//
from Autodesk.Revit.DB import *
#//
from Autodesk.Revit.DB.Structure import *
#//
clr.AddReference('RevitServices')
#//
from RevitServices.Persistence import DocumentManager
from RevitServices.Transactions import TransactionManager
#//
clr.AddReference('RevitNodes')
import Revit
clr.ImportExtensions(Revit.GeometryConversion)
#//
import System
from System.Collections.Generic import List
#//
doc = DocumentManager.Instance.CurrentDBDocument
#//
#curvas_por_rebar = IN[0]
#hosts = UnwrapElement(IN[1])
rebar_style = IN[0]
#rebar_bar_type = UnwrapElement(IN[3])
start_hook_orientation = IN[1]
end_hook_orientation = IN[2]
#start_hook_type = UnwrapElement(IN[6]) if IN[6] else None
#end_hook_type = UnwrapElement(IN[7]) if IN[7] else None
#vectores = IN[8]


#//
bar_style = System.Enum.Parse(RebarStyle, rebar_style)
start_hook_orientation_enum = System.Enum.Parse(RebarHookOrientation, start_hook_orientation)
end_hook_orientation_enum = System.Enum.Parse(RebarHookOrientation, end_hook_orientation)

OUT = [bar_style,start_hook_orientation_enum,end_hook_orientation_enum]
# ----------------------------------------
firstItem = List.FirstItem(list=conversión_de_strings_a_enums)
Start_Hook_Type = Input(Start_Hook_Type: var[]..[])  # Nombre de entrada por defecto; cambie el nombre.
End_Hook_Type = Input(End_Hook_Type: var[]..[])  # Nombre de entrada por defecto; cambie el nombre.
Start_Hook_orientation = Input(Start_Hook_orientation: var[]..[])  # Nombre de entrada por defecto; cambie el nombre.
code_block_3 = CodeBlock(a=Start_Hook_orientation) { a=="Left"; }
code_block_4 = CodeBlock { 1; }
getItemAtIndex = List.GetItemAtIndex(list=conversión_de_strings_a_enums, index=code_block_4)
lastItem = List.LastItem(list=conversión_de_strings_a_enums)
if_2 = RefactoredIf(test=code_block_3, true=getItemAtIndex, false=lastItem)
End_Hook_orientation = Input(End_Hook_orientation: var[]..[])  # Nombre de entrada por defecto; cambie el nombre.
code_block_5 = CodeBlock(a=End_Hook_orientation) { a=="Left"; }
if_3 = RefactoredIf(test=code_block_5, true=getItemAtIndex, false=lastItem)
Host_Element = Input(Host_Element: var[]..[])  # Nombre de entrada por defecto; cambie el nombre.
count = List.Count(list=Curvas)
ofRepeatedItem = List.OfRepeatedItem(item=Host_Element, amount=count)
vector = Input(vector: var[]..[])  # Nombre de entrada por defecto; cambie el nombre.
ofRepeatedItem_2 = List.OfRepeatedItem(item=vector, amount=count)
script_básico_para_cerar_una = Python(IN[0]=if_, IN[1]=Rebar_Bar_Type, IN[2]=firstItem, IN[3]=Start_Hook_Type, IN[4]=End_Hook_Type, IN[5]=if_2, IN[6]=if_3, IN[7]=ofRepeatedItem, IN[8]=ofRepeatedItem_2)  # "Script básico para cerar una barra de armadura con varias lineas unidas"; CPython3
# ---------- script_básico_para_cerar_una.python (114 lines) ----------
import clr
clr.AddReference('RevitAPI')
from Autodesk.Revit.DB import *
from Autodesk.Revit.DB.Structure import *

clr.AddReference('RevitServices')
from RevitServices.Persistence import DocumentManager
from RevitServices.Transactions import TransactionManager

clr.AddReference('RevitNodes')
import Revit
clr.ImportExtensions(Revit.GeometryConversion)

doc = DocumentManager.Instance.CurrentDBDocument

def ensure_list(x):
    if isinstance(x, list):
        return x
    elif x is None:
        return []
    else:
        return [x]

# Mapas de enums válidos
bar_style_map = {
    0: RebarStyle.Standard,
    1: RebarStyle.StirrupTie
}
hook_orientation_map = {
    0: RebarHookOrientation.Left,
    1: RebarHookOrientation.Right
}

# --- Entradas desde Dynamo ---
curvas_in = IN[0]
rebar_bar_type = UnwrapElement(IN[1])
bar_style = bar_style_map.get(IN[2], RebarStyle.Standard)
start_hook_type = UnwrapElement(IN[3]) if IN[3] else None
end_hook_type = UnwrapElement(IN[4]) if IN[4] else None
start_hook_orientation_enum = hook_orientation_map.get(IN[5], RebarHookOrientation.Left)
end_hook_orientation_enum = hook_orientation_map.get(IN[6], RebarHookOrientation.Left)
host_in = IN[7]
vector_in = IN[8]

hosts = ensure_list(UnwrapElement(host_in))
vectores = ensure_list(vector_in)
vectores = [v.ToRevitType() for v in vectores if v is not None]

rebars = []

TransactionManager.Instance.EnsureInTransaction(doc)

# --- Caso 1: lista de listas (varias barras independientes)
if isinstance(curvas_in, list) and len(curvas_in) > 0 and isinstance(curvas_in[0], list):
    for i, subcurvas in enumerate(curvas_in):
        h = hosts[i] if len(hosts) > 1 else hosts[0]
        v = vectores[i] if len(vectores) > 1 else vectores[0]
        rebar = Rebar.CreateFromCurves(
            doc,
            bar_style,
            rebar_bar_type,
            start_hook_type,
            end_hook_type,
            h,
            v,
            subcurvas,
            start_hook_orientation_enum,
            end_hook_orientation_enum,
            True,
            True
        )
        rebars.append(rebar)
# --- Caso 2: lista de curvas (una sola barra con varias líneas unidas)
elif isinstance(curvas_in, list) and len(curvas_in) > 0:
    h = hosts[0]
    v = vectores[0]
    rebar = Rebar.CreateFromCurves(
        doc,
        bar_style,
        rebar_bar_type,
        start_hook_type,
        end_hook_type,
        h,
        v,
        curvas_in,
        start_hook_orientation_enum,
        end_hook_orientation_enum,
        True,
        True
    )
    rebars.append(rebar)
# --- Caso 3: solo una curva (crear una barra con una línea)
else:
    h = hosts[0]
    v = vectores[0]
    rebar = Rebar.CreateFromCurves(
        doc,
        bar_style,
        rebar_bar_type,
        start_hook_type,
        end_hook_type,
        h,
        v,
        [curvas_in],
        start_hook_orientation_enum,
        end_hook_orientation_enum,
        True,
        True
    )
    rebars.append(rebar)

TransactionManager.Instance.TransactionTaskDone()

OUT = rebars
# ----------------------------------------
empty_2 = List.Empty()
if_4 = RefactoredIf(test=code_block, true=aplana_lista_y_transforma_curvas, false=empty_2)
script_básico_para_cerar_una_2 = Python(IN[0]=if_4, IN[1]=Rebar_Bar_Type, IN[2]=firstItem, IN[3]=Start_Hook_Type, IN[4]=End_Hook_Type, IN[5]=if_2, IN[6]=if_3, IN[7]=ofRepeatedItem, IN[8]=ofRepeatedItem_2)  # "Script básico para cerar una barra de armadura con una sola linea"; CPython3
# ---------- script_básico_para_cerar_una_2.python (63 lines) ----------
import clr
clr.AddReference('RevitAPI')
from Autodesk.Revit.DB import *
from Autodesk.Revit.DB.Structure import *

clr.AddReference('RevitServices')
from RevitServices.Persistence import DocumentManager
from RevitServices.Transactions import TransactionManager

clr.AddReference('RevitNodes')
import Revit
clr.ImportExtensions(Revit.GeometryConversion)

import System

doc = DocumentManager.Instance.CurrentDBDocument

def ensure_list(x):
    if isinstance(x, list):
        return x
    elif x is None:
        return []
    else:
        return [x]

# -- Entradas --
curvas_por_rebar = ensure_list(IN[0])
rebar_bar_type = UnwrapElement(IN[1])
bar_style = IN[2]
start_hook_type = UnwrapElement(IN[3]) if IN[3] else None
end_hook_type = UnwrapElement(IN[4]) if IN[4] else None
start_hook_orientation_enum = IN[5]
end_hook_orientation_enum = IN[6]
hosts = ensure_list(UnwrapElement(IN[7]))
vectores = ensure_list(IN[8])

# Convertir vectores a XYZ solo si no son None
vectores = [v.ToRevitType() for v in vectores if v is not None]

rebars = []

TransactionManager.Instance.EnsureInTransaction(doc)

for curva, host, vector in zip(curvas_por_rebar, hosts, vectores):
    rebar = Rebar.CreateFromCurves(
        doc,
        bar_style,
        rebar_bar_type,
        start_hook_type,
        end_hook_type,
        host,
        vector,
        [curva],  # cada curva debe ir en lista
        start_hook_orientation_enum,
        end_hook_orientation_enum,
        True,
        True
    )
    rebars.append(rebar)

TransactionManager.Instance.TransactionTaskDone()

OUT = rebars
# ----------------------------------------
list_create = List.Create(item0=script_básico_para_cerar_una, item1=script_básico_para_cerar_una_2)
elimina_todos_los_null_de_una = Python(IN[0]=list_create)  # "Elimina todos los null de una lista"; CPython3
# ---------- elimina_todos_los_null_de_una.python (9 lines) ----------
def limpiar_nulls(input_data):
    # Si es una lista, filtra los nulls (None en Python)
    if isinstance(input_data, list):
        return [x for x in input_data if x is not None]
    else:
        # Si no es lista, revisa si es null, si no lo es lo devuelve
        return None if input_data is None else input_data

OUT = limpiar_nulls(IN[0])
# ----------------------------------------
flatten = List.Flatten(list=elimina_todos_los_null_de_una)
Rebar = Output(flatten)
watch = Watch(conversión_de_strings_a_enums)
script_básico_para_cerar_una_3 = Python(IN[0]=if_, IN[1]=Rebar_Bar_Type, IN[2]=firstItem, IN[3]=Start_Hook_Type, IN[4]=End_Hook_Type, IN[5]=if_2, IN[6]=if_3, IN[7]=ofRepeatedItem, IN[8]=ofRepeatedItem_2)  # "Script básico para cerar una barra de armadura con varias lineas unidas"; CPython3
# ---------- script_básico_para_cerar_una_3.python (181 lines) ----------
# Dynamo CPython 3 – Revit 2026.3
import clr

# Revit API
clr.AddReference('RevitAPI')
from Autodesk.Revit.DB import *
from Autodesk.Revit.DB.Structure import *

# RevitServices
clr.AddReference('RevitServices')
from RevitServices.Persistence import DocumentManager
from RevitServices.Transactions import TransactionManager

# RevitNodes (para ToRevitType)
clr.AddReference('RevitNodes')
import Revit
clr.ImportExtensions(Revit.GeometryConversion)  # ToRevitType() en DS Geometry
clr.ImportExtensions(Revit.Elements)

from System.Collections.Generic import List

doc = DocumentManager.Instance.CurrentDBDocument

# -------------------- utilidades --------------------
def ensure_list(x):
    if isinstance(x, list): return x
    return [] if x is None else [x]

def ds_vector_to_xyz(v):
    """Acepta DS.Vector o [x,y,z] o XYZ y devuelve XYZ."""
    if v is None:
        return None
    # Ya es XYZ
    if isinstance(v, XYZ):
        return v
    # DS.Vector
    if hasattr(v, "ToRevitType"):
        return v.ToRevitType()
    # Lista/tupla
    try:
        return XYZ(float(v[0]), float(v[1]), float(v[2]))
    except:
        raise Exception("IN[8] (vector) debe ser DS.Vector, [x,y,z] o XYZ.")

def flatten_db_curves_from_any(curves_any):
    """
    Convierte una entrada que puede ser:
      - DS.Curve, DS.PolyCurve, DS.NurbsCurve, etc.
      - Autodesk.Revit.DB.Curve
      - lista mixta de lo anterior
    en List[Autodesk.Revit.DB.Curve]
    """
    def add_curve(c, acc):
        if c is None: 
            return
        # Ya es curva DB
        if isinstance(c, Curve):
            acc.Add(c)
            return
        # DS PolyCurve -> iterar subcurvas
        if hasattr(c, "Curves"):
            try:
                for sc in c.Curves():
                    add_curve(sc, acc)
                return
            except:
                pass
        # Cualquier DS.Curve con ToRevitType()
        if hasattr(c, "ToRevitType"):
            db_c = c.ToRevitType()
            # Algunos retornan directamente Curve, otros listas
            if isinstance(db_c, Curve):
                acc.Add(db_c)
                return
            # Si fuera una colección, intentar iterarla
            try:
                for sc in db_c:
                    add_curve(sc, acc)
                return
            except:
                pass
        # Último recurso: rechazar
        raise Exception("No se pudo convertir una curva a Autodesk.Revit.DB.Curve.")

    acc = List[Curve]()
    # Si viene una sola curva
    if not isinstance(curves_any, list):
        add_curve(curves_any, acc)
        return acc
    # Lista de curvas
    for c in curves_any:
        add_curve(c, acc)
    return acc

# -------------------- mapas de enums --------------------
bar_style_map = {
    0: RebarStyle.Standard,
    1: RebarStyle.StirrupTie
}
hook_orientation_map = {
    0: RebarHookOrientation.Left,
    1: RebarHookOrientation.Right
}

# -------------------- Entradas --------------------
curvas_in          = IN[0]                             # curva / lista / lista de listas (DS o DB)
rebar_bar_type     = UnwrapElement(IN[1])              # RebarBarType
bar_style          = bar_style_map.get(IN[2], RebarStyle.Standard)
start_hook_type    = UnwrapElement(IN[3]) if IN[3] else None  # RebarHookType o None
end_hook_type      = UnwrapElement(IN[4]) if IN[4] else None  # RebarHookType o None
start_hook_orient  = hook_orientation_map.get(IN[5], RebarHookOrientation.Left)
end_hook_orient    = hook_orientation_map.get(IN[6], RebarHookOrientation.Left)
hosts_in           = ensure_list(UnwrapElement(IN[7]))  # Element o lista
vectors_in         = ensure_list(IN[8])                 # DS.Vector/XYZ/[x,y,z] o lista

# Normalizar vectores a XYZ
vectors_xyz = [ds_vector_to_xyz(v) for v in vectors_in if v is not None]
if not vectors_xyz:
    raise Exception("Debes proporcionar al menos un vector (IN[8]).")

rebars = []

TransactionManager.Instance.EnsureInTransaction(doc)

try:
    # Caso 1: lista de listas (varias barras independientes)
    if isinstance(curvas_in, list) and curvas_in and isinstance(curvas_in[0], list):
        for i, subcurvas in enumerate(curvas_in):
            host = hosts_in[i] if len(hosts_in) > 1 else hosts_in[0]
            norm = vectors_xyz[i] if len(vectors_xyz) > 1 else vectors_xyz[0]
            db_curves = flatten_db_curves_from_any(subcurvas)
            if db_curves.Count == 0:
                continue
            rb = Rebar.CreateFromCurves(
                doc,
                bar_style,
                rebar_bar_type,
                start_hook_type,
                end_hook_type,
                host,
                norm,
                db_curves,
                start_hook_orient,
                end_hook_orient,
                True,   # useExistingShapeIfPossible
                True    # createNewShape
            )
            rebars.append(rb)

    # Caso 2: lista de curvas (una sola barra con varias líneas/arcos)
    elif isinstance(curvas_in, list) and curvas_in:
        host = hosts_in[0]
        norm = vectors_xyz[0]
        db_curves = flatten_db_curves_from_any(curvas_in)
        rb = Rebar.CreateFromCurves(
            doc, bar_style, rebar_bar_type,
            start_hook_type, end_hook_type,
            host, norm, db_curves,
            start_hook_orient, end_hook_orient,
            True, True
        )
        rebars.append(rb)

    # Caso 3: una sola curva
    else:
        host = hosts_in[0]
        norm = vectors_xyz[0]
        db_curves = flatten_db_curves_from_any([curvas_in])
        rb = Rebar.CreateFromCurves(
            doc, bar_style, rebar_bar_type,
            start_hook_type, end_hook_type,
            host, norm, db_curves,
            start_hook_orient, end_hook_orient,
            True, True
        )
        rebars.append(rb)

finally:
    TransactionManager.Instance.TransactionTaskDone()

OUT = rebars
# ----------------------------------------
watch_2 = Watch(script_básico_para_cerar_una_3)
watch_3 = Watch(if_)
watch_4 = Watch(aplana_lista_y_transforma_curvas)
watch_5 = Watch(ofRepeatedItem)
watch_6 = Watch(if_3)
watch_7 = Watch(if_2)
script_básico_para_cerar_una_4 = Python(IN[0]=if_4, IN[1]=Rebar_Bar_Type, IN[2]=firstItem, IN[3]=Start_Hook_Type, IN[4]=End_Hook_Type, IN[5]=if_2, IN[6]=if_3, IN[7]=ofRepeatedItem, IN[8]=ofRepeatedItem_2)  # "Script básico para cerar una barra de armadura con una sola linea"; CPython3
# ---------- script_básico_para_cerar_una_4.python (137 lines) ----------
# Dynamo CPython 3 – Revit 2026.3
import clr

# Revit API
clr.AddReference('RevitAPI')
from Autodesk.Revit.DB import *
from Autodesk.Revit.DB.Structure import *

# RevitServices
clr.AddReference('RevitServices')
from RevitServices.Persistence import DocumentManager
from RevitServices.Transactions import TransactionManager

# RevitNodes (ToRevitType)
clr.AddReference('RevitNodes')
import Revit
clr.ImportExtensions(Revit.GeometryConversion)
clr.ImportExtensions(Revit.Elements)

from System.Collections.Generic import List

doc = DocumentManager.Instance.CurrentDBDocument

# ---------------- utilidades ----------------
def ensure_list(x):
    if isinstance(x, list): return x
    return [] if x is None else [x]

def ds_vector_to_xyz(v):
    """Acepta DS.Vector, XYZ o [x,y,z] y devuelve XYZ."""
    if v is None:
        return None
    if isinstance(v, XYZ):
        return v
    if hasattr(v, "ToRevitType"):
        return v.ToRevitType()
    try:
        return XYZ(float(v[0]), float(v[1]), float(v[2]))
    except:
        raise Exception("IN[8] (vector) debe ser DS.Vector, XYZ o [x,y,z].")

def flatten_db_curves_from_any(any_curves):
    """
    Convierte una curva/colección (DS o DB) en List[DB.Curve].
    Soporta DS.PolyCurve/NurbsCurve descomponiéndolas.
    """
    def add_curve(c, acc):
        if c is None: return
        if isinstance(c, Curve):
            acc.Add(c); return
        # DS PolyCurve tiene Curves()
        if hasattr(c, "Curves"):
            try:
                for sc in c.Curves():
                    add_curve(sc, acc)
                return
            except:
                pass
        # Cualquier DS curve con ToRevitType
        if hasattr(c, "ToRevitType"):
            db_c = c.ToRevitType()
            if isinstance(db_c, Curve):
                acc.Add(db_c); return
            try:
                for sc in db_c:
                    add_curve(sc, acc)
                return
            except:
                pass
        raise Exception("No se pudo convertir una curva a Autodesk.Revit.DB.Curve.")
    acc = List[Curve]()
    if isinstance(any_curves, list):
        for c in any_curves: add_curve(c, acc)
    else:
        add_curve(any_curves, acc)
    return acc

def pick_by_index(lst, i):
    """Devuelve lst[i] si existe; si no, el primero (para usar uno para todos)."""
    return lst[i] if len(lst) > 1 else lst[0]

# ---------------- mapas de enums ----------------
bar_style_map = {0: RebarStyle.Standard, 1: RebarStyle.StirrupTie}
hook_orient_map = {0: RebarHookOrientation.Left, 1: RebarHookOrientation.Right}

# ---------------- Entradas ----------------
curvas_por_rebar = ensure_list(IN[0])                 # cada item: curva o lista de curvas (DS o DB)
rebar_bar_type    = UnwrapElement(IN[1])              # RebarBarType
bar_style_in      = IN[2]
start_hook_type   = UnwrapElement(IN[3]) if IN[3] else None
end_hook_type     = UnwrapElement(IN[4]) if IN[4] else None
start_hook_or_in  = IN[5]
end_hook_or_in    = IN[6]
hosts_in          = ensure_list(UnwrapElement(IN[7])) # Element(s)
vectors_in        = ensure_list(IN[8])                # DS.Vector/XYZ/[x,y,z]

# Normalizar enums si vienen como enteros
bar_style = bar_style_map.get(bar_style_in, bar_style_in if isinstance(bar_style_in, RebarStyle) else RebarStyle.Standard)
start_hook_orient = hook_orient_map.get(start_hook_or_in, start_hook_or_in if isinstance(start_hook_or_in, RebarHookOrientation) else RebarHookOrientation.Left)
end_hook_orient   = hook_orient_map.get(end_hook_or_in, end_hook_or_in if isinstance(end_hook_or_in, RebarHookOrientation) else RebarHookOrientation.Left)

# Normalizar vectores
vectors_xyz = [ds_vector_to_xyz(v) for v in vectors_in if v is not None]
if not vectors_xyz:
    raise Exception("Debes proporcionar al menos un vector en IN[8].")

# ---------------- Crear barras ----------------
rebars = []
TransactionManager.Instance.EnsureInTransaction(doc)
try:
    for i, item in enumerate(curvas_por_rebar):
        host  = pick_by_index(hosts_in, i)
        norm  = pick_by_index(vectors_xyz, i)
        # cada 'item' puede ser curva suelta o lista de curvas
        curves_list = item if isinstance(item, list) else [item]
        db_curves = flatten_db_curves_from_any(curves_list)
        if db_curves.Count == 0:
            continue
        rb = Rebar.CreateFromCurves(
            doc,
            bar_style,
            rebar_bar_type,
            start_hook_type,
            end_hook_type,
            host,
            norm,
            db_curves,
            start_hook_orient,
            end_hook_orient,
            True,   # useExistingShapeIfPossible
            True    # createNewShape
        )
        rebars.append(rb)
finally:
    TransactionManager.Instance.TransactionTaskDone()

OUT = rebars
# ----------------------------------------
watch_8 = Watch(script_básico_para_cerar_una_4)
watch_9 = Watch(list_create)
watch_10 = Watch(code_block)
watch_11 = Watch(Rebar_Bar_Type)
