# Dynamo custom node Rebar_CenterLine.dyf (Dynamo 3.6.0.9395)
# category: 01_Nodos_CQING
# Obtiene la CenterLine de una barra recta

Rebar = Input(Rebar: var[]..[])  # Nombre de entrada por defecto; cambie el nombre.
obtiene_la_centerline_de_rebar = Python(IN[0]=Rebar)  # CPython3
# ---------- obtiene_la_centerline_de_rebar.python (72 lines) ----------
import clr
clr.AddReference('RevitAPI')
from Autodesk.Revit.DB import *
from Autodesk.Revit.DB.Structure import Rebar, RebarInSystem, MultiplanarOption

clr.AddReference('RevitServices')
from RevitServices.Persistence import DocumentManager

clr.AddReference('RevitNodes')
import Revit
clr.ImportExtensions(Revit.Elements)
clr.ImportExtensions(Revit.GeometryConversion)

def as_list(x):
    return x if isinstance(x, list) else ([] if x is None else [x])

def curves_rebar_all_positions(r):
    """Rebar suelto: iterar todas las posiciones usando el overload transformado con índice."""
    curves_per_pos = []
    try:
        n = r.NumberOfBarPositions
    except:
        n = 1
    for i in range(max(1, n)):
        # Rebar tiene overload con MultiplanarOption + index
        crvs = r.GetTransformedCenterlineCurves(
            False,   # adjustForSelfIntersection
            False,   # suppressHooks
            False,   # suppressBendRadius
            MultiplanarOption.IncludeOnlyPlanarCurves,
            i        # barPositionIndex
        )
        curves_per_pos.append([c.ToProtoType() for c in crvs])
    return curves_per_pos

def curves_rebarinsystem_all_positions(ris):
    """RebarInSystem: en 2026 el método transformado exige índice -> iterar 0..N-1."""
    curves_per_pos = []
    try:
        n = ris.NumberOfBarPositions
    except:
        n = 1
    for i in range(max(1, n)):
        # OJO: en RIS el overload transformado (2026) no pide MultiplanarOption, sí índice
        crvs = ris.GetTransformedCenterlineCurves(
            False,   # adjustForSelfIntersection
            False,   # suppressHooks
            False,   # suppressBendRadius
            i        # barPositionIndex (0..N-1)
        )
        curves_per_pos.append([c.ToProtoType() for c in crvs])
    return curves_per_pos

def curves_any(wrapped):
    r = UnwrapElement(wrapped)
    if r is None:
        return []
    # Rebar individual
    if isinstance(r, Rebar):
        return curves_rebar_all_positions(r)
    # Rebar en sistema (set)
    if isinstance(r, RebarInSystem):
        return curves_rebarinsystem_all_positions(r)
    # Fallback genérico: intenta un GetCenterlineCurves sin índice (primera barra)
    try:
        crvs = r.GetCenterlineCurves(False, False, False, MultiplanarOption.IncludeOnlyPlanarCurves)
        return [[c.ToProtoType() for c in crvs]]
    except:
        return []

items = as_list(IN[0])
OUT = [curves_any(x) for x in items]
# ----------------------------------------
Line = Output(obtiene_la_centerline_de_rebar)
