# Dynamo custom node Rebar_Espaciado_Máximo.dyf (Dynamo 3.5.2.8914)
# category: 01_Nodos_CQING

Rebar = Input(Rebar: var[]..[])
Espaciado = Input(Espaciado: var[]..[])
convert_by_units = DynamoUnitConvert(Espaciado, MeasurementType="autodesk.unit.quantity:length-1.0.5", FromConversion="autodesk.unit.unit:meters-1.0.0", ToConversion="autodesk.unit.unit:feet-1.0.1")
Longitud_de_espaciado = Input(Longitud_de_espaciado: var[]..[])
convert_by_units_2 = DynamoUnitConvert(Longitud_de_espaciado, MeasurementType="autodesk.unit.quantity:length-1.0.5", FromConversion="autodesk.unit.unit:meters-1.0.0", ToConversion="autodesk.unit.unit:feet-1.0.1")
python_script = Python(IN[0]=Rebar, IN[1]=convert_by_units, IN[2]=convert_by_units_2)  # CPython3; unwired: IN[3], IN[4], IN[5], IN[6]
# ---------- python_script.python (79 lines) ----------
import clr

clr.AddReference('RevitServices')
import RevitServices
from RevitServices.Persistence import DocumentManager
from RevitServices.Transactions import TransactionManager

doc = DocumentManager.Instance.CurrentDBDocument

clr.AddReference('RevitAPI')
from Autodesk.Revit.DB import *
from Autodesk.Revit.DB.Structure import *

clr.AddReference("System")
from System.Collections.Generic import List

clr.AddReference('RevitNodes')
import Revit
clr.ImportExtensions(Revit.GeometryConversion)
clr.ImportExtensions(Revit.Elements)

def get_input(idx, default=None):
    try:
        val = IN[idx]
        if val is None:
            return default
        return val
    except IndexError:
        return default

def ensure_list(x):
    if isinstance(x, list):
        return x
    else:
        return [x]

# Entradas
rebarElements = ensure_list(UnwrapElement(get_input(0)))
spacing = get_input(1, 0)
arrayLengths = ensure_list(get_input(2, 0))  # Puede ser lista o escalar
barsOnNormalSide = get_input(3, True)
inclFirstBar = bool(get_input(4, True))
inclLastBar = bool(get_input(5, True))
convertUnits = get_input(6, False)

if spacing == 0 or not rebarElements or not arrayLengths:
    OUT = "Error: Entrada(s) inválida(s)."
else:
    # Conversión de unidades si aplica
    if convertUnits:
        spacing /= 304.8
        arrayLengths = [x/304.8 for x in arrayLengths]
    else:
        arrayLengths = [float(x) for x in arrayLengths]

    # Si sólo hay un valor de longitud, repetir para todos
    if len(arrayLengths) == 1 and len(rebarElements) > 1:
        arrayLengths = arrayLengths * len(rebarElements)

    # Si las longitudes y barras no coinciden, error
    if len(arrayLengths) != len(rebarElements):
        OUT = "Error: El número de barras y longitudes no coincide."
    else:
        TransactionManager.Instance.EnsureInTransaction(doc)
        outList = []
        for i, rebarElement in enumerate(rebarElements):
            if rebarElement is None:
                outList.append("Elemento nulo")
                continue
            sda = rebarElement.GetShapeDrivenAccessor()
            RebarShapeDrivenAccessor.SetLayoutAsMaximumSpacing(
                sda, spacing, arrayLengths[i], barsOnNormalSide, inclFirstBar, inclLastBar
            )
            outList.append(rebarElement)
        TransactionManager.Instance.TransactionTaskDone()
        doc.Regenerate()
        uidoc = DocumentManager.Instance.CurrentUIApplication.ActiveUIDocument
        uidoc.RefreshActiveView()
        OUT = outList
# ----------------------------------------
Rebar_2 = Output(python_script)  # "Rebar"
