# Dynamo custom node Rebar_Estribos_135deg.dyf (Dynamo 3.6.0.9395)
# category: 01_Nodos_CQING

Curvas = Input(Curvas: var[]..[])  # Nombre de entrada por defecto; cambie el nombre.
aplana_lista_y_transforma_curvas = Python(IN[0]=Curvas)  # "Aplana lista y transforma curvas de Dynamo a Revit"; CPython3
# ---------- aplana_lista_y_transforma_curvas.python (48 lines) ----------
import clr
#//
clr.AddReference('RevitAPI')
#//
from Autodesk.Revit.DB import *
#//
from Autodesk.Revit.DB.Structure import *
#//
clr.AddReference('RevitServices')
#//
from RevitServices.Persistence import DocumentManager
from RevitServices.Transactions import TransactionManager
#//
clr.AddReference('RevitNodes')
import Revit
clr.ImportExtensions(Revit.GeometryConversion)
#//
import System
from System.Collections.Generic import List
#//
doc = DocumentManager.Instance.CurrentDBDocument
#//


#//
def flatten_and_get_revit_curves(curves):
    """Profundiza cualquier lista, ignora None, convierte PolyCurve y curvas simples."""
    result = []
    if curves is None:
        return result
    if isinstance(curves, list):
        for c in curves:
            result.extend(flatten_and_get_revit_curves(c))
    else:
        try:
            # PolyCurve
            for sc in curves.Curves:
                try:
                    result.append(sc.ToRevitType())
                except:
                    continue
        except:
            try:
                result.append(curves.ToRevitType())
            except:
                pass
    return result
OUT = flatten_and_get_revit_curves(IN[0])
# ----------------------------------------
vector = Input(vector: var[]..[])  # Nombre de entrada por defecto; cambie el nombre.
python_script = Python(IN[0]=aplana_lista_y_transforma_curvas, IN[1]=vector)  # CPython3
# ---------- python_script.python (125 lines) ----------
import clr
clr.AddReference('RevitAPI')
from Autodesk.Revit.DB import Curve, XYZ, Line

# IN[0]: Lista de Autodesk.Revit.DB.Curve (loop)
# IN[1]: Vector normal deseado (Autodesk.Revit.DB.XYZ)
curves = IN[0]
desired_norm = IN[1]
TOL = 1e-7

def points_equal(p1, p2, tol=TOL):
    return (abs(p1.X - p2.X) < tol) and (abs(p1.Y - p2.Y) < tol) and (abs(p1.Z - p2.Z) < tol)

def reorder_curves(curves):
    # Ordena las curvas para que cada final coincida con el inicio de la siguiente
    if not curves: return []
    ordered = [curves[0]]
    curves_left = list(curves[1:])
    while curves_left:
        end_pt = ordered[-1].GetEndPoint(1)
        found = False
        for idx, c in enumerate(curves_left):
            if points_equal(end_pt, c.GetEndPoint(0)):
                ordered.append(c)
                del curves_left[idx]
                found = True
                break
            elif points_equal(end_pt, c.GetEndPoint(1)):
                # Invierte la curva si está al revés
                if hasattr(c, "CreateReversed"):
                    c_rev = c.CreateReversed()
                    ordered.append(c_rev)
                else:
                    c_rev = Line.CreateBound(c.GetEndPoint(1), c.GetEndPoint(0))
                    ordered.append(c_rev)
                del curves_left[idx]
                found = True
                break
        if not found:
            # No se pudo cerrar, aborta
            break
    return ordered

def adjust_curve_loop_points(curves, tol=TOL):
    # Ajusta los finales de líneas para que coincidan con el inicio de la siguiente
    n = len(curves)
    fixed = []
    for i in range(n):
        c = curves[i]
        p_start = c.GetEndPoint(0)
        p_end = c.GetEndPoint(1)
        p_next = curves[(i+1)%n].GetEndPoint(0)
        # Solo para líneas, ajusta el punto final
        if not points_equal(p_end, p_next, tol) and isinstance(c, Line):
            fixed.append(Line.CreateBound(p_start, p_next))
        else:
            fixed.append(c)
    return fixed

def force_close_loop(curves, tol=TOL):
    # Si el último punto no coincide con el primero, corrige la última curva
    n = len(curves)
    if n < 2:
        return curves
    first_pt = curves[0].GetEndPoint(0)
    last_curve = curves[-1]
    last_pt_start = last_curve.GetEndPoint(0)
    last_pt_end = last_curve.GetEndPoint(1)
    if not points_equal(last_pt_end, first_pt, tol):
        # Si la última curva es una línea, la recrea para que termine justo en el inicio
        if isinstance(last_curve, Line):
            curves[-1] = Line.CreateBound(last_pt_start, first_pt)
    return curves

def get_loop_normal(curves):
    # Usa los tres primeros puntos para calcular el plano
    if len(curves) < 2:
        return None
    p0 = curves[0].GetEndPoint(0)
    p1 = curves[0].GetEndPoint(1)
    p2 = curves[1].GetEndPoint(1)
    v1 = XYZ(p1.X - p0.X, p1.Y - p0.Y, p1.Z - p0.Z)
    v2 = XYZ(p2.X - p1.X, p2.Y - p1.Y, p2.Z - p1.Z)
    nx = v1.Y * v2.Z - v1.Z * v2.Y
    ny = v1.Z * v2.X - v1.X * v2.Z
    nz = v1.X * v2.Y - v1.Y * v2.X
    mag = (nx**2 + ny**2 + nz**2)**0.5
    if mag == 0:
        return None
    return XYZ(nx/mag, ny/mag, nz/mag)

def same_direction(vec1, vec2):
    dot = vec1.X*vec2.X + vec1.Y*vec2.Y + vec1.Z*vec2.Z
    return dot >= 0

# 1. Reordena para cerrar el loop
curves_ordered = reorder_curves(curves)
# 2. Ajusta puntos finales para cerrar perfectamente
curves_closed = adjust_curve_loop_points(curves_ordered, TOL)
# 3. Fuerza cierre perfecto del loop
curves_closed = force_close_loop(curves_closed, TOL)
# 4. Calcula la normal
loop_norm = get_loop_normal(curves_closed)
# 5. Orienta según la normal deseada
if loop_norm and desired_norm:
    if not same_direction(loop_norm, desired_norm):
        curves_closed = curves_closed[::-1]
        # Forzar de nuevo el cierre después de invertir
        curves_closed = adjust_curve_loop_points(curves_closed, TOL)
        curves_closed = force_close_loop(curves_closed, TOL)

# Última validación
def is_curve_loop(curves, tol=TOL):
    n = len(curves)
    for i in range(n):
        p_end = curves[i].GetEndPoint(1)
        p_next = curves[(i+1)%n].GetEndPoint(0)
        if not points_equal(p_end, p_next, tol):
            return False
    return True

if is_curve_loop(curves_closed, TOL):
    OUT = curves_closed
else:
    OUT = "Error: Las curvas aún NO forman un CurveLoop válido."
# ----------------------------------------
Host_Element = Input(Host_Element: var[]..[])  # Nombre de entrada por defecto; cambie el nombre.
Rebar_Bar_Type = Input(Rebar_Bar_Type: var[]..[])  # Nombre de entrada por defecto; cambie el nombre.
rebar_Hook_Type = Custom[Rebar_Hook_Type]()  # Obtiene las formas de gancho de armaduras
python_script_2 = Python(IN[0]=vector)  # CPython3
# ---------- python_script_2.python (21 lines) ----------
from Autodesk.Revit.DB import XYZ

norm_in = IN[0]  # <-- ¡No olvides esta línea!
norm = None
try:
    # Si es un Vector de Dynamo
    norm = norm_in.ToXyz()
except:
    try:
        # Si ya es un XYZ de Revit
        _ = norm_in.X
        norm = norm_in
    except:
        try:
            # Si es una lista/tupla de 3 números
            if isinstance(norm_in, (list, tuple)) and len(norm_in) == 3:
                norm = XYZ(*norm_in)
        except:
            norm = None

OUT = norm
# ----------------------------------------
python_script_3 = Python(IN[0]=python_script, IN[1]=Host_Element, IN[2]=Rebar_Bar_Type, IN[3]=rebar_Hook_Type.Stirrup_Tie_Seismic_135_deg, IN[4]=python_script_2)  # CPython3
# ---------- python_script_3.python (63 lines) ----------
import clr
clr.AddReference('RevitAPI')
from Autodesk.Revit.DB import *
from Autodesk.Revit.DB.Structure import *

clr.AddReference('RevitServices')
from RevitServices.Persistence import DocumentManager
from RevitServices.Transactions import TransactionManager

clr.AddReference('RevitNodes')
import Revit
clr.ImportExtensions(Revit.Elements)
clr.ImportExtensions(Revit.GeometryConversion)

import System
from System.Collections.Generic import List

doc = DocumentManager.Instance.CurrentDBDocument

# ENTRADAS
revit_curves = IN[0]                 # Lista de Autodesk.Revit.DB.Curve (ya lista y plana)
host = UnwrapElement(IN[1])          # Elemento host (viga, columna, etc.)
rebar_type = UnwrapElement(IN[2])    # Tipo de barra (RebarBarType)
hook_type = UnwrapElement(IN[3])     # Tipo de gancho 135° (RebarHookType)
norm_in = IN[4]                      # Vector normal (puede ser Vector de Dynamo o XYZ de Revit)

# --- Conversión del vector normal ---
if hasattr(norm_in, "ToXyz"):
    norm = norm_in.ToXyz()  # Vector de Dynamo a XYZ de Revit
elif isinstance(norm_in, XYZ):
    norm = norm_in          # Ya es un XYZ
else:
    norm = None

# Validación rápida de la normal
if not norm or not hasattr(norm, "X"):
    OUT = "Error: El vector normal (IN[4]) está vacío o no es Autodesk.Revit.DB.XYZ"
else:
    rebar_style = RebarStyle.StirrupTie
    useExistingShapeIfPossible = False
    createNewShape = True

    bar_terminations = BarTerminationsData(doc)
    bar_terminations.HookTypeIdAtStart = hook_type.Id
    bar_terminations.HookTypeIdAtEnd = hook_type.Id

    TransactionManager.Instance.EnsureInTransaction(doc)
    try:
        rebar = Rebar.CreateFromCurves(
            doc,
            rebar_style,
            rebar_type,
            host,
            norm,
            List[Curve](revit_curves),
            bar_terminations,
            useExistingShapeIfPossible,
            createNewShape
        )
        OUT = rebar.ToDSType(False)
    except Exception as e:
        OUT = "Error: {}".format(e)
    TransactionManager.Instance.TransactionTaskDone()
# ----------------------------------------
Rebar = Output(python_script_3)
watch = Watch(vector)
