# Dynamo custom node Rebar_Hook_Type.dyf (Dynamo 3.6.0.9395)
# category: 01_Nodos_CQING
# Obtiene las formas de gancho de armaduras

obtiene_todos_los_elementtype = Python()  # "Obtiene todos los ElementType del documento de Revit"; CPython3
# ---------- obtiene_todos_los_elementtype.python (12 lines) ----------
import clr
clr.AddReference('RevitServices')
from RevitServices.Persistence import DocumentManager
doc = DocumentManager.Instance.CurrentDBDocument

clr.AddReference('RevitAPI')
from Autodesk.Revit.DB import FilteredElementCollector, ElementType

# Obtener todos los ElementType del documento
element_types = FilteredElementCollector(doc).OfClass(ElementType).ToElements()

OUT = element_types
# ----------------------------------------
name = ElementType.Name(elementType=obtiene_todos_los_elementtype)
code_block = CodeBlock(a=name) { a=="Standard - 90 deg."; }
filterByBoolMask = List.FilterByBoolMask(list=obtiene_todos_los_elementtype, mask=code_block)
identity = Object.Identity(object=filterByBoolMask.in)
firstItem = List.FirstItem(list=identity)
code_block_2 = CodeBlock(a=name) { a=="Standard - 180 deg."; }
filterByBoolMask_2 = List.FilterByBoolMask(list=obtiene_todos_los_elementtype, mask=code_block_2)
identity_2 = Object.Identity(object=filterByBoolMask_2.in)
firstItem_2 = List.FirstItem(list=identity_2)
code_block_3 = CodeBlock(a=name) { a=="Stirrup/Tie Seismic - 135 deg."; }
filterByBoolMask_3 = List.FilterByBoolMask(list=obtiene_todos_los_elementtype, mask=code_block_3)
identity_3 = Object.Identity(object=filterByBoolMask_3.in)
firstItem_3 = List.FirstItem(list=identity_3)

# group: Para Revit 2026.3
# Descripción <Haga doble clic aquí para editar la descripción del grupo>
obtiene_todos_los_elementtype_2 = Python()  # "Obtiene todos los ElementType del documento de Revit"; CPython3
# ---------- obtiene_todos_los_elementtype_2.python (28 lines) ----------
import clr
# RevitServices
clr.AddReference('RevitServices')
from RevitServices.Persistence import DocumentManager
doc = DocumentManager.Instance.CurrentDBDocument

# Revit API
clr.AddReference('RevitAPI')
from Autodesk.Revit.DB import FilteredElementCollector, BuiltInParameter
from Autodesk.Revit.DB import Element
from Autodesk.Revit.DB import ElementType

# Revit API – Structure
from Autodesk.Revit.DB.Structure import RebarHookType

# ---- Solo tipos de gancho de armadura ----
hooks = (FilteredElementCollector(doc)
         .OfClass(RebarHookType)
         .WhereElementIsElementType()      # asegura que son tipos
         .ToElements())

# Nombres legibles (soporta plantillas localizadas)
hook_names = []
for h in hooks:
    n = h.get_Parameter(BuiltInParameter.ALL_MODEL_TYPE_NAME)
    hook_names.append(n.AsString() if n else h.Name)

OUT = hooks, hook_names
# ----------------------------------------
code_block_4 = CodeBlock(A=obtiene_todos_los_elementtype_2) { A[0]; }
name_2 = ElementType.Name(elementType=code_block_4)
code_block_5 = CodeBlock(a=name_2) { a=="Standard - 90 deg."; }
filterByBoolMask_4 = List.FilterByBoolMask(list=code_block_4, mask=code_block_5)
identity_4 = Object.Identity(object=filterByBoolMask_4.in)
firstItem_4 = List.FirstItem(list=identity_4)
code_block_6 = CodeBlock(a=name_2) { a=="Standard - 180 deg."; }
filterByBoolMask_5 = List.FilterByBoolMask(list=code_block_4, mask=code_block_6)
identity_5 = Object.Identity(object=filterByBoolMask_5.in)
firstItem_5 = List.FirstItem(list=identity_5)
code_block_7 = CodeBlock(a=name_2) { a=="Stirrup/Tie Seismic - 135 deg."; }
filterByBoolMask_6 = List.FilterByBoolMask(list=code_block_4, mask=code_block_7)
identity_6 = Object.Identity(object=filterByBoolMask_6.in)
firstItem_6 = List.FirstItem(list=identity_6)

Standard_90_deg = Output(firstItem_4)  # "Standard - 90 deg."
Standard_180_deg = Output(firstItem_5)  # "Standard - 180 deg."
Stirrup_Tie_Seismic_135_deg = Output(firstItem_6)  # "Stirrup/Tie Seismic - 135 deg."
watch = Watch(obtiene_todos_los_elementtype)
watch_2 = Watch(name)
