# Dynamo custom node Rebars_Hospedadas.dyf (Dynamo 3.6.0.9395)
# category: 01_Nodos_CQING
# Obtiene las barras de armaduras hospedadas

Elementos = Input(Elementos: var[]..[])  # Elementos de concreto, vigas, columnas, zapatas, etc.
rebars_hospedadas = Python(IN[0]=Elementos)  # CPython3
# ---------- rebars_hospedadas.python (59 lines) ----------
# Cargar bibliotecas estándar de Python y CLR
import clr
import sys

# Cargar las bibliotecas de Revit API
clr.AddReference('RevitAPI')
from Autodesk.Revit.DB import *
from Autodesk.Revit.DB.Structure import RebarHostData

# Cargar las bibliotecas de RevitServices para acceder al documento actual
clr.AddReference('RevitServices')
import RevitServices
from RevitServices.Persistence import DocumentManager

# Obtener el documento actual
doc = DocumentManager.Instance.CurrentDBDocument

# Función auxiliar para asegurar que la entrada sea siempre una lista
def to_list(obj):
    if hasattr(obj, '__iter__') and not isinstance(obj, str):
        return obj
    else:
        return [obj]

# Entrada: Elementos anfitriones (Vigas, Columnas, Pisos, Cimentaciones)
hosts = to_list(UnwrapElement(IN[0]))

results_list = []

# Iterar sobre cada elemento anfitrión
for host in hosts:
    hosted_elements = []
    
    try:
        # Verificar si el elemento es válido para alojar refuerzo
        host_data = RebarHostData.GetRebarHostData(host)
        
        if host_data:
            # 1. Obtener Rebars (Barras individuales)
            # CORRECCIÓN: El método es GetRebarsInHost (plural) y devuelve los elementos directamente
            rebars = host_data.GetRebarsInHost()
            for r in rebars:
                hosted_elements.append(r)
            
            # 2. Obtener Fabric Sheets (Mallas electrosoldadas)
            # CORRECCIÓN: El método es GetFabricSheetsInHost (plural)
            fabrics = host_data.GetFabricSheetsInHost()
            for f in fabrics:
                hosted_elements.append(f)
                    
    except Exception as e:
        # Si hay un error, lo agregamos a la lista como texto para identificarlo
        hosted_elements.append("Error: " + str(e))
        
    # Añadir la sublista de refuerzos a la lista principal
    results_list.append(hosted_elements)

# Salida: Lista de listas con los refuerzos encontrados
OUT = results_list
# ----------------------------------------
Rebars = Output(rebars_hospedadas)
