# Dynamo custom node Recubrimiento_De_Armadura.dyf (Dynamo 3.5.2.8914)
# category: 01_Nodos_CQING
# Obtiene el Recubrimiento de armadura de elementos estructurales.

Elemento = Input(Elemento: var[]..[])
code_block = CodeBlock { "Recubrimiento de armadura - Cara inferior"; "Recubrimiento de armadura - Cara superior"; }
getParameterValueByName = Element.GetParameterValueByName(element=Elemento, parameterName=code_block.out0)
getParameterValueByName_2 = Element.GetParameterValueByName(element=Elemento, parameterName=code_block.out1)
list_create = List.Create(item0=getParameterValueByName, item1=getParameterValueByName_2)
python_script = Python(IN[0]=list_create)  # CPython3
# ---------- python_script.python (9 lines) ----------
def limpiar_nulls(input_data):
    # Si es una lista, filtra los nulls (None en Python)
    if isinstance(input_data, list):
        return [x for x in input_data if x is not None]
    else:
        # Si no es lista, revisa si es null, si no lo es lo devuelve
        return None if input_data is None else input_data

OUT = limpiar_nulls(IN[0])
# ----------------------------------------
flatten = List.Flatten(list=python_script)
code_block_2 = CodeBlock { "Longitud"; }
getParameterValueByName_3 = Element.GetParameterValueByName(element=flatten, parameterName=code_block_2)
python_script_2 = Python(IN[0]=getParameterValueByName_3)  # CPython3; same code as python_script
firstItem = List.FirstItem(list=python_script_2)
code_block_3 = CodeBlock(Recub=firstItem) { Recub/1000; }
Recubrimiento_en_m = Output(code_block_3)
code_block_4 = CodeBlock(Recub=python_script_2) { Recub/1000; }
Mas_recubrimientos_en_m = Output(code_block_4)
