# Dynamo custom node References_Rebars.dyf (Dynamo 3.6.0.9395)
# category: 01_Nodos_CQING
# Obtiene todas las GeometryReferences y entidades geometricas de rebars.

Element = Input(Element: var[]..[])  # Lista plana de Rebar
Views = Input(Views: var[]..[])  # Lista plana de vitas
referencias_de_rebar = Python(IN[0]=Element, IN[1]=Views)  # CPython3
# ---------- referencias_de_rebar.python (154 lines) ----------
import clr

# Importar bibliotecas principales de Revit API
clr.AddReference('RevitAPI')
from Autodesk.Revit.DB import *

# Importar Servicios de Documentos
clr.AddReference('RevitServices')
import RevitServices
from RevitServices.Persistence import DocumentManager

# Importar bibliotecas de Dynamo para conversión de geometría
clr.AddReference('RevitNodes')
import Revit
clr.ImportExtensions(Revit.GeometryConversion)

doc = DocumentManager.Instance.CurrentDBDocument

# --- GESTIÓN ROBUSTA DE ENTRADAS ---
input_elements = UnwrapElement(IN[0])
input_views = UnwrapElement(IN[1]) # Nueva entrada para vistas

# 1. Normalizar Elementos a lista
if isinstance(input_elements, list):
    elements = input_elements
else:
    elements = [input_elements]

# 2. Normalizar Vistas a lista alineada con los elementos
if isinstance(input_views, list):
    views = input_views
    # Nota: Si la lista de vistas es más corta que la de elementos, 
    # el bucle 'zip' se detendrá en el más corto.
else:
    # Si es una sola vista, repetirla para cada elemento
    views = [input_views] * len(elements)

def get_separated_references(element, specific_view):
    """
    Extrae referencias separando Superficies de Líneas/Curvas.
    Usa la vista específica proporcionada para la geometría dependiente de vista.
    """
    # Listas para Superficies (Faces)
    s_refs = []
    s_geoms = []
    
    # Listas para Líneas (Edges, Curves, Points)
    c_refs = []
    c_geoms = []
    
    # Definir configuraciones de extracción
    options_list = []
    
    # 1. Configuración de Modelo (Geometría 3D pura, independiente de la vista)
    opt_model = Options()
    opt_model.ComputeReferences = True
    opt_model.DetailLevel = ViewDetailLevel.Fine
    opt_model.IncludeNonVisibleObjects = True 
    options_list.append(opt_model)
    
    # 2. Configuración de Vista Específica (Geometría proyectada/dependiente)
    if specific_view:
        try:
            opt_view = Options()
            opt_view.ComputeReferences = True
            opt_view.IncludeNonVisibleObjects = True
            # Asignamos la vista específica pasada por argumento
            opt_view.View = specific_view
            options_list.append(opt_view)
        except:
            pass # Si la vista no es válida, ignoramos esta opción

    def process_geometry_object(g):
        
        # --- CASO A: SÓLIDOS ---
        if isinstance(g, Solid):
            # Caras -> Lista de Superficies
            if g.Faces:
                for face in g.Faces:
                    if face.Reference:
                        s_refs.append(face.Reference)
                        s_geoms.append(face.ToProtoType())
            # Bordes -> Lista de Curvas
            if g.Edges:
                for edge in g.Edges:
                    if edge.Reference:
                        c = edge.AsCurve()
                        if c:
                            c_refs.append(edge.Reference)
                            c_geoms.append(c.ToProtoType())

        # --- CASO B: CURVAS ---
        elif isinstance(g, Curve):
            if g.Reference:
                c_refs.append(g.Reference)
                c_geoms.append(g.ToProtoType())

        # --- CASO C: PUNTOS ---
        elif isinstance(g, Point):
            if g.Reference:
                c_refs.append(g.Reference)
                c_geoms.append(g.ToProtoType())
                
        # --- CASO D: POLILÍNEAS ---
        elif isinstance(g, PolyLine):
             try:
                 pass 
             except:
                 pass

        # --- CASO E: INSTANCIAS ---
        elif isinstance(g, GeometryInstance):
            inst_geo = g.GetInstanceGeometry()
            if inst_geo:
                for sub_g in inst_geo:
                    process_geometry_object(sub_g)

    # Ejecutar la extracción para cada configuración
    for opt in options_list:
        try:
            geom_elem = element.get_Geometry(opt)
            if geom_elem:
                for geom_obj in geom_elem:
                    process_geometry_object(geom_obj)
        except Exception:
            continue
            
    return s_refs, s_geoms, c_refs, c_geoms

# Listas maestras de salida
out_surf_refs = []  # OUT[0]
out_surf_geoms = [] # OUT[1]
out_curve_refs = [] # OUT[2]
out_curve_geoms = []# OUT[3]

# Procesar pares (Elemento, Vista)
# Usamos 'zip' para iterar ambas listas simultáneamente
for elem, view in zip(elements, views):
    try:
        sr, sg, cr, cg = get_separated_references(elem, view)
        
        out_surf_refs.append(sr)
        out_surf_geoms.append(sg)
        out_curve_refs.append(cr)
        out_curve_geoms.append(cg)
    except Exception:
        # Si falla, mantenemos la estructura de la lista con listas vacías
        out_surf_refs.append([])
        out_surf_geoms.append([])
        out_curve_refs.append([])
        out_curve_geoms.append([])

# Estructura de salida ordenada
OUT = [out_surf_refs, out_surf_geoms, out_curve_refs, out_curve_geoms]
# ----------------------------------------
Referencias = Output(referencias_de_rebar)
