# Dynamo custom node SectionView_by_Linea_Base_Altura_VectorCamara_TipoVista_Plantilla_Nombre_Profundidad.dyf (Dynamo 3.6.0.9395)
# category: 01_Nodos_CQING
# Crea vistas en el punto central de las lineas. Las entradas  de Linea, Base, Altura, VectorCamara y Nombre deben ser listas de igual tamaño y estructura. Las entradas de TipoVista, Plantilla y Profundidad deben ser elementos individuales. (Linea) - (Base, double) - (Altura, double) - (VectorCamara) - (TipoVista, string) - (Plantilla, string) - (Nombre, string) - (Profundidad, double).

Linea = Input(Linea: var[]..[])  # Línea (Dynamo).
Base = Input(Base: var[]..[])  # Ancho de la vista (double).
Altura = Input(Altura: var[]..[])  # Altura de la vista (double).
VectorCamara = Input(VectorCamara: var[]..[])  # Vector en el que apunta la cámara de la vista (Dynamo).
TipoVista = Input(TipoVista: var[]..[])  # Tipo de vista que se le asignará a la vista (string).
Plantilla = Input(Plantilla: var[]..[])  # Plantilla de vista que se le asignará a la vista (string).
Nombre = Input(Nombre: var[]..[])  # Nombre que se le asignará a la vista (string).
Profundidad = Input(Profundidad: var[]..[])  # Profundidad de vista (double).
crea_vistas_de_las_columnas = Python(IN[0]=Linea, IN[1]=Base, IN[2]=Altura, IN[3]=VectorCamara, IN[4]=TipoVista, IN[5]=Plantilla, IN[6]=Nombre, IN[7]=Profundidad)  # CPython3
# ---------- crea_vistas_de_las_columnas.python (325 lines) ----------
# @DYNAMO v.3.6.0 © 2025 Autodesk, Inc.
# Script desarrollado para crear Vistas de Sección automatizadas

import clr
import System

# Importar librerías de Revit API
clr.AddReference('RevitAPI')
from Autodesk.Revit.DB import *

# Importar servicios de Dynamo y gestión de documentos
clr.AddReference('RevitServices')
import RevitServices
from RevitServices.Persistence import DocumentManager
from RevitServices.Transactions import TransactionManager

# Importar nodos de geometría de Dynamo
clr.AddReference('RevitNodes')
import Revit
clr.ImportExtensions(Revit.GeometryConversion)
clr.ImportExtensions(Revit.Elements)

# Obtener el documento actual
doc = DocumentManager.Instance.CurrentDBDocument

# ---------------------------------------------------------------------------
# FUNCIONES AUXILIARES
# ---------------------------------------------------------------------------

def to_list(obj):
    if obj is None: return []
    if isinstance(obj, list): return obj
    if hasattr(obj, "GetType") and obj.GetType().IsArray: return obj
    return [obj]

def meters_to_feet(meters):
    try:
        if meters is None: return 1.0
        return float(meters) * 3.2808399
    except:
        return 1.0

def to_revit_xyz(pt_or_vec):
    if pt_or_vec is None: return XYZ.Zero
    if isinstance(pt_or_vec, XYZ): return pt_or_vec
    try:
        return XYZ(float(pt_or_vec.X), float(pt_or_vec.Y), float(pt_or_vec.Z))
    except:
        return XYZ.Zero

def get_curve_geometry_and_convert(element):
    """
    Obtiene una Linea de Revit válida y asegura que esté en PIES.
    """
    if element is None: return None
    
    # Intento 1: Curva Nativa
    if isinstance(element, Curve): return element
    if hasattr(element, "GeometryCurve"): return element.GeometryCurve

    # Intento 2: Dynamo .ToRevitType
    try:
        if hasattr(element, "ToRevitType"): return element.ToRevitType()
    except: pass

    # Intento 3: Reconstrucción Manual (Metros -> Pies)
    try:
        if hasattr(element, "StartPoint") and hasattr(element, "EndPoint"):
            p1_raw = element.StartPoint
            p2_raw = element.EndPoint
            factor = 3.2808399
            p1 = XYZ(float(p1_raw.X) * factor, float(p1_raw.Y) * factor, float(p1_raw.Z) * factor)
            p2 = XYZ(float(p2_raw.X) * factor, float(p2_raw.Y) * factor, float(p2_raw.Z) * factor)
            return Line.CreateBound(p1, p2)
    except: pass
        
    return None

def find_view_template(doc, template_name):
    if not template_name or not isinstance(template_name, str): return None
    
    collector = FilteredElementCollector(doc).OfClass(View)
    for v in collector:
        try:
            if not v or not v.IsValidObject: continue
            if v.IsTemplate and v.Name == template_name:
                return v.Id
        except: 
            continue
    return None

def normalize_string(s):
    """Limpia strings para comparaciones seguras."""
    if not s: return ""
    return str(s).strip().lower()

def get_safe_name(element):
    """Obtiene el nombre de forma segura usando Parámetros BuiltIn."""
    try:
        # Intento 1: Parámetro interno (Más seguro contra corrupción)
        p = element.get_Parameter(BuiltInParameter.ALL_MODEL_TYPE_NAME)
        if p and p.HasValue:
            return p.AsString()
    except: pass
    
    try:
        # Intento 2: Propiedad directa
        return element.Name
    except:
        return ""

def get_strict_view_type_id(doc, type_name_input):
    """
    Busca o crea el Tipo de Vista EXACTO.
    ESTRATEGIA FORENSE: Busca por parámetro interno antes de intentar duplicar.
    """
    # 1. Preparar nombre objetivo
    target_name = "New Section Type"
    if type_name_input:
        if isinstance(type_name_input, list):
            if len(type_name_input) > 0: target_name = str(type_name_input[0]).strip()
        else:
            target_name = str(type_name_input).strip()
            
    target_clean = normalize_string(target_name)

    # 2. BÚSQUEDA EXHAUSTIVA
    # Buscamos en TODOS los ViewFamilyTypes sin filtrar familia primero
    # para asegurar que encontramos el nombre si existe.
    collector = FilteredElementCollector(doc).OfClass(ViewFamilyType)
    
    potential_source = None
    
    for vt in collector:
        try:
            if not vt.IsValidObject: continue
            
            # Obtener nombre seguro
            vt_name = get_safe_name(vt)
            
            # Comparar nombres
            if normalize_string(vt_name) == target_clean:
                # ¡ENCONTRADO! Devolvemos este ID inmediatamente.
                return vt.Id, vt_name
            
            # Guardamos un candidato para duplicar si es Sección (Building Section, etc)
            if not potential_source:
                try:
                    if vt.ViewFamily == ViewFamily.Section:
                        if "building" in normalize_string(vt_name) or "edificio" in normalize_string(vt_name) or "section" in normalize_string(vt_name):
                            potential_source = vt
                except: pass
        except: 
            continue
            
    # Si llegamos aquí, NO encontramos el nombre.
    
    # 3. Preparar Fuente para Duplicar
    if not potential_source:
        # Búsqueda secundaria de fuente
        col_sec = FilteredElementCollector(doc).OfClass(ViewFamilyType)
        for vt in col_sec:
            try:
                if vt.ViewFamily == ViewFamily.Section:
                    potential_source = vt
                    break
            except: continue
            
    if not potential_source:
        raise Exception("No existen tipos de familia 'Section' en el proyecto para duplicar.")

    # 4. DUPLICAR
    try:
        new_type = potential_source.Duplicate(target_name)
        return new_type.Id, target_name

    except Exception as e:
        # Si falla diciendo que ya existe, es un error fantasma muy raro.
        # Hacemos una última verificación desesperada por ID.
        raise Exception(f"CRÍTICO: El nombre '{target_name}' no se pudo encontrar ni crear. Error API: {str(e)}")

# ---------------------------------------------------------------------------
# LÓGICA PRINCIPAL
# ---------------------------------------------------------------------------

created_views = []

try:
    if IN[0] is None:
        created_views.append("Error: Input IN[0] es nulo")
    else:
        # Entradas
        lines_raw = to_list(IN[0]) 
        widths = to_list(IN[1])
        heights = to_list(IN[2])
        vectors_raw = to_list(IN[3])
        view_type_input = IN[4]
        template_name = IN[5]
        view_names = to_list(IN[6])
        view_depth = IN[7]

        TransactionManager.Instance.EnsureInTransaction(doc)
        
        # 1. OBTENER ID DEL TIPO (CRÍTICO)
        target_type_id = None
        try:
            target_type_id, final_type_name = get_strict_view_type_id(doc, view_type_input)
        except Exception as e:
            created_views.append(f"ERROR TIPO DE VISTA: {str(e)}")
            target_type_id = None

        # Plantilla
        template_id = find_view_template(doc, template_name)
        
        # Solo procedemos si tenemos el tipo correcto
        if target_type_id:
            count = len(lines_raw)
            for i in range(count):
                try:
                    # --- GEOMETRÍA ---
                    raw_item = lines_raw[i]
                    line = get_curve_geometry_and_convert(UnwrapElement(raw_item))
                    if not line: line = get_curve_geometry_and_convert(raw_item)
                    
                    if not line:
                        created_views.append(f"Error Item {i}: Geometría inválida")
                        continue
                    
                    # --- DATOS ---
                    w_m = widths[i] if i < len(widths) else widths[0]
                    h_m = heights[i] if i < len(heights) else heights[0]
                    raw_vec = vectors_raw[i] if i < len(vectors_raw) else vectors_raw[0]
                    direction_vec = to_revit_xyz(UnwrapElement(raw_vec))
                    v_name = view_names[i] if i < len(view_names) else f"Section {i}"
                    
                    w_ft = meters_to_feet(w_m)
                    h_ft = meters_to_feet(h_m)
                    d_ft = meters_to_feet(view_depth)

                    # --- TRANSFORMACIÓN (Centrado) ---
                    p_start = line.GetEndPoint(0)
                    p_end = line.GetEndPoint(1)
                    mid_x = (p_start.X + p_end.X) / 2.0
                    mid_y = (p_start.Y + p_end.Y) / 2.0
                    mid_z = (p_start.Z + p_end.Z) / 2.0
                    midpoint = XYZ(mid_x, mid_y, mid_z)
                    
                    view_dir = direction_vec.Normalize()
                    if view_dir.IsZeroLength(): view_dir = XYZ.BasisY

                    up = XYZ.BasisZ
                    right = view_dir.CrossProduct(up)
                    if right.IsZeroLength(): right = XYZ.BasisX
                    else: right = right.Normalize()
                    real_up = right.CrossProduct(view_dir).Normalize()

                    t = Transform.Identity
                    t.Origin = midpoint
                    t.BasisX = right
                    t.BasisY = real_up
                    t.BasisZ = view_dir.Negate()

                    # --- BOUNDING BOX ---
                    bb = BoundingBoxXYZ()
                    bb.Transform = t
                    depth_val = d_ft if d_ft > 0.001 else 1.0
                    bb.Min = XYZ(-w_ft/2, -h_ft/2, -depth_val) 
                    bb.Max = XYZ(w_ft/2, h_ft/2, 0.0) 
                    bb.MinEnabled = True
                    bb.MaxEnabled = True

                    # --- CREAR VISTA ---
                    new_view = ViewSection.CreateSection(doc, target_type_id, bb)
                    
                    # --- FORZADO DE TIPO ---
                    current_type_id = new_view.GetTypeId()
                    
                    # Comparación directa de ElementId
                    if current_type_id != target_type_id:
                        try:
                            new_view.ChangeTypeId(target_type_id)
                        except:
                            try:
                                p_type = new_view.get_Parameter(BuiltInParameter.ELEM_FAMILY_AND_TYPE_PARAM)
                                if p_type and not p_type.IsReadOnly:
                                    p_type.Set(target_type_id)
                            except:
                                pass

                    # Nombre
                    try:
                        new_view.Name = str(v_name)
                    except:
                        new_view.Name = f"{v_name}_{new_view.Id}"
                    
                    # Plantilla
                    if template_id:
                        try: new_view.ViewTemplateId = template_id
                        except: pass
                    
                    # Profundidad
                    try:
                        p = new_view.get_Parameter(BuiltInParameter.VIEWER_BOUND_OFFSET_FAR)
                        if p: p.Set(d_ft)
                    except: pass
                    
                    # Activar Recorte
                    try:
                        new_view.CropBoxActive = True
                        new_view.CropBoxVisible = True
                    except: pass
                        
                    created_views.append(new_view)

                except Exception as e_inner:
                    created_views.append(f"Error vista {i}: {str(e_inner)}")
        else:
            pass 

        TransactionManager.Instance.TransactionTaskDone()

except Exception as global_e:
    created_views.append(f"Error Fatal: {str(global_e)}")

OUT = created_views
# ----------------------------------------
Vista = Output(crea_vistas_de_las_columnas)
