# Dynamo custom node Set_Hook_Rotation_Angle_Rebar.dyf (Dynamo 3.5.2.8914)
# category: 01_Nodos_CQING
# Rota el gancho de la barra de armadura

Rebar = Input(Rebar: var[]..[])  # Nombre de entrada por defecto; cambie el nombre.
Start = Input(Start: var[]..[])  # Nombre de entrada por defecto; cambie el nombre.
End = Input(End: var[]..[])  # Nombre de entrada por defecto; cambie el nombre.
rota_el_ángulo_del_gancho_de_la = Python(IN[0]=Rebar, IN[1]=Start, IN[2]=End)  # "Rota el ángulo del gancho de la barra"; CPython3
# ---------- rota_el_ángulo_del_gancho_de_la.python (43 lines) ----------
# ==== ENTRADAS DE DYNAMO ====
rebars = IN[0]
rot_inicio = IN[1]      # Grados (fuera del plano) en extremo inicial, o None
rot_final = IN[2]       # Grados (fuera del plano) en extremo final, o None

import clr
clr.AddReference('RevitAPI')
from Autodesk.Revit.DB import *
clr.AddReference('RevitServices')
from RevitServices.Persistence import DocumentManager
from RevitServices.Transactions import TransactionManager

import math

doc = DocumentManager.Instance.CurrentDBDocument

def tolist(x):
    if isinstance(x, list): return x
    else: return [x]

def rotar_gancho(rebar, ang_inicio, ang_final):
    rvt_rebar = UnwrapElement(rebar)
    cambios = False
    # Rota gancho de inicio si aplica
    if ang_inicio is not None and rvt_rebar.GetHookTypeId(0) != ElementId.InvalidElementId:
        rvt_rebar.SetHookRotationAngle(math.radians(ang_inicio), 0)
        cambios = True
    # Rota gancho de final si aplica
    if ang_final is not None and rvt_rebar.GetHookTypeId(1) != ElementId.InvalidElementId:
        rvt_rebar.SetHookRotationAngle(math.radians(ang_final), 1)
        cambios = True
    return rebar if cambios else None

rebars = tolist(rebars)
output = []

TransactionManager.Instance.EnsureInTransaction(doc)
for rb in rebars:
    resultado = rotar_gancho(rb, rot_inicio, rot_final)
    output.append(resultado)
TransactionManager.Instance.TransactionTaskDone()

OUT = output if len(output) > 1 else output[0]
# ----------------------------------------
Rebar_2 = Output(rota_el_ángulo_del_gancho_de_la)  # "Rebar"
