# Dynamo custom node Vector_By_Line.dyf (Dynamo 3.6.0.9395)
# category: 01_Nodos_CQING
# Crea un vector a partir de una linea

Linea = Input(Linea: var)
identity = Object.Identity(object=Linea)
startPoint = Curve.StartPoint(curve=identity)
endPoint = Curve.EndPoint(curve=identity)
byTwoPoints = Vector.ByTwoPoints(start=startPoint, end=endPoint)
Vector = Output(byTwoPoints)
